# Grasshopper definition bottomleftright_supported_slab.gh (Grasshopper 1.0.7)
# plug-ins: Human, Weaverbird, TT Toolbox, karambaGH

shell_dimension_x = Slider(4.5, range=0..10)
shell_global_orientation = Slider(0, range=0..1)
shell_dimension_y_m = Slider(6, range=0..10)
num_of_faces_in_x_direction = Slider(45, range=0..100)
num_of_faces_in_y_direction = Slider(60, range=0..120)
num = Number(shell_dimension_x)
num_2 = Number(shell_dimension_y_m)
num_3 = Number(num_of_faces_in_x_direction)
num_4 = Number(num_of_faces_in_y_direction)
num_5 = Number(shell_global_orientation)

num_6 = Number(num_2)
num_7 = Number(num)
division = Division(A=num_7, B="6")
addition = Addition(A="6", B=1)
division_2 = Division(A=num_6, B="6")
series = Series(Start=0, Step=1, Count=addition)
division_3 = Division(A=num_6, B=2)
division_4 = Division(A=num_7, B=2)
multiplication = Multiplication(A=division, B=series)
multiplication_2 = Multiplication(A=division_2, B=series)
pt = ConstructPoint(XCoordinate=division_4, YCoordinate=division_3, ZCoordinate=0)
num_8 = Number(num_2)
graft = GraftTree(Tree=multiplication, IncludeEmptyLists=True, IncludeNullItems=True)
num_9 = Number(num_3)
num_10 = Number(num_4)
num_11 = Number(num)
xy = XYPlane(Origin=Point(0, 0, 0))
xy_2 = XYPlane(Origin=pt)
division_5 = Division(A=num_11, B="2")
division_6 = Division(A=num_8, B="2")
pt_2 = ConstructPoint(XCoordinate=graft, YCoordinate=multiplication_2, ZCoordinate=0)
neg = Negative(Value=division_5)
neg_2 = Negative(Value=division_6)
panel = Panel("""1
3
5""")
orient = Orient(Geometry=pt_2, Source=xy_2, Target=xy)  # -> Geometry, Transform
dom = ConstructDomain(DomainStart=neg_2, DomainEnd=division_6)
dom_2 = ConstructDomain(DomainStart=neg, DomainEnd=division_5)
panel_2 = Panel("""4
2
4""")
panel_3 = Panel("""4
1
4""")
rectangle = Rectangle(Plane=PlaneXY(0, 0, 0), XSize=dom_2, YSize=dom, Radius=0)  # -> Rectangle, Length
tii = TreeItemIndex(DataTree=orient.Geometry, BranchIndex=panel, ItemIndex=panel_3)
tii_2 = TreeItemIndex(DataTree=orient.Geometry, BranchIndex=panel, ItemIndex=panel_2)
mplane = MeshPlane(Boundary=rectangle.Rectangle, WidthCount=num_9, HeightCount=num_10)  # -> Mesh, Area
pt_3 = Point(tii_2)
pt_4 = Point(tii)
tri = Triangulate(Mesh=mplane.Mesh)  # -> Mesh, Count
concrete_covers_cm = Panel("""2.5
2.5
-2.5
-2.5""")
mesh = Mesh(tri.Mesh)
mesh_2 = Mesh(mesh)
demesh = DeconstructMesh(Mesh=mesh_2)  # -> Vertices, Faces, Colours, Normals
crv = Curve(rectangle.Rectangle)
crv_2 = Curve(crv)
explode = Explode(Curve=crv_2, Recursive=True)  # -> Segments, Vertices
graft_2 = GraftTree(Tree=explode.Segments, IncludeEmptyLists=True, IncludeNullItems=True)
crv_cp = CurveClosestPoint(Point=demesh.Vertices, Curve=graft_2)  # -> Point, Parameter, Distance
smaller = SmallerThan(FirstNumber=crv_cp.Distance, SecondNumber="0.001")  # -> SmallerThan, OrEqualTo
cull = CullPattern(List=crv_cp.Point, CullPattern=smaller.SmallerThan)  # -> simplify(List)
split = SplitTree(Data=cull, Masks=flatten("{0,2}"))  # -> Positive, Negative
intersection = SetIntersection(SetA=split.Positive, SetB=flatten(split.Negative))  # -> flatten(Union)
difference = SetDifference(SetA=split.Positive, SetB=flatten(intersection))
difference_2 = SetDifference(SetA=split.Negative, SetB=flatten(intersection))
matselect = MaterialSelectionKaramba(menu=[dropdown(3), dropdown(8)])
matselect_2 = MaterialSelectionKaramba(menu=[dropdown(2), dropdown(2)])
num_12 = Number("1.5")
mesh_3 = Mesh(mesh)
num_13 = Number(num_5)
cps = ClosestPoints(Point=intersection, Cloud=flatten(difference_2), Count="1")  # -> ClosestPoint, CPIndex, Distance
multiplication_3 = Multiplication(A=num_12, B="100")
multiplication_4 = Multiplication(A=concrete_covers_cm, B=2)
crv_3 = Curve(graft_2)
panel_4 = Panel(multiplication_3)
pt_5 = Point(cull)
pt_6 = Point(cps.ClosestPoint)
pt_7 = Point(intersection)
cross_sections = CrossSectionsKaramba(
    FamilyNameOfCrossSection="DefaultCroSec",
    MaterialConcrete=matselect,
    Height_cm=panel_4,
    MaterialReinforcement=matselect_2,
    ReinforcementConcreteCovers_cm=multiplication_4,
    PrincipalReinforcementDirection_deg=0,
    mode="Shell RC Standard - Const.")
mesh_4 = Mesh(mesh)
split_tree = SplitTree(Data=pt_5, Masks=flatten("{1, 3}"))  # -> Positive, Negative
list_length = ListLength(List=split_tree.Negative)
list_length_2 = ListLength(List=split_tree.Positive)
division_7 = Division(A=list_length, B=2)
division_8 = Division(A=list_length_2, B=2)
meshtoshell = MeshToShellKaramba(Mesh=mesh_3, Identifier="slab", CrossSection=cross_sections, LimitDistance_m=0.005)  # -> Element, Points, Info
pt_8 = Point(meshtoshell.Points)
cps_2 = ClosestPoints(Point=pt_4, Cloud=flatten(pt_8), Count="1")  # -> ClosestPoint, CPIndex, Distance
pt_9 = Point(cps_2.ClosestPoint)
pt_10 = ConstructPoint(XCoordinate=0, YCoordinate=0, ZCoordinate=0)
vec = VectorXYZ(XComponent="1.0", YComponent=num_13, ZComponent=0)  # -> Vector, Length
split_list = SplitList(List=split_tree.Negative, Index=division_7)  # -> ListA, ListB
split_list_2 = SplitList(List=split_tree.Positive, Index=division_8)  # -> ListA, ListB
vdisex = VectorDisplayEx(Point=pt_10, Vector=vec.Vector, Colour=RGB(0, 0, 0), Width=2)
tree_statistics = TreeStatistics(Tree=split_list.ListA)  # -> Paths, Length, Count
orientate = OrientateElemKaramba(Shell=meshtoshell.Element, XOrientations=vec.Vector, mode="Shell")
tree_statistics_2 = TreeStatistics(Tree=split_list_2.ListA)  # -> Paths, Length, Count
element = ElementKaramba(flatten(orientate))
list_item = ListItem(List=tree_statistics_2.Paths, Index=0, Wrap=True)  # -> Item, Item1
list_item_2 = ListItem(List=tree_statistics.Paths, Index=0, Wrap=True)  # -> Item, Item1
element_2 = ElementKaramba(element)
tree_branch = TreeBranch(Tree=split_list_2.ListA, Path=list_item.Item, MaintainPaths=True)
tree_branch_2 = TreeBranch(Tree=split_list_2.ListB, Path=list_item.Item1, MaintainPaths=True)
tree_branch_3 = TreeBranch(Tree=split_list.ListA, Path=list_item_2.Item1, MaintainPaths=True)
tree_branch_4 = TreeBranch(Tree=split_list.ListA, Path=list_item_2.Item, MaintainPaths=True)
list_item_3 = ListItem(List=reverse(tree_branch_4), Index=0, Wrap=True)
list_item_4 = ListItem(List=tree_branch, Index=0, Wrap=True)
pt_11 = Point(flatten(cull))
data = Data([tree_branch_2, tree_branch_4])
data_2 = Data([tree_branch, tree_branch_2, tree_branch_3, tree_branch_4])
data_3 = Data([tree_branch, tree_branch_2, tree_branch_4])
data_4 = Data([tree_branch_2, tree_branch_3])
data_5 = Data([list_item_4, tree_branch_2])
data_6 = Data([tree_branch, tree_branch_3])
data_7 = Data([tree_branch_3, list_item_3])
create_set = CreateSet(List=flatten(data_3))  # -> Set, Map
supp = SupportKaramba(PosInd=create_set.Set, menu=[buttons(on, on, on, off, off, off)])
entwine = Entwine(Branch02=supp, FlattenInputs=True)
support = SupportKaramba(flatten(entwine))
support_2 = SupportKaramba(support)

# ---- group: Optional Colors
range = Range(Domain=Domain(0, 1), Steps=10)
gradient = Gradient(
    LowerLimit=0,
    UpperLimit=1,
    Parameter=range,
    stops=[0: RGB(255, 0, 0), 0.176: RGB(255, 238, 0), 0.35: RGB(0, 255, 234), 0.504: RGB(35, 4, 128), 0.664: RGB(0, 252, 215), 0.843: RGB(255, 255, 0), 1: RGB(255, 0, 47)])

range_2 = Range(Domain=Domain(0, 1), Steps=10)
gradient_2 = Gradient(
    LowerLimit=0,
    UpperLimit=1,
    Parameter=range_2,
    stops=[0: RGB(255, 0, 0), 0.176: RGB(255, 238, 0), 0.35: RGB(0, 255, 234), 0.504: RGB(35, 4, 128), 0.664: RGB(0, 252, 215), 0.843: RGB(255, 255, 0), 1: RGB(255, 0, 47)])

# ----
panel_5 = Panel("""nx
ny
nxy
mx
my
mxy
vx
vy""")
graft_3 = GraftTree(Tree=panel_5, IncludeEmptyLists=True, IncludeNullItems=True)

# ---- group: Custom Vector - Controls
x_vector = Slider(1, range=0..1)
y_vector = Slider(0, range=0..1)
z_vector = Slider(0, range=0..1)
vec_2 = VectorXYZ(XComponent=x_vector, YComponent=y_vector, ZComponent=z_vector)  # -> Vector, Length
vec_3 = Vector(vec_2.Vector)

# ----
vec_4 = Vector(vec_3)

# ---- group: Loading - Controls
area_load_kn_m2 = Slider(10, range=0..100)
num_14 = Number(area_load_kn_m2)

# ----
num_15 = Number(num_14)
panel_6 = Panel(num_15)
Z = UnitZ(Factor=panel_6)
rev = Reverse(Vector=Z)
loads = LoadsKaramba(Vector=rev, Mesh=mesh_4, LCase=0, mode="MeshLoad -Const.", menu=[buttons(off, on, off), buttons(on, on)])
entwine_2 = Entwine(Branch00=loads, FlattenInputs=True)
load = LoadKaramba(flatten(entwine_2))
load_2 = LoadKaramba(load)
assemble = AssembleModelKaramba(Elem=element_2, Support=support_2, Load=load_2, LimitDistance_m=0.005)  # -> Model, Info, Mass_kg, CenterOfGravity
analyzethi = AnalyzeThIKaramba(Model=assemble.Model)  # -> CalculatedModel, MaximumDisplacement_m, ResultingForceOfGravity_kN, ElasticEnergy_kNm
panel_7 = Panel(analyzethi.MaximumDisplacement_m)
model = ModelKaramba(analyzethi.CalculatedModel)
model_2 = ModelKaramba(model)
shelllineresults = LineResultsOnShellsKaramba(
    AnalyzedModel=model_2,
    Layer="-1",
    ListOfSourcesOfPrincipalStressLinesLinesPoints=pt_11,
    SegmentLength_m=0.5,
    DA_deg=5,
    mode="PrincStress")  # -> AnalyzedModel, Lines1, Lines2
model_3 = ModelKaramba(model)

model_4 = ModelKaramba(model)
modelview = ModelViewKaramba(Model=model_4, LoadCaseFactorsForLinearSuperposition=1, IndexOfVisibleLoadcase=-1, ListOfColorsForColoringPlots=gradient)  # -> Model, DeformedMesh, DeformedAxes, DeformedModel
shellview = ShellViewKaramba(Model=modelview.Model, IndexOfLayer=0)  # -> Model, MeshesOfRenderedShells, LegendColors, LegendTags
legend = Legend(Colour=shellview.LegendColors, Tags=shellview.LegendTags, LegendType=1)

# ---- group: RC - Design Controls
shell_thickness_m = Slider(0.14, range=0..1)
cover_to_rebar_m = Slider(0.05, range=0..1)
concrete_compression_strength_fck = Slider(40, range=0..100)
concrete_tension_strength_factor_fctd = Slider(10, range=0..100)
rebar_yield_strength_fy = Slider(500, range=0..1000)

# ---- group: Algorithm - Controls
run_smesh = BooleanToggle(True)
bool = Boolean(run_smesh)

run_rc_design = BooleanToggle(True)
bool_2 = Boolean(run_rc_design)

# ----
export_smesh_json = BooleanToggle(False)
bool_3 = Boolean(export_smesh_json)

# ---- group: Display Controls
display_results_on_mesh = BooleanToggle(True)
bool_4 = Boolean(display_results_on_mesh)

display_vector_field = BooleanToggle(True)
bool_5 = Boolean(display_vector_field)

display_seeds = BooleanToggle(False)
bool_6 = Boolean(display_seeds)

display_face_singularities = BooleanToggle(True)
bool_7 = Boolean(display_face_singularities)

display_face_edge_planes = BooleanToggle(False)
bool_8 = Boolean(display_face_edge_planes)

# ---- group: Vector Field 1 - Selection
list = ValueList({"n_1": 0, "n_2": 1, "m_1": 2, "m_2": 3, "ps_1_top": 4, "ps_1_bot": 5, "ps_1_mid": 6, "ps_2_top": 7, "ps_2_bot": 8, "ps_2_mid": 9, "custom_1": 10, "custom_2": 11}, selected="ps_1_top")
int = Integer(list)

# ---- group: As 1 - Density Selection
list_2 = ValueList({"asx_": 0, "asy_": 1}, selected="asx_")
int_2 = Integer(list_2)

# ---- group: As 2 - Density Selection
list_3 = ValueList({"asx_": 0, "asy_": 1}, selected="asy_")
int_3 = Integer(list_3)

# ---- group: Display Vector Field - Selection
list_4 = ValueList({"n_1": 0, "n_2": 1, "m_1": 2, "m_2": 3, "ps_1_top": 4, "ps_1_bot": 5, "ps_1_mid": 6, "ps_2_top": 7, "ps_2_bot": 8, "ps_2_mid": 9, "custom_1": 10, "custom_2": 11}, selected="ps_1_top")
int_4 = Integer(list_4)

# ---- group: Display Vector Field - Selection 2
list_5 = ValueList({"n_1": 0, "n_2": 1, "m_1": 2, "m_2": 3, "ps_1_top": 4, "ps_1_bot": 5, "ps_1_mid": 6, "ps_2_top": 7, "ps_2_bot": 8, "ps_2_mid": 9, "custom_1": 10, "custom_2": 11}, selected="ps_1_top")
int_5 = Integer(list_5)

# ---- group: Display Mesh - Mode Selection
list_6 = ValueList({"max": 0, "min": 1, "avg": 2, "angle_avg": 3}, selected="avg")
int_6 = Integer(list_6)

# ---- group: Display Mesh - Results Selection
list_7 = ValueList({"nx": 0, "ny": 1, "nxy": 2, "mx": 3, "my": 4, "mxy": 5, "vx": 6, "vy": 7, "asx_b": 8, "asx_t": 9, "asy_b": 10, "asy_t": 11, "asx_c": 12, "asy_c": 13, "asx_": 14, "asy_": 15, "sp_asx_": 16, "sp_asy_": 17}, selected="asy_")
int_7 = Integer(list_7)

# ----
panel_8 = Panel("""asx_b
asx_t
asy_b
asy_t
asx_c
asy_c
asx_
asy_
spacing_asx_
spacing_asy_""")
int_8 = Integer(int_7)

min_length = Slider(0.2, range=0..2)
dl = Slider(0.01, range=0..0.1)
num_16 = Number(dl)
num_17 = Number(min_length)

dir_1_weight_vector_field = Slider(1, range=0..1)
dir_1_weight_separate = Slider(0, range=0..1)
dir_1_weight_align = Slider(0, range=0..1)
dir_2_weight_separate = Slider(0, range=0..1)
dir_2_weight_vector_field = Slider(1, range=0..1)
dir_2_weight_align = Slider(0, range=0..1)
merge = Merge(
    Data1=dir_1_weight_vector_field,
    Data2=dir_1_weight_separate,
    Data3=dir_1_weight_align,
    Data4=dir_2_weight_vector_field,
    Data5=dir_2_weight_separate,
    Data6=dir_2_weight_align)
num_18 = Number(merge)

vector_scale = Slider(2.5, range=0..2.5)
num_19 = Number(vector_scale)

vector_scale_2 = Slider(2.5, range=0..2.5)
num_20 = Number(vector_scale_2)

singularities_tol = Slider(0, range=0..1)
num_21 = Number(singularities_tol)

panel_9 = Panel("""n_1
n_2
m_1
m_2
ps_1_top
ps_1_bot
ps_1_mid
ps_2_top
ps_2_bot
ps_2_mid
custom_1
custom_2""")
int_9 = Integer(int)
int_10 = Integer(int_4)
graft_4 = GraftTree(Tree=panel_9, IncludeEmptyLists=True, IncludeNullItems=True)
item = ListItem(List=panel_9, Index=int_10, Wrap=True)
item_2 = ListItem(List=panel_9, Index=int_9, Wrap=True)

panel_10 = Panel("""max
min
avg
angle_avg""")
int_11 = Integer(int_6)

panel_11 = Panel("""asx_
asy_""")
int_12 = Integer(int_2)
int_13 = Integer(int_3)
item_3 = ListItem(List=panel_11, Index=int_12, Wrap=True)
item_4 = ListItem(List=panel_11, Index=int_13, Wrap=True)

int_14 = Integer(int_5)
merge_2 = Merge(Data1=panel_5, Data2=panel_8)
item_5 = ListItem(List=panel_9, Index=int_14, Wrap=True)
item_6 = ListItem(List=merge_2, Index=int_8, Wrap=True)
item_7 = ListItem(List=panel_10, Index=int_11, Wrap=True)

# ---- group: Internal Forces - Tags
txt = Text(graft_3)

# ---- group: Display - Tag
txt_2 = Text(item_6)

# ---- group: as_tag_1
txt_3 = Text(item_3)

# ---- group: as_tag_2
txt_4 = Text(item_4)

# ---- group: Principal Vectors - Tags
txt_5 = Text(graft_4)

# ---- group: vector_tag
txt_6 = Text(item_2)

# ---- group: vector_tag - display
txt_7 = Text(item)

# ---- group: Display - Tag
txt_8 = Text(item_7)

# ----
txt_9 = Text(item_5)

# ---- group: RC - Design Controls
num_22 = Number(shell_thickness_m)
num_23 = Number(cover_to_rebar_m)
num_24 = Number(concrete_compression_strength_fck)
num_25 = Number(concrete_tension_strength_factor_fctd)
num_26 = Number(rebar_yield_strength_fy)

# ----
crv_4 = Curve()
crv_5 = Curve()

bool_9 = Boolean(bool_6)

X = UnitX(Factor="6")
swatch = ColourSwatch(SwatchColor=RGB(0, 0, 0))
swatch_2 = ColourSwatch(SwatchColor=RGB(0, 0, 0))
entwine_3 = Entwine(
    Branch00=ColourSwatch(SwatchColor=RGB(255, 255, 255)),
    Branch01=ColourSwatch(SwatchColor=RGB(255, 0, 0)),
    Branch02=ColourSwatch(SwatchColor=RGB(0, 128, 255)),
    FlattenInputs=True)
Z_2 = UnitZ(Factor="6")
Z_3 = UnitZ(Factor="6")
X_2 = UnitX(Factor="0")
panel_12 = Panel("Z:\code\libraries\streamlines\examples\bottomlefright_supported_slab.json")
panel_13 = Panel("4 to 0.5")
swatch_3 = ColourSwatch(SwatchColor=RGB(0, 0, 0))
panel_14 = Panel("2")

# ---- group: Principal Vectors - Tags
txt_10 = Text(txt_5)

txt_11 = Text(txt_5)

# ---- group: vector_tag
txt_12 = Text(txt_6)

# ---- group: Optional Colors
range_3 = Range(Domain=Domain(0, 1), Steps=10)
gradient_3 = Gradient(
    LowerLimit=0,
    UpperLimit=1,
    Parameter=range_3,
    stops=[0: RGB(255, 0, 0), 0.176: RGB(255, 238, 0), 0.35: RGB(0, 255, 234), 0.504: RGB(35, 4, 128), 0.664: RGB(0, 252, 215), 0.843: RGB(255, 255, 0), 1: RGB(255, 0, 47)])

# ----
panel_16 = Panel("""1
-1
0""")

# ---- group: Principal Vectors - Tags
txt_13 = Text(flatten(txt_5))

# ----
txt_14 = Text(flatten(txt))
bool_10 = Boolean(bool_2)
num_27 = Number(num_22)
num_28 = Number(num_23)
num_29 = Number(num_24)
num_30 = Number(num_26)
num_31 = Number(num_25)
panel_17 = Panel("True")

# ---- group: display
bool_11 = Boolean(bool_4)

# ---- group: mode
txt_15 = Text(txt_8)

# ---- group: data_tag
txt_16 = Text(txt_2)

# ---- group: vector_tag
txt_17 = Text(txt_9)

txt_18 = Text(txt_7)

# ---- group: Vector Scale
num_32 = Number(num_21)

# ---- group: vector_tag
txt_19 = Text(txt_7)

# ---- group: display
bool_12 = Boolean(bool_7)

bool_13 = Boolean(bool_8)

# ---- group: Vector Scale
num_33 = Number(num_19)

num_34 = Number(num_20)

# ---- group: display
bool_14 = Boolean(bool_5)

bool_15 = Boolean(bool_5)

# ----
panel_18 = Panel("0")

proximity_factor_to_others = Slider(0.05, range=0..1)
number_of_samples = Slider(20, range=0..500)
strat_factor = Slider(1, range=0..1)
proximity_at_start = Slider(0.8, range=0..1)
iterations = Slider(2000, range=0..10000)
proximity_to_itself = Slider(1, range=0..10)
int_15 = Integer(number_of_samples)
num_35 = Number(strat_factor)
num_36 = Number(proximity_factor_to_others)
num_37 = Number(iterations)
num_38 = Number(proximity_at_start)
num_39 = Number(proximity_to_itself)

uniform_spacing = BooleanToggle(False)
min_sp_m = Slider(0.5, range=0..1)
dl_2 = Slider(0.02, range=0..0.1)
min_length_2 = Slider(0.01, range=0..4)
num_40 = Number(dl_2)
num_41 = Number(min_length_2)
bool_16 = Boolean(uniform_spacing)
num_42 = Number(min_sp_m)

run_streamlines_jobard = BooleanToggle(False)
bool_17 = Boolean(run_streamlines_jobard)

run_streamlines_jobard_2 = BooleanToggle(False)
bool_18 = Boolean(run_streamlines_jobard_2)

uniform_spacing_2 = BooleanToggle(False)
min_sp_m_2 = Slider(0.5, range=0..1)
dl_3 = Slider(0.02, range=0..0.1)
min_length_3 = Slider(0.2, range=0..4)
num_43 = Number(min_length_3)
bool_19 = Boolean(uniform_spacing_2)
num_44 = Number(min_sp_m_2)
num_45 = Number(dl_3)

number_of_samples_2 = Slider(15, range=0..300)
proximity_at_start_2 = Slider(0.9, range=0..1)
strat_factor_2 = Slider(1, range=0..1)
proximity_factor_to_others_2 = Slider(0.05, range=0..1)
proximity_to_itself_2 = Slider(1, range=0..10)
iterations_2 = Slider(1000, range=0..10000)
int_16 = Integer(number_of_samples_2)
num_46 = Number(strat_factor_2)
num_47 = Number(proximity_factor_to_others_2)
num_48 = Number(proximity_at_start_2)
num_49 = Number(proximity_to_itself_2)
num_50 = Number(iterations_2)

percentage_of_max_demand_dir_1 = Slider(0.67, range=0..1)
percentage_of_max_demand_dir_2 = Slider(0.67, range=0..1)
bar_diameter_mm_dir_1 = Slider(18, range=0..30)
bar_diameter_mm_dir_2 = Slider(18, range=0..30)
max_spacing_dir_2 = Slider(0.4, range=0..1)
max_spacing_dir_1 = Slider(0.4, range=0..1)
merge_3 = Merge(Data1=bar_diameter_mm_dir_1, Data2=bar_diameter_mm_dir_2)
merge_4 = Merge(Data1=max_spacing_dir_1, Data2=max_spacing_dir_2)
merge_5 = Merge(Data1=percentage_of_max_demand_dir_1, Data2=percentage_of_max_demand_dir_2)
num_51 = Number(merge_4)
num_52 = Number(merge_5)
num_53 = Number(merge_3)

# ---- group: bar diameter
num_54 = Number(num_53)

# ---- group: max spacing
num_55 = Number(num_51)

# ---- group: % demand
num_56 = Number(num_52)

# ----
bool_20 = Boolean(bool_17)
txt_20 = Text(txt_3)
num_57 = Number(num_18)
num_58 = Number(num_40)
num_59 = Number(num_41)
txt_21 = Text(txt_6)
num_60 = Number(num_42)
bool_21 = Boolean(bool_16)
int_17 = Integer(int_15)
num_61 = Number(num_35)
num_62 = Number(num_36)
num_63 = Number(num_38)
num_64 = Number(num_39)
num_65 = Number(num_37)
num_66 = Number(num_43)
num_67 = Number(num_18)
num_68 = Number(num_48)
bool_22 = Boolean(bool_18)
num_69 = Number(num_45)
txt_22 = Text(txt_6)
txt_23 = Text(txt_4)
num_70 = Number(num_44)
bool_23 = Boolean(bool_19)
int_18 = Integer(int_16)
num_71 = Number(num_46)
num_72 = Number(num_47)
num_73 = Number(num_49)
num_74 = Number(num_50)
crv_6 = Curve()
crv_7 = Curve()
flatten = FlattenTree(Tree=crv_6, Path="{0}")
flatten_2 = FlattenTree(Tree=crv_7, Path="{0}")
eval = EvaluateCurve(Curve=reparameterize(flatten), Parameter="0.5")  # -> Point, Tangent, Angle
eval_2 = EvaluateCurve(Curve=reparameterize(flatten_2), Parameter="0.5")  # -> Point, Tangent, Angle

panel_19 = Panel("""1
-1
0""")
graft_5 = GraftTree(Tree=panel_19, IncludeEmptyLists=True, IncludeNullItems=True)
shellvecresults = ResultVectorsOnShellsKaramba(AnalyzedModel=model_3, mode="PrincForce")  # -> AnalyzedModel, Points, FirstPrincipalNormalForceVector_kN_m, SecondPrincipalNormalForceVector_kN_m, FirstPrincipalMomentVector_kN, SecondPrincipalMomentVector_kN, FirstPrincipalNormalForceValue_kN_m, SecondPrincipalNormalForceValue_kN_m, FirstPrincipalMomentValue_kN, SecondPrincipalMomentValue_kN
shellvecresults_2 = ResultVectorsOnShellsKaramba(AnalyzedModel=model_3, LayerOfResults=graft_5, mode="PrincStress")  # -> AnalyzedModel, Points, FirstPrincipalStressVector_kN_cm2, SecondPrincipalStressVector_kN_cm2, FirstPrincipalStressValue_kN_cm2, SecondPrincipalStressValue_kN_cm2
disassemble = DisassembleModelKaramba(Model=model_3)  # -> Model, Point, Beam, Shell, Support, Load, Line, Mesh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

vec_5 = Vector(shellvecresults_2.SecondPrincipalStressVector_kN_cm2)
vec_6 = Vector(shellvecresults_2.FirstPrincipalStressVector_kN_cm2)

vec_7 = Vector(shellvecresults.SecondPrincipalNormalForceVector_kN_m)
vec_8 = Vector(shellvecresults.FirstPrincipalNormalForceVector_kN_m)

vec_9 = Vector(shellvecresults.FirstPrincipalMomentVector_kN)
vec_10 = Vector(shellvecresults.SecondPrincipalMomentVector_kN)

vec_11 = Vector(vec_7)
vec_12 = Vector(vec_8)
vec_13 = Vector(vec_9)
vec_14 = Vector(vec_10)
vec_15 = Vector(vec_6)
vec_16 = Vector(vec_5)

path_mapper = PathMapper(vec_16, source="{A;B}", target="{A;B+7}")
path_mapper_2 = PathMapper(vec_15, source="{A;B}", target="{A;B+4}")
entwine_4 = Entwine(Branch00=vec_12, Branch01=vec_11, Branch02=vec_13, Branch03=vec_14, FlattenInputs=True)  # -> simplify(Result)
merge_6 = Merge(Data1=entwine_4, Data2=simplify(path_mapper_2), Data3=simplify(path_mapper))

mesh_5 = Mesh(disassemble.Mesh)

# ---- group: Vector Fields
vec_17 = Vector(merge_6)

# ----
vec_18 = Vector(vec_17)
mesh_6 = Mesh(mesh_5)

cluster = Cluster(mesh=mesh_6, vec=vec_4)  # -> vec_6, vec_5
entwine_5 = Entwine(Branch00=cluster.vec_6, Branch01=cluster.vec_5, FlattenInputs=True)  # -> simplify(Result)
path_mapper_3 = PathMapper(entwine_5, source="{A}", target="{A+10}")
merge_7 = Merge(Data1=vec_18, Data2=simplify(path_mapper_3))

mesh_7 = Mesh(mesh_6)
model_5 = ModelKaramba(model)
vec_19 = Vector(merge_7)

mesh_8 = Mesh(mesh_7)
vec_20 = Vector(vec_19)
model_6 = ModelKaramba(model_5)

mesh_9 = Mesh(mesh_8)
vec_21 = Vector(vec_20)
model_7 = ModelKaramba(model_6)

# ---- group: Principal Vectors
vec_22 = Vector(vec_21)

vec_23 = Vector(vec_21)

# ----
mesh_10 = Mesh(mesh_9)
bool_24 = Boolean(bool)

mesh_11 = Mesh(mesh_9)
bool_25 = Boolean(bool_3)

python = GhPythonScript(run=bool_24, mesh=mesh_10, vectors=vec_22, vectors_tags=txt_10)  # -> out, s_mesh; inputs mesh: Mesh, vectors: tree of Vector3d, vectors_tags: tree
# ---------- python: Python ----------
__author__ = "Rafael Pastrana"
__name__ = "Mesh Maker"
__date__ = "2018.07.19"
__version__ = "0.0.1"


# 1. Import dependencies
import sys
import imp
import rhinoscriptsyntax as rs

# 1-b. Replace with your own path here
sys.path.append("Z:\code\libraries\streamlines\src\streamlines")

import custom_mesh
imp.reload(custom_mesh)

from custom_mesh import StructuralMesh
from compas.datastructures import Mesh
from compas_rhino.helpers import mesh_from_guid

# Define Global Variables
NORM = False

# 2. Start System
if run is True:
    print('SYSTEM STARTED')
        
    # instantiate mesh
    mesh = mesh_from_guid(Mesh, mesh)
    my_mesh = StructuralMesh(mesh)
    compas_mesh = Mesh()

    # set vector attributes
    for idx, vector_field in enumerate(vectors.Branches):
        tag = vectors_tags.Branches[idx][0]
        clean_vectors = [[vec.X, vec.Y, vec.Z] for vec in vector_field]
        my_mesh.set_face_vectors(clean_vectors, tag, NORM)
        # my_mesh.set_vertex_vectors(tag)
        my_mesh.set_vertex_vectors_angles(tag)
    
    # output mesh
    s_mesh = my_mesh
# ---------- end python ----------
wbedges = WeaverbirdsMeshEdges(MeshOrPolylines=mesh_10)
wbedges_2 = WeaverbirdsMeshEdges(MeshOrPolylines=mesh_11)
python_2 = GhPythonScript(run=bool_25, mesh=mesh_11, vectors=vec_23, vectors_tags=txt_11, filepath=panel_12)  # -> out, s_mesh; inputs mesh: Mesh, vectors: tree of Vector3d, vectors_tags: tree
# ---------- python_2: Python ----------
__author__ = "Rafael Pastrana"
__name__ = "Mesh Maker"
__date__ = "2018.07.19"
__version__ = "0.0.1"


# 1. Import dependencies
import sys
import imp
import rhinoscriptsyntax as rs

# 1-b. Replace with your own path here
sys.path.append("Z:\code\libraries\streamlines\src\streamlines")

import custom_mesh
imp.reload(custom_mesh)

from custom_mesh import StructuralMesh
from compas.datastructures import Mesh
from compas_rhino.helpers import mesh_from_guid

# Define Global Variables
NORM = False

# 2. Start System
if run is True:
    print('SYSTEM STARTED')
        
    # instantiate mesh
    compas_mesh = mesh_from_guid(Mesh, mesh)

    # set vector attributes
    for idx, vector_field in enumerate(vectors.Branches):
        tag = vectors_tags.Branches[idx][0]
        clean_vectors = [[vec.X, vec.Y, vec.Z] for vec in vector_field]
        # my_mesh.set_face_vectors(clean_vectors, tag, NORM)
        # my_mesh.set_vertex_vectors(tag)
        # my_mesh.set_vertex_vectors_angles(tag)
        help(compas_mesh.set_face_attribute)
        
        for jdx, vector in enumerate(clean_vectors):
            compas_mesh.set_face_attribute(jdx, tag, vector)
        # compas_mesh.set_faces_attributes(tag, clean_vectors)
        
    
    # output mesh
    
    compas_mesh.to_json(filepath)
# ---------- end python_2 ----------
lng = ListLength(List=wbedges)
lng_2 = ListLength(List=wbedges_2)
data_8 = Data(python.s_mesh)
data_9 = Data(python_2.s_mesh)
panel_20 = Panel(lng)
panel_21 = Panel(lng_2)

# ---- group: s_mesh
data_10 = Data(data_8)

# ----
python_3 = GhPythonScript(s_mesh=data_10, vector_tag=txt_12)  # -> out, s_mesh, vector_field
# ---------- python_3: Python ----------
# 1. Import dependencies
import rhinoscriptsyntax as rs
import copy

print('number of edges is: {}'.format(len([e for e in s_mesh.c_mesh.edges()])))

# 2. Start System
my_mesh = s_mesh
v_name = vector_tag

# vector properties
vector_field = [x[0] for x in my_mesh.find_vector_face_centers(v_name)]
vector_field = [rs.CreateVector(x) for x in vector_field]
s_mesh = my_mesh
# ---------- end python_3 ----------
vec_24 = Vector(python_3.vector_field)
model_8 = ModelKaramba(model_7)
vec_25 = Vector(vec_24)

disassemble_2 = DisassembleModelKaramba(Model=model_8)  # -> Model, Point, Beam, Shell, Support, Load, Line, Mesh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
orientate_2 = OrientateElemKaramba(Shell=disassemble_2.Shell, XOrientations=unitize(vec_25), mode="Shell")
assemble_2 = AssembleModelKaramba(
    Points=disassemble_2.Point,
    Elem=orientate_2,
    Support=disassemble_2.Support,
    Load=disassemble_2.Load,
    LimitDistance_m=0.005)  # -> Model, Info, Mass_kg, CenterOfGravity
analyzethi_2 = AnalyzeThIKaramba(Model=assemble_2.Model)  # -> CalculatedModel, MaximumDisplacement_m, ResultingForceOfGravity_kN, ElasticEnergy_kNm

model_9 = ModelKaramba(analyzethi_2.CalculatedModel)

model_10 = ModelKaramba(model_9)
modelview_2 = ModelViewKaramba(Model=model_10, LoadCaseFactorsForLinearSuperposition=1, IndexOfVisibleLoadcase=-1)  # -> Model, DeformedMesh, DeformedAxes, DeformedModel
shellview_2 = ShellViewKaramba(Model=modelview_2.Model, IndexOfLayer=0)  # -> Model, MeshesOfRenderedShells, LegendColors, LegendTags
legend_2 = Legend(Colour=shellview_2.LegendColors, Tags=shellview_2.LegendTags, LegendType=1)

model_11 = ModelKaramba(model_9)
modelview_3 = ModelViewKaramba(
    Model=model_11,
    LoadCaseFactorsForLinearSuperposition=1,
    IndexOfVisibleLoadcase=-1,
    ListOfColorsForColoringPlots=gradient_3)  # -> Model, DeformedMesh, DeformedAxes, DeformedModel
shellview_3 = ShellViewKaramba(Model=modelview_3.Model, IndexOfLayer=0)  # -> Model, MeshesOfRenderedShells, LegendColors, LegendTags
legend_3 = Legend(Colour=shellview_3.LegendColors, Tags=shellview_3.LegendTags, LegendType=1)

panel_22 = Panel(analyzethi_2.MaximumDisplacement_m)
model_12 = ModelKaramba(model_9)

graft_6 = GraftTree(Tree=panel_16, IncludeEmptyLists=True, IncludeNullItems=True)
shellvecresults_3 = ResultVectorsOnShellsKaramba(AnalyzedModel=model_12, LayerOfResults=graft_6, mode="PrincStress")  # -> AnalyzedModel, Points, FirstPrincipalStressVector_kN_cm2, SecondPrincipalStressVector_kN_cm2, FirstPrincipalStressValue_kN_cm2, SecondPrincipalStressValue_kN_cm2
shellvecresults_4 = ResultVectorsOnShellsKaramba(AnalyzedModel=model_12, mode="PrincForce")  # -> AnalyzedModel, Points, FirstPrincipalNormalForceVector_kN_m, SecondPrincipalNormalForceVector_kN_m, FirstPrincipalMomentVector_kN, SecondPrincipalMomentVector_kN, FirstPrincipalNormalForceValue_kN_m, SecondPrincipalNormalForceValue_kN_m, FirstPrincipalMomentValue_kN, SecondPrincipalMomentValue_kN
path_mapper_4 = PathMapper(shellvecresults_3.SecondPrincipalStressValue_kN_cm2, source="{A;B}", target="{A;B+7}")
path_mapper_5 = PathMapper(shellvecresults_3.FirstPrincipalStressValue_kN_cm2, source="{A;B}", target="{A;B+4}")
entwine_6 = Entwine(
    Branch00=shellvecresults_4.FirstPrincipalNormalForceValue_kN_m,
    Branch01=shellvecresults_4.SecondPrincipalNormalForceValue_kN_m,
    Branch02=shellvecresults_4.FirstPrincipalMomentValue_kN,
    Branch03=shellvecresults_4.SecondPrincipalMomentValue_kN,
    FlattenInputs=True)  # -> simplify(Result)
merge_8 = Merge(Data1=entwine_6, Data2=simplify(path_mapper_5), Data3=simplify(path_mapper_4))

s_forces = ShellForcesKaramba(AnalyzedModel=model_12, LCase=0, mode="Local")  # -> AnalyzedModel, Nxx_kN_m, Nyy_kN_m, Nxy_kN_m, Mxx_kN, Myy_kN, Mxy_kN, Vx_kN_m, Vy_kN_m
graft_7 = GraftTree(Tree=s_forces.Nxx_kN_m, IncludeEmptyLists=True, IncludeNullItems=True)  # -> simplify(Tree)
graft_8 = GraftTree(Tree=s_forces.Nyy_kN_m, IncludeEmptyLists=True, IncludeNullItems=True)  # -> simplify(Tree)
graft_9 = GraftTree(Tree=s_forces.Nxy_kN_m, IncludeEmptyLists=True, IncludeNullItems=True)  # -> simplify(Tree)
graft_10 = GraftTree(Tree=s_forces.Mxx_kN, IncludeEmptyLists=True, IncludeNullItems=True)  # -> simplify(Tree)
graft_11 = GraftTree(Tree=s_forces.Myy_kN, IncludeEmptyLists=True, IncludeNullItems=True)  # -> simplify(Tree)
graft_12 = GraftTree(Tree=s_forces.Mxy_kN, IncludeEmptyLists=True, IncludeNullItems=True)  # -> simplify(Tree)
graft_13 = GraftTree(Tree=s_forces.Vx_kN_m, IncludeEmptyLists=True, IncludeNullItems=True)  # -> simplify(Tree)
graft_14 = GraftTree(Tree=s_forces.Vy_kN_m, IncludeEmptyLists=True, IncludeNullItems=True)  # -> simplify(Tree)
merge_9 = Merge(
    Data1=graft_7,
    Data2=graft_8,
    Data3=graft_9,
    Data4=graft_10,
    Data5=graft_11,
    Data6=graft_12,
    Data7=graft_13,
    Data8=graft_14)
flip = FlipMatrix(Data=merge_9)

num_75 = Number(merge_8)
num_76 = Number(flip)

txt_24 = Text(flatten(txt))
data_11 = Data(data_8)

num_77 = Number(num_76)

# ---- group: Assign Local Internal Forces to sMesh
python_4 = GhPythonScript(s_mesh=data_11, int_forces=num_77, force_tags=txt_24)  # -> out, s_mesh; inputs int_forces: tree, force_tags: list
# ---------- python_4: Python ----------
__author__ = "Rafael Pastrana"
__name__ = "Mesh Maker"
__date__ = "2018.07.19"
__version__ = "0.0.1"


# 1. Import dependencies
import rhinoscriptsyntax as rs
import copy

# 2. Start System
# set vector attributes
my_mesh = s_mesh


for idx, int_force in enumerate(int_forces.Branches):
    tag = force_tags[idx]
    
    for f_key in my_mesh.c_mesh.faces():
        force = int_force[f_key]
        if force == 0:
            force = 1e-7
            
        my_mesh.c_mesh.set_face_attribute(f_key, str(tag), force)

s_mesh = my_mesh
# ---------- end python_4 ----------

# ----
data_12 = Data(python_4.s_mesh)
data_13 = Data(data_12)
num_78 = Number(num_75)

# ---- group: Assign Principal Internal Forces to sMesh
python_5 = GhPythonScript(s_mesh=data_13, int_forces=num_78, force_tags=txt_13)  # -> out, s_mesh; inputs int_forces: tree, force_tags: list
# ---------- python_5: Python ----------
__author__ = "Rafael Pastrana"
__name__ = "Mesh Maker"
__date__ = "2018.07.19"
__version__ = "0.0.1"


# 1. Import dependencies
import rhinoscriptsyntax as rs
import copy

TAG = '_val'
my_mesh = s_mesh

# 2. Start System
# set vector attributes
for idx, int_force in enumerate(int_forces.Branches):
    f_tag = force_tags[idx] + TAG
    
    for f_key in my_mesh.c_mesh.faces():
        force = int_force[f_key]
        if force == 0:
            force = 1e-7
        my_mesh.c_mesh.set_face_attribute(f_key, str(f_tag), force)

s_mesh = my_mesh
# ---------- end python_5 ----------

# ----
data_14 = Data(python_5.s_mesh)
data_15 = Data(data_14)

panel_23 = Panel("""bottom layer
top layer
center layer
total """)
panel_24 = Panel("""asx_b
asx_t
asy_b
asy_t
asx_c
asy_c""")

entwine_7 = Entwine(
    Branch00=ColourSwatch(SwatchColor=RGB(0, 124, 247)),
    Branch01=ColourSwatch(SwatchColor=RGB(1, 35, 97)),
    Branch02=ColourSwatch(SwatchColor=RGB(1, 97, 92)),
    FlattenInputs=True)

X_3 = UnitX(Factor="6")

X_4 = UnitX(Factor="6")

entwine_8 = Entwine(
    Branch00=ColourSwatch(SwatchColor=RGB(227, 9, 118)),
    Branch01=ColourSwatch(SwatchColor=RGB(214, 204, 4)),
    FlattenInputs=True)

# ---- group: Make RC Design
python_6 = GhPythonScript(run=bool_10, s_mesh=data_15, heights=num_27, covers=num_28, fck=num_29, fy=num_30, fctd_factor=num_31, force_tags=txt_14)  # -> out, s_mesh, asxb, asxt, asyb, asyt, asxc, asyc, ast; inputs run: Boolean, force_tags: list
# ---------- python_6: Python ----------
"""NOTE 18.08.01: Bottom and Top were inverted for compatibility"""

__author__ = "Rafael Pastrana"
__name__ = "Sandwich"
__date__ = "2018.08.01"
__version__ = "0.0.2"

# 1. Import dependencies
import sys
import imp
import rhinoscriptsyntax as rs

# 1-b. Replace with your own path here
sys.path.append("Z:\projects\streamlines\src\streamlines")

import materials
import basic_sandwich

imp.reload(materials)
imp.reload(basic_sandwich)

from basic_sandwich import ReinforcedShell
from materials import Concrete
from materials import Rebar


# 2. Create Input Material Data
myConcrete = Concrete(fck)
myRebar = Rebar(fy)
#myConcrete.printSummary()

# 3. Perform Reinforcement Design
my_mesh = s_mesh

asxb = []
asyb = []
asxt = []
asyt = []
asxc = []
asyc = []

ast = []
shells = []

if run is True:
    for idx, f_key in enumerate(s_mesh.c_mesh.faces()):
        forces = s_mesh.c_mesh.get_face_attributes(f_key, force_tags)
        myForces = {str(a): b for a, b in zip(force_tags, forces)}
        
        myShell = ReinforcedShell(idx, myConcrete, myRebar, heights, covers)
        myShell.tcred = myShell.concrete.fctd * fctd_factor
        
        # 4. Perform Reinforcement Design Routine
        myShell.applyForces(**myForces)
        
        # new version 25.08.18
        myShell.get_membrane_forces()
        myShell.get_reinforcement_forces()
        myShell.design_reinforcement()
        
        # 5. Append Results to Output Lists. Bottom and top were inverted
        shells.append(myShell)
        
        asxb.append(myShell.asxt)
        asyb.append(myShell.asyt)
        
        asxt.append(myShell.asxb)
        asyt.append(myShell.asyb)
        
        asxc.append(myShell.asxc)
        asyc.append(myShell.asyc)
        
        ast.append(myShell.ast)
        
        # 6. Set Face Attributes. Bottom and top were inverted
        my_mesh.c_mesh.set_face_attribute(f_key, 'asx_b', myShell.asxt)
        my_mesh.c_mesh.set_face_attribute(f_key, 'asx_t', myShell.asxb)
        my_mesh.c_mesh.set_face_attribute(f_key, 'asy_b', myShell.asyt)
        my_mesh.c_mesh.set_face_attribute(f_key, 'asy_t', myShell.asyb)
        
        my_mesh.c_mesh.set_face_attribute(f_key, 'asx_c', myShell.asxc)
        my_mesh.c_mesh.set_face_attribute(f_key, 'asy_c', myShell.asyc)
        
        my_mesh.c_mesh.set_face_attribute(f_key, 'asx_', (myShell.asxc + myShell.asxt + myShell.asxb))
        my_mesh.c_mesh.set_face_attribute(f_key, 'asy_', (myShell.asyc + myShell.asyt + myShell.asyb))
    
        
    # 6. Retrieve Statistics
    print("# of Elements with Crushed Core: {}".format(len([shell for shell in shells if shell.coreCrush == True])))
    print("# of Elements with Crushed Top Cover: {}".format(len([shell for shell in shells if shell.tsupCrush == True])))
    print("# of Elements with Crushed Bottom Cover: {}".format(len([shell for shell in shells if shell.tinfCrush == True])))
    print("----------------------------------")
    print("Shear Force Vo in Crushed Core Elements: {}".format([shell.vo for shell in shells if shell.coreCrush == True]))
    print("----------------------------------")
# ---------- end python_6 ----------

num_79 = Number(python_6.asyt)
num_80 = Number(python_6.ast)
num_81 = Number(python_6.asyb)
num_82 = Number(python_6.asxb)
num_83 = Number(python_6.asxt)

# ----
num_84 = Number(python_6.asxc)
num_85 = Number(python_6.asyc)
num_86 = Number(num_84)
num_87 = Number(num_85)

# ---- group: Make RC Design (continued)
num_88 = Number(num_82)
num_89 = Number(num_83)
num_90 = Number(num_81)
num_91 = Number(num_79)
entwine_9 = Entwine(Branch00=num_88, Branch01=num_89, Branch02=num_90, Branch03=num_91, Branch04=num_86, Branch05=num_87, FlattenInputs=True)

# ----
entwine_10 = Entwine(Branch00=num_88, Branch01=num_89, Branch02=num_90, Branch03=num_91, FlattenInputs=True)

data_16 = Data(python_6.out)
num_92 = Number(entwine_9)

data_17 = Data(python_6.s_mesh)
num_93 = Number(entwine_10)

# ---- group: s_mesh
data_18 = Data(data_17)

# ----
python_7 = GhPythonScript(s_mesh=data_18, diam=num_54, max_sp=num_55)  # -> out, s_mesh, sp_asx, sp_asy; inputs diam: list, max_sp: list
# ---------- python_7: Python ----------
# 1. Import dependencies
import rhinoscriptsyntax as rs
import Rhino.Geometry as rg
import math


# 1-b. Define Globals
TAG = 'spacing_'
TOL = 1e-6
AS_TAGS = ['asx_', 'asy_']
my_mesh = s_mesh

# 1-c. Define Functions

def get_bar_area(diameter):
    return math.pi * math.pow((diameter / 10), 2) / 4

def steel_area_to_spacing(steel_areas, diameter, max):
    spacings = []
    bar_area = get_bar_area(diameter)
    
    for s_area in steel_areas:
        if s_area < TOL:
            s_area = TOL
        spacing = s_area / bar_area
        spacing = 1 / spacing
        
        if spacing > max:
            spacing = max
        spacings.append(spacing)
    return spacings

# 2. Set Data
for f_key in my_mesh.c_mesh.faces():
    for as_tag in AS_TAGS:
        steel_area = my_mesh.c_mesh.get_face_attribute(f_key, as_tag)
        if as_tag[2] == 'x':
            sp = steel_area_to_spacing([steel_area], diam[0], max_sp[0])[0]
            my_mesh.c_mesh.set_face_attribute(f_key, TAG+as_tag, sp)
            my_mesh.c_mesh.set_face_attribute(f_key, 'bar_diameter_x', diam[0])
            
        elif as_tag[2] == 'y':
            sp = steel_area_to_spacing([steel_area], diam[1], max_sp[1])[0]
            my_mesh.c_mesh.set_face_attribute(f_key, TAG+as_tag, sp)
            my_mesh.c_mesh.set_face_attribute(f_key, 'bar_diameter_y', diam[1])
            
# 3. Get Data

s_mesh = my_mesh
keys = [f_key for f_key in my_mesh.c_mesh.faces()]

sp_asx_ = my_mesh.c_mesh.get_faces_attribute(keys, TAG+AS_TAGS[0])
sp_asy_ = my_mesh.c_mesh.get_faces_attribute(keys, TAG+AS_TAGS[1])

t_sp_asx_ = sorted(sp_asx_)
t_sp_asy_ = sorted(sp_asy_)

print('Spacings for ASX_ min is {0}. max is {1}'.format(t_sp_asx_[0], t_sp_asx_[-1]))
print('Spacings for ASY_ min is {0}. max is {1}'.format(t_sp_asy_[0], t_sp_asy_[-1]))
# ---------- end python_7 ----------
data_19 = Data(python_7.out)
num_94 = Number(python_7.sp_asx)
num_95 = Number(python_7.sp_asy)
data_20 = Data(python_7.s_mesh)

# ---- group: s_mesh
data_21 = Data(data_20)

# ----
python_8 = GhPythonScript(s_mesh=data_21, perc=num_56)  # -> out, s_mesh, face_centers, seeds_x, seeds_y; inputs perc: list
# ---------- python_8: Python ----------
# 1. Import dependencies
import rhinoscriptsyntax as rs
import Rhino.Geometry as rg
import math


# 1-b. Define Globals
my_mesh = s_mesh
TAG = 'spacing_'
TOL = 1e-6
AS_TAGS = ['asx_', 'asy_']
seeds_x = []
seeds_y = []
face_centers = []

# 1-c. Define Functions

# 2. Set and Get Data
as_dir_1 = TAG + AS_TAGS[0]
as_dir_2 = TAG + AS_TAGS[1]
keys = [f_key for f_key in my_mesh.c_mesh.faces()]

max_dir_1 = sorted(my_mesh.c_mesh.get_faces_attribute(keys, as_dir_1))[-1]
max_dir_2 = sorted(my_mesh.c_mesh.get_faces_attribute(keys, as_dir_2))[-1]
print('Max AS in dir X is {} cm2/m. In dir Y is {} cm2/m'.format(max_dir_1, max_dir_2))

for f_key in my_mesh.c_mesh.faces():
    my_as_dir_1 = my_mesh.c_mesh.get_face_attribute(f_key, as_dir_1)
    my_as_dir_2 = my_mesh.c_mesh.get_face_attribute(f_key, as_dir_2)
    pt = rg.Point3d(*my_mesh.c_mesh.face_centroid(f_key))
    
    face_centers.append(pt)
    if my_as_dir_1 <= max_dir_1 * perc[0]:
        seeds_x.append((pt, my_as_dir_1))
    if my_as_dir_2 <= max_dir_2 * perc[1]:
        seeds_y.append((pt, my_as_dir_2))

s_mesh = my_mesh
seeds_x = [seed[0] for seed in sorted(seeds_x, key=lambda x: x[1])]
seeds_y = [seed[0] for seed in sorted(seeds_y, key=lambda x: x[1])]

print('Number of Seeds in X direction is {}'.format(len(seeds_x)))
print('Number of Seeds in Y direction is {}'.format(len(seeds_y)))
# ---------- end python_8 ----------
pt_12 = Point(python_8.seeds_y)

# ---- group: seeds Y
pt_13 = Point(pt_12)

# ----
pt_14 = Point(python_8.seeds_x)

# ---- group: seeds X
pt_15 = Point(pt_14)

# ----
entwine_11 = Entwine(Branch00=pt_15, Branch01=pt_13, FlattenInputs=True)
filter = StreamFilter(Gate=bool_9, Stream1=entwine_11)
dots = DotDisplay(Point=filter, Colour=entwine_8, Size="0.01")

data_22 = Data(python_8.out)
data_23 = Data(python_8.s_mesh)  # disabled
pt_16 = Point(python_8.face_centers)  # disabled

# ---- group: s_mesh
data_24 = Data(data_20)

data_25 = Data(data_20)

data_26 = Data(data_20)

data_27 = Data(data_20)

# ----
python_9 = GhPythonScript(show=bool_14, s_mesh=data_25, vector_tag=txt_17, v_scale=num_34)  # -> out, s_mesh, line_field, node_line_field, centers_line_field, colors_line_field, colors_node_line_field, colors_centers_line_field, vectors_a, vectors_b; inputs show: Boolean
# ---------- python_9: Python ----------
"""Retrieves data from a Structural Mesh object"""

__author__ = "Rafael Pastrana"
__name__ = "Mesh Displayer"
__date__ = "2018.07.24"
__version__ = "0.0.1"


# 1. Import dependencies
import imp
import rhinoscriptsyntax as rs
import sys
sys.path.append("Z:\projects\streamlines\src\streamlines")
import display
imp.reload(display)
from display import Display
import compas.geometry as cg

dsp = Display()

# 2. Start System
my_mesh = s_mesh
v_name = vector_tag
TAG = '_val'

if show is True:
    # vector properties
    line_field = dsp.draw_face_vectors(my_mesh, v_name, v_scale)
    node_line_field = dsp.draw_node_vectors(my_mesh, v_name, v_scale)
    center_vectors = my_mesh.find_vector_face_centers(v_name)
    centers = list(map(lambda x: my_mesh.c_mesh.face_centroid(x), my_mesh.c_mesh.faces()))
    centers_line_field = dsp.draw_vectors(centers, center_vectors, v_scale)
        
    f_color = []
    for f_key in my_mesh.c_mesh.faces():
        val = my_mesh.c_mesh.get_face_attribute(f_key, v_name+TAG)
        if val:
            if val < 0:
                f_color.append(rs.CreateColor(255,0,0))
            else:
                f_color.append(rs.CreateColor(0,0,255))
        else:
            f_color.append(rs.CreateColor(0,0,255))
            
    n_color = []
    for v_key in my_mesh.c_mesh.vertices():
        val = my_mesh.c_mesh.get_vertex_attribute(v_key, v_name+TAG)
        if val < 0:
            n_color.append(rs.CreateColor(0,0,0))
        else:
            n_color.append(rs.CreateColor(0,0,0))
    
    colors_line_field = f_color
    colors_node_line_field = n_color
    colors_centers_line_field = f_color
    
    vectors_a = list(map(lambda x: my_mesh.c_mesh.get_vertex_attribute(x,v_name+'_a'), my_mesh.c_mesh.vertices()))
    vectors_a = list(map(lambda x: rs.CreateVector(*x), vectors_a))
    
    vectors_b = list(map(lambda x: my_mesh.c_mesh.get_vertex_attribute(x,v_name+'_b'), my_mesh.c_mesh.vertices()))
    vectors_b = list(map(lambda x: rs.CreateVector(*x), vectors_b))
# ---------- end python_9 ----------
python_10 = GhPythonScript(show=bool_15, s_mesh=data_26, vector_tag=txt_19, v_scale=num_33)  # -> out, s_mesh, line_field, node_line_field, centers_line_field, colors_line_field, colors_node_line_field, colors_centers_line_field, vectors_a, vectors_b; inputs show: Boolean; same code as python_9
python_11 = GhPythonScript(show=bool_11, s_mesh=data_24, data_tag=txt_16, mode=txt_15)  # -> out, s_mesh, display_mesh, color_data, data_values; inputs show: Boolean
# ---------- python_11: Python ----------
"""Retrieves data from a Structural Mesh object"""

__author__ = "Rafael Pastrana"
__name__ = "Mesh Displayer"
__date__ = "2018.07.24"
__version__ = "0.0.1"


# 1. Import dependencies
import imp
import copy
import rhinoscriptsyntax as rs
import sys
sys.path.append("Z:\Dropbox\Documentos\ETH Zuerich\ETH MAS Thesis\code\current")

import Display
imp.reload(Display)
from Display import Display

dsp = Display()
my_mesh = s_mesh

# 2. Start System
if show is True:
    display_mesh = my_mesh.gh_mesh
    color_data = None
    data_values = my_mesh.get_data_on_nodes(data_tag, mode)
    # display_mesh, data_values, color_data = dsp.plot_mesh(my_mesh, data_tag, mode)
# ---------- end python_11 ----------
data_28 = Data(python_11.s_mesh)
python_12 = GhPythonScript(s_mesh=data_27, steel_density="7.85")  # -> out, steel_mass, mass_bot, mass_top, mass_center
# ---------- python_12: Python ----------
"""Retrieves data from a Structural Mesh object"""

__author__ = "Rafael Pastrana"
__name__ = "Steel Mass Calculator"
__date__ = "2018.08.02"
__version__ = "0.0.1"


# 1. Import dependencies
import rhinoscriptsyntax as rs

# 2. Define Globals
DENSITY = steel_density  # kg/cm3
TOL = 1e-6
AS_TAGS = ['asx_b', 'asx_t', 'asy_b', 'asy_t', 'asx_c', 'asy_c']

# 3. Start System
my_mesh = s_mesh
face_areas = list(map(lambda x: my_mesh.c_mesh.face_area(x), my_mesh.c_mesh.faces()))

# 4. Get Mass at Bottom Layer
m_asx_b = list(map(lambda x: DENSITY * my_mesh.c_mesh.get_face_attribute(x,AS_TAGS[0]), my_mesh.c_mesh.faces()))
m_asy_b = list(map(lambda x: DENSITY * my_mesh.c_mesh.get_face_attribute(x,AS_TAGS[2]), my_mesh.c_mesh.faces()))

m_asx_t = list(map(lambda x: DENSITY * my_mesh.c_mesh.get_face_attribute(x,AS_TAGS[1]), my_mesh.c_mesh.faces()))
m_asy_t = list(map(lambda x: DENSITY * my_mesh.c_mesh.get_face_attribute(x,AS_TAGS[3]), my_mesh.c_mesh.faces()))

m_asx_c = list(map(lambda x: DENSITY * my_mesh.c_mesh.get_face_attribute(x,AS_TAGS[4]), my_mesh.c_mesh.faces()))
m_asy_c = list(map(lambda x: DENSITY * my_mesh.c_mesh.get_face_attribute(x,AS_TAGS[5]), my_mesh.c_mesh.faces()))

mass_bot = reduce(lambda x, y: x+y, [sum(x)*face_areas[idx] for idx, x in enumerate(zip(m_asx_b, m_asy_b))])
mass_top = reduce(lambda x, y: x+y, [sum(x)*face_areas[idx] for idx, x in enumerate(zip(m_asx_t, m_asy_t))])
mass_center = reduce(lambda x, y: x+y, [sum(x)*face_areas[idx] for idx, x in enumerate(zip(m_asx_c, m_asy_c))])

steel_mass = mass_bot + mass_top + mass_center
# ---------- end python_12 ----------
python_13 = GhPythonScript(x=data_28)  # -> out, a
# ---------- python_13: Python ----------
__author__ = "ARPJ"
__version__ = "2018.08.01"

import rhinoscriptsyntax as rs

print('number of edges is: {}'.format(len([e for e in x.c_mesh.edges()])))
# ---------- end python_13 ----------
num_96 = Number(python_12.steel_mass)
num_97 = Number(python_12.mass_bot)
num_98 = Number(python_12.mass_top)
num_99 = Number(python_12.mass_center)
num_100 = Number(num_99)

num_101 = Number(num_96)
num_102 = Number(num_97)
num_103 = Number(num_98)
data_29 = Data(data_19)
data_30 = Data(data_22)
num_104 = Number(num_92)
data_31 = Data(data_16)
entwine_12 = Entwine(Branch00=num_102, Branch01=num_103, Branch02=num_100, Branch03=num_101, FlattenInputs=True)
num_105 = Number(num_92)
bnd = Bounds(Numbers=num_104)
sort = SortList(Keys=num_105)  # -> Keys, ValuesA
concat = Concatenate(FragmentA=graft(panel_24), FragmentB="domain is:", FragmentC=bnd, JoinSeparator=" ")
concat_2 = Concatenate(FragmentA=graft(panel_23), FragmentB="mass is:", FragmentC=entwine_12, FragmentD="kg", JoinSeparator=" ")
panel_25 = Panel(data_29)
panel_26 = Panel(data_30)
panel_27 = Panel(data_31)
reinforcement_areas_domain_cm2_m = Panel(concat)
graph = QuickGraph(sort.Keys, SortOrder=0)
reinforcement_areas_domain_cm2_m_2 = Panel(concat_2)

panel_28 = Panel(python_13.out)
num_106 = Number(python_11.data_values)
mesh_12 = Mesh(python_11.display_mesh)
mesh_13 = Mesh(mesh_12)
wbnaked = WeaverbirdsNakedBoundary(MeshClosedPolylines=mesh_13)

entwine_13 = Entwine(Branch00=wbnaked, Branch01=crv_4, Branch02=crv_5, FlattenInputs=True)
previewlw = CustomPreviewLineweights(Geometry=entwine_13, Shader=entwine_7, Thickness="4", Absolute=False)

col = Colour(python_11.color_data)
line = Line(python_9.centers_line_field)
line_2 = Line(python_9.line_field)
col_2 = Colour(python_9.colors_line_field)
col_3 = Colour(python_9.colors_centers_line_field)
vec_26 = Vector(python_9.vectors_a)
line_3 = Line(python_10.line_field)
line_4 = Line(python_10.centers_line_field)
col_4 = Colour(python_10.colors_line_field)
col_5 = Colour(python_10.colors_centers_line_field)
vec_27 = Vector(python_10.vectors_a)
vec_28 = Vector(python_9.vectors_b)
vec_29 = Vector(python_10.vectors_b)
line_5 = Line(python_9.node_line_field)

line_6 = Line(line_2)
line_7 = Line(line_5)
line_8 = Line(line)

line_9 = Line(flatten(line_7))
line_10 = Line(line_9)
end = EndPoints(Curve=graft(line_10))  # -> Start, End
vec2pt = Vector2Pt(PointA=end.Start, PointB=end.End, Unitize=False)  # -> flatten(Vector), Length
evaluate_curve = EvaluateCurve(Curve=graft(line_10), Parameter=0.5)  # -> Point, Tangent, Angle
vec2pt_2 = Vector2Pt(PointA=end.Start, PointB=end.End, Unitize="True")  # -> Vector, Length
vlen = VectorLength(Vector=vec2pt.Vector)
multiplication_5 = Multiplication(A=vec2pt_2.Vector, B=Slider(0.04, range=0..0.1))
reverse = Reverse(Vector=multiplication_5)
bnd_2 = Bounds(Numbers=vlen)
remap = RemapNumbers(Value=vlen, Source=bnd_2, Target=Domain(0, 1))  # -> Mapped, Clipped
move = Move(Geometry=line_9, Motion=Z_2)  # -> Geometry, Transform
move_2 = Move(Geometry=evaluate_curve.Point, Motion=reverse)  # -> Geometry, Transform
move_3 = Move(Geometry=evaluate_curve.Point, Motion=multiplication_5)  # -> Geometry, Transform
graph_2 = GraphMapper(remap.Mapped, x0=0, x1=1, y0=0, y1=1, container_name="Bezier", cpx=[0, 0, 0.9786925316, 1], cpy=[0, 0, 0.5259319544, 1])
line_11 = Line(StartPoint=move_3.Geometry, EndPoint=move_2.Geometry)  # -> flatten(Line)
bnd_3 = Bounds(Numbers=graph_2)
line_12 = Line(line_11)
gradient_4 = Gradient(
    LowerLimit="1",
    UpperLimit="-1",
    Parameter=graph_2,
    stops=[0: RGB(255, 0, 0), 0.176: RGB(255, 238, 0), 0.35: RGB(0, 255, 234), 0.504: RGB(35, 4, 128), 0.664: RGB(0, 252, 215), 0.843: RGB(255, 255, 0), 1: RGB(255, 0, 47)])
avr = Average(Input=[end.Start, end.End])  # -> flatten(ArithmeticMean)
remap_2 = RemapNumbers(Value=graph_2, Source=bnd_3, Target="4 to 0.5")  # -> Mapped, Clipped
scale = Scale(Geometry=line_10, Center=avr, Factor=remap_2.Mapped)  # -> Geometry, Transform
line_13 = Line(scale.Geometry)
col_6 = Colour(gradient_4)
preview = CustomPreview(Geometry=line_13, Material=swatch_3)
preview_2 = CustomPreview(Geometry=line_10, Material=col_6)
preview_3 = CustomPreview(Geometry=line_12, Material=gradient_4)
col_7 = Colour(col_6)
line_14 = Line(line_13)
graft_15 = GraftTree(Tree=col_7, IncludeEmptyLists=True, IncludeNullItems=True)
graft_16 = GraftTree(Tree=line_14, IncludeEmptyLists=True, IncludeNullItems=True)
createatts = CreateAttributes(LayerName="colored_vectors", Color=graft_15, enableFullPath=False)
bake = BakeGeometry(Bake=Button(), Geometry=graft_16, Attributes=createatts, DeleteOldBakes=False, PreserveTrees=False)
line_15 = Line(python_10.node_line_field)

line_16 = Line(line_3)
line_17 = Line(line_15)
line_18 = Line(line_4)

line_19 = Line(flatten(line_17))
line_20 = Line(line_19)
end_2 = EndPoints(Curve=graft(line_20))  # -> Start, End
vec2pt_3 = Vector2Pt(PointA=end_2.Start, PointB=end_2.End, Unitize=False)  # -> flatten(Vector), Length
vlen_2 = VectorLength(Vector=vec2pt_3.Vector)
bnd_4 = Bounds(Numbers=vlen_2)
remap_3 = RemapNumbers(Value=vlen_2, Source=bnd_4, Target=Domain(0, 1))  # -> Mapped, Clipped
move_4 = Move(Geometry=line_19, Motion=Z_3)  # -> Geometry, Transform
graph_3 = GraphMapper(
    remap_3.Mapped,
    x0=0,
    x1=1,
    y0=0,
    y1=1,
    container_name="Bezier",
    cpx=[0, 0, 1, 1],
    cpy=[0, 0.3821747303, 0.5108695626, 1])
bnd_5 = Bounds(Numbers=graph_3)
gradient_5 = Gradient(
    LowerLimit="1",
    UpperLimit="-1",
    Parameter=graph_3,
    stops=[0: RGB(255, 0, 0), 0.176: RGB(255, 238, 0), 0.35: RGB(0, 255, 234), 0.504: RGB(35, 4, 128), 0.664: RGB(0, 252, 215), 0.843: RGB(255, 255, 0), 1: RGB(255, 0, 47)])
avr_2 = Average(Input=[end_2.Start, end_2.End])  # -> flatten(ArithmeticMean)
remap_4 = RemapNumbers(Value=graph_3, Source=bnd_5, Target="4 to 0.5")  # -> Mapped, Clipped
scale_2 = Scale(Geometry=line_20, Center=avr_2, Factor=remap_4.Mapped)  # -> Geometry, Transform
line_21 = Line(scale_2.Geometry)
col_8 = Colour(gradient_5)
preview_4 = CustomPreview(Geometry=line_20, Material=col_8)
preview_5 = CustomPreview(Geometry=line_21, Material=swatch_3)
line_22 = Line(line_21)
col_9 = Colour(col_8)
graft_17 = GraftTree(Tree=col_9, IncludeEmptyLists=True, IncludeNullItems=True)
graft_18 = GraftTree(Tree=line_22, IncludeEmptyLists=True, IncludeNullItems=True)
createatts_2 = CreateAttributes(LayerName="colored_vectors", Color=graft_17, enableFullPath=False)
bake_2 = BakeGeometry(Bake=Button(), Geometry=graft_18, Attributes=createatts_2, DeleteOldBakes=False, PreserveTrees=False)
data_32 = Data(python_9.s_mesh)
col_10 = Colour(python_9.colors_node_line_field)

col_11 = Colour(col_2)
col_12 = Colour(col_10)
col_13 = Colour(col_3)

entwine_14 = Entwine(Branch00=line_6, Branch01=line_7, Branch02=line_8, FlattenInputs=True)
entwine_15 = Entwine(Branch00=col_11, Branch01=col_12, Branch02=col_13, FlattenInputs=True)
move_5 = Move(Geometry=entwine_14, Motion=X_3)  # -> Geometry, Transform
preview_6 = CustomPreview(Geometry=line_9, Material=ColourSwatch(SwatchColor=RGB(255, 255, 255)))

data_33 = Data(python_10.s_mesh)

# ---- group: s_mesh
data_34 = Data(data_33)

# ----
python_14 = GhPythonScript(show=bool_12, s_mesh=data_34, vector_tag=txt_18, tol=num_32)  # -> out, s_mesh, face_neg, face_null, face_pos; inputs show: Boolean
# ---------- python_14: Python ----------
"""Retrieves data from a Structural Mesh object"""

__author__ = "Rafael Pastrana"
__name__ = "Mesh Displayer"
__date__ = "2018.07.24"
__version__ = "0.0.1"


# 1. Import dependencies
import rhinoscriptsyntax as rs

# 2. Start System
my_mesh = s_mesh
v_name = vector_tag

if show is True:
    my_mesh.get_face_labels(v_name, tol)
    face_neg, face_null, face_pos = my_mesh.stream_face_labels()
# ---------- end python_14 ----------
data_35 = Data(python_14.s_mesh)

# ---- group: s_mesh
data_36 = Data(data_35)

# ----
python_15 = GhPythonScript(show=bool_13, s_mesh=data_36)  # -> out, s_mesh, face_planes, edge_planes; inputs show: Boolean
# ---------- python_15: Python ----------
"""Retrieves data from a Structural Mesh object"""

__author__ = "Rafael Pastrana"
__name__ = "Mesh Displayer"
__date__ = "2018.07.24"
__version__ = "0.0.1"


# 1. Import dependencies
import rhinoscriptsyntax as rs

# 2. Start System
my_mesh = s_mesh

if show is True:
    # plane properties
    face_planes = list(map(lambda x: my_mesh.cMesh.get_face_attribute(x,'plane'), my_mesh.cMesh.faces()))
    face_planes = [rs.PlaneFromNormal(x[0], x[1]) for x in face_planes]
    
    edge_planes = list(map(lambda x: my_mesh.cMesh.get_edge_attribute(x,'plane'), my_mesh.cMesh.edges()))
    edge_planes = [rs.PlaneFromNormal(x[0], x[1]) for x in edge_planes if x is not None]

s_mesh = s_mesh
# ---------- end python_15 ----------
pt_17 = Point(python_14.face_neg)
pt_18 = Point(python_14.face_null)
pt_19 = Point(python_14.face_pos)

pt_20 = Point(pt_17)
pt_21 = Point(pt_18)
pt_22 = Point(pt_19)  # disabled

entwine_16 = Entwine(Branch00=pt_20, Branch01=pt_21, Branch02=pt_22, FlattenInputs=True)
move_6 = Move(Geometry=entwine_16, Motion=X_2)  # -> Geometry, Transform
circle_cnr = CircleCNR(Center=move_6.Geometry, Normal=Vector(0, 0, 1), Radius="0.05")
custom_preview = CustomPreview(Geometry=circle_cnr, Material=entwine_3)
data_37 = Data(python_15.s_mesh)
pln = Plane(python_15.edge_planes)
pln_2 = Plane(python_15.face_planes)
col_14 = Colour(python_10.colors_node_line_field)

col_15 = Colour(col_4)
col_16 = Colour(col_14)
col_17 = Colour(col_5)

entwine_17 = Entwine(Branch00=line_16, Branch01=line_17, Branch02=line_18, FlattenInputs=True)
entwine_18 = Entwine(Branch00=col_15, Branch01=col_16, Branch02=col_17, FlattenInputs=True)
move_7 = Move(Geometry=entwine_17, Motion=X_4)  # -> Geometry, Transform
preview_7 = CustomPreview(Geometry=line_19, Material=ColourSwatch(SwatchColor=RGB(255, 255, 255)))

data_38 = Data(data_20)
data_39 = Data(data_20)
python_16 = GhPythonScript(
    run=bool_20,
    s_mesh=flatten(data_38),
    weights=num_57,
    dL=num_58,
    min_length=num_59,
    vector_tag=txt_21,
    as_tag=txt_20,
    min_sp=num_60,
    uni_sp=bool_21,
    num_samples=int_17,
    strat_factor=num_61,
    others_prox=num_62,
    start_prox=num_63,
    self_prox=num_64,
    iterations=num_65)  # -> out, str_system; inputs weights: list, uni_sp: Boolean, num_samples: Int32, iterations: Int32
# ---------- python_16: Python ----------
fac__author__ = "Rafael Pastrana"
__name__ = "Streamliner"
__date__ = "2018.08.05"
__version__ = "0.0.4"


# 0. Import dependencies
import sys
import imp
import rhinoscriptsyntax as rs
import clr
clr.AddReference("Grasshopper")
import Grasshopper.Kernel.Data.GH_Path as ghpath
import Grasshopper.DataTree as datatree
import System
import ghpythonlib.parallel as gh_parallel
 
# 0-b. Replace with your own path here
sys.path.append("Z:\projects\streamlines\src\streamlines")
import streamsystem
imp.reload(streamsystem)
from streamsystem import Streamsystem


# 1. Define Globals 
TAG = 'spacing_'
TOL = 1e-6
AS_TAGS = [TAG+'asx_', TAG+'asy_']
MIN_SP = min_sp  # minimum backup separation for objects
UNI_SP = uni_sp  # Ignore Separation Map from RC Design?

W_1 = [weights[0], weights[1], weights[2]]
W_2= [weights[3], weights[4], weights[5]]
vec_tag_dict = {'n_1':'n_2', 'n_2':'n_1', 'm_1':'m_2', 'm_2':'m_1', 'ps_1_top':'ps_2_top', 'ps_1_bot':'ps_2_bot', 'ps_1_mid':'ps_2_mid', 'ps_2_top':'ps_1_top', 'ps_2_bot':'ps_1_bot', 'ps_2_mid':'ps_1_mid', 'custom_1':'custom_2', 'custom_2':'custom_1'}

# 2. Establish Tag Convention
if as_tag == 'asx_':
    as_dir = AS_TAGS[0]
    w = W_1
    vector_tag = vector_tag

elif as_tag == 'asy_':
    as_dir = AS_TAGS[1]
    w = W_2
    vector_tag = vec_tag_dict[vector_tag]

# 3. Create Data Trees for collecting output
streamlines = datatree[System.Object]()
streamlines_objects = datatree[System.Object]()
short_streamlines = datatree[System.Object]()
offsets = datatree[System.Object]()

# 4. Run Streamlines on Direction 1
if run :
    str_system = Streamsystem(s_mesh, as_dir, dL, MIN_SP, UNI_SP)
    str_system.set_tracing_data(vector_tag, w, min_length)
    str_system.make_streamlines_jobard(strat_factor, others_prox, start_prox, self_prox, num_samples, iterations)
# ---------- end python_16 ----------
python_17 = GhPythonScript(
    run=bool_22,
    s_mesh=flatten(data_39),
    weights=num_67,
    dL=num_69,
    min_length=num_66,
    vector_tag=txt_22,
    as_tag=txt_23,
    min_sp=num_70,
    uni_sp=bool_23,
    num_samples=int_18,
    strat_factor=num_71,
    others_prox=num_72,
    start_prox=num_68,
    self_prox=num_73,
    iterations=num_74)  # -> out, str_system; inputs weights: list, uni_sp: Boolean, num_samples: Int32, iterations: Int32
# ---------- python_17: Python ----------
__author__ = "Rafael Pastrana"
__name__ = "Streamliner"
__date__ = "2018.08.05"
__version__ = "0.0.4"


# 0. Import dependencies
import sys
import imp
import rhinoscriptsyntax as rs
import clr
clr.AddReference("Grasshopper")
import Grasshopper.Kernel.Data.GH_Path as ghpath
import Grasshopper.DataTree as datatree
import System
import ghpythonlib.parallel as gh_parallel
 
# 0-b. Replace with your own path here
sys.path.append("Z:\projects\streamlines\src\streamlines")
import streamsystem
imp.reload(streamsystem)
from streamsystem import Streamsystem


# 1. Define Globals 
TAG = 'spacing_'
TOL = 1e-6
AS_TAGS = [TAG+'asx_', TAG+'asy_']
MIN_SP = min_sp  # minimum backup separation for objects
UNI_SP = uni_sp  # Ignore Separation Map from RC Design?

W_1 = [weights[0], weights[1], weights[2]]
W_2= [weights[3], weights[4], weights[5]]
vec_tag_dict = {'n_1':'n_2', 'n_2':'n_1', 'm_1':'m_2', 'm_2':'m_1', 'ps_1_top':'ps_2_top', 'ps_1_bot':'ps_2_bot', 'ps_1_mid':'ps_2_mid', 'ps_2_top':'ps_1_top', 'ps_2_bot':'ps_1_bot', 'ps_2_mid':'ps_1_mid', 'custom_1':'custom_2', 'custom_2':'custom_1'}

# 2. Establish Tag Convention
if as_tag == 'asx_':
    as_dir = AS_TAGS[0]
    w = W_1
    vector_tag = vector_tag

elif as_tag == 'asy_':
    as_dir = AS_TAGS[1]
    w = W_2
    vector_tag = vec_tag_dict[vector_tag]

# 3. Create Data Trees for collecting output
streamlines = datatree[System.Object]()
streamlines_objects = datatree[System.Object]()
short_streamlines = datatree[System.Object]()
offsets = datatree[System.Object]()

# 4. Run Streamlines on Direction 1
if run :
    str_system = Streamsystem(s_mesh, as_dir, dL, MIN_SP, UNI_SP)
    str_system.set_tracing_data(vector_tag, w, min_length)
    str_system.make_streamlines_jobard(strat_factor, others_prox, start_prox, self_prox, num_samples, iterations)

# 5. Collect Streamlines
#    for idx, streamline in enumerate(str_system.streamlines):
#        rh_pts = []
#        for point in streamline.polyline.points:
#            rh_pts.append(rs.AddPoint(*point))
#        streamlines.AddRange(rh_pts, ghpath(idx))
#        streamlines_objects.Add(streamline, ghpath(idx))
#        
#    for idx, streamline in enumerate(str_system.short_streamlines):
#        rh_pts = []
#        for point in streamline.polyline.points:
#            rh_pts.append(rs.AddPoint(*point))
#        short_streamlines.AddRange(rh_pts, ghpath(idx))
#   
#    for idx, streamline in enumerate(str_system.offsets):
#        rh_pts = []
#        for point in streamline.polyline.points:
#            rh_pts.append(rs.AddPoint(*point))
#        offsets.AddRange(rh_pts, ghpath(idx))
#        
#    seed_pts = str_system.seed_pts
#    first_pt = str_system.first_pt


# if run_2:
#     print('dir 2')
#     myStreamSystem = StreamSystem(s_mesh, seeds_2, as_dir_2, dL, MIN_SP, UNI_SP)
#     myStreamSystem.set_data_mebarki(vector_tag_2, W_2, min_length)
# 
#     all_seeds = seeds_2
#     if PARALLEL is True:
#         rh_pts = gh_parallel.run(myStreamSystem.make_streamline_mebarki_parallel, [all_seeds], True)
#     else:
#         rh_pts = myStreamSystem.make_streamline_mebarki_parallel([all_seeds])
# 
#     for idx, pts in enumerate(rh_pts):
#         if pts:
#            streamlines_2.AddRange(pts, ghpath(idx))
# ---------- end python_17 ----------
data_40 = Data(python_16.str_system)
data_41 = Data(python_17.str_system)
panel_29 = Panel(python_16.out)
data_42 = Data(data_40)
data_43 = Data(data_41)
panel_30 = Panel(python_17.out)
python_18 = GhPythonScript(streamsystem=data_42)  # -> out, offsets, first_pt, seed_pts, streamlines, streamlines_objects, short_streamlines
# ---------- python_18: Python ----------
__author__ = "Rafael Pastrana"
__name__ = "Streamliner"
__date__ = "2018.08.05"
__version__ = "0.0.4"


# 0. Import dependencies
import sys
import imp
import rhinoscriptsyntax as rs
import clr
clr.AddReference("Grasshopper")
import Grasshopper.Kernel.Data.GH_Path as ghpath
import Grasshopper.DataTree as datatree
import System
import ghpythonlib.parallel as gh_parallel
 
# 0-b. Replace with your own path here
# sys.path.append("Z:\Dropbox\Documentos\ETH Zuerich\ETH MAS Thesis\code\current")
#import streamsystem
#imp.reload(streamsystem)
#from streamsystem import Streamsystem


# 1. Define Globals 
streamlines = datatree[System.Object]()
streamlines_objects = datatree[System.Object]()
short_streamlines = datatree[System.Object]()
offsets = datatree[System.Object]()


# 5. Collect Streamlines
if streamsystem is not None:
    str_system = streamsystem
    
    for idx, streamline in enumerate(str_system.streamlines):
        rh_pts = []
        for point in streamline.polyline.points:
            rh_pts.append(rs.AddPoint(*point))
        streamlines.AddRange(rh_pts, ghpath(idx))
        streamlines_objects.Add(streamline, ghpath(idx))
        
    for idx, streamline in enumerate(str_system.short_streamlines):
        rh_pts = []
        for point in streamline.polyline.points:
            rh_pts.append(rs.AddPoint(*point))
        short_streamlines.AddRange(rh_pts, ghpath(idx))
    
    for idx, streamline in enumerate(str_system.offsets):
        rh_pts = []
        for point in streamline.polyline.points:
            rh_pts.append(rs.AddPoint(*point))
        offsets.AddRange(rh_pts, ghpath(idx))
        
    seed_pts = str_system.seed_pts
    first_pt = str_system.first_pt
# ---------- end python_18 ----------
python_19 = GhPythonScript(streamsystem=data_43)  # -> out, offsets, first_pt, seed_pts, streamlines, streamlines_objects, short_streamlines
# ---------- python_19: Python ----------
__author__ = "Rafael Pastrana"
__name__ = "Streamliner"
__date__ = "2018.08.05"
__version__ = "0.0.4"


# 0. Import dependencies
import sys
import imp
import rhinoscriptsyntax as rs
import clr
clr.AddReference("Grasshopper")
import Grasshopper.Kernel.Data.GH_Path as ghpath
import Grasshopper.DataTree as datatree
import System
import ghpythonlib.parallel as gh_parallel
 
# 0-b. Replace with your own path here
sys.path.append("Z:\Dropbox\Documentos\ETH Zuerich\ETH MAS Thesis\code\current")
#import streamsystem
#imp.reload(streamsystem)
#from streamsystem import Streamsystem


# 1. Define Globals 
streamlines = datatree[System.Object]()
streamlines_objects = datatree[System.Object]()
short_streamlines = datatree[System.Object]()
offsets = datatree[System.Object]()


# 5. Collect Streamlines
if streamsystem is not None:
    str_system = streamsystem
    
    for idx, streamline in enumerate(str_system.streamlines):
        rh_pts = []
        for point in streamline.polyline.points:
            rh_pts.append(rs.AddPoint(*point))
        streamlines.AddRange(rh_pts, ghpath(idx))
        streamlines_objects.Add(streamline, ghpath(idx))
        
    for idx, streamline in enumerate(str_system.short_streamlines):
        rh_pts = []
        for point in streamline.polyline.points:
            rh_pts.append(rs.AddPoint(*point))
        short_streamlines.AddRange(rh_pts, ghpath(idx))
    
    for idx, streamline in enumerate(str_system.offsets):
        rh_pts = []
        for point in streamline.polyline.points:
            rh_pts.append(rs.AddPoint(*point))
        offsets.AddRange(rh_pts, ghpath(idx))
        
    seed_pts = str_system.seed_pts
    first_pt = str_system.first_pt
# ---------- end python_19 ----------
pt_23 = Point(python_18.first_pt)
pt_24 = Point(python_18.seed_pts)
pt_25 = Point(python_18.short_streamlines)
pt_26 = Point(python_18.offsets)
pt_27 = Point(python_18.streamlines)
data_44 = Data(python_18.streamlines_objects)
pt_28 = Point(python_19.streamlines)
pt_29 = Point(python_19.short_streamlines)
pt_30 = Point(python_19.seed_pts)
data_45 = Data(python_19.streamlines_objects)
pt_31 = Point(python_19.first_pt)
pt_32 = Point(python_19.offsets)

pt_33 = Point(pt_26)
pt_34 = Point(pt_25)
pt_35 = Point(pt_27)
pline = PolyLine(Vertices=pt_35, Closed=False)
pline_2 = PolyLine(Vertices=pt_33, Closed=False)
pline_3 = PolyLine(Vertices=pt_34, Closed=False)
crv_8 = Curve(pline)
crv_9 = Curve(pline_2)
crv_10 = Curve(pline_3)

pt_36 = Point(pt_29)
pt_37 = Point(pt_32)
pt_38 = Point(pt_28)
pline_4 = PolyLine(Vertices=pt_38, Closed=False)
pline_5 = PolyLine(Vertices=pt_37, Closed=False)
pline_6 = PolyLine(Vertices=pt_36, Closed=False)
crv_11 = Curve(pline_5)
crv_12 = Curve(pline_4)
crv_13 = Curve(pline_6)

crv_14 = Curve(crv_8)
crv_15 = Curve(crv_8)
crv_16 = Curve(crv_12)
crv_17 = Curve(crv_12)
tstat = TreeStatistics(Tree=crv_14)  # -> Paths, Length, Count
flatten_3 = FlattenTree(Tree=crv_15, Path="{0}")
tstat_2 = TreeStatistics(Tree=crv_17)  # -> Paths, Length, Count
flatten_4 = FlattenTree(Tree=crv_16, Path="{0}")
crv_18 = Curve(crv_12)
series_2 = Series(Start=0, Step=1, Count=tstat.Count)
eval_3 = EvaluateCurve(Curve=reparameterize(flatten_3), Parameter="0.5")  # -> Point, Tangent, Angle
series_3 = Series(Start=0, Step=1, Count=tstat_2.Count)
eval_4 = EvaluateCurve(Curve=reparameterize(flatten_4), Parameter="0.5")  # -> Point, Tangent, Angle
gradient_6 = Gradient(
    LowerLimit=0,
    UpperLimit=expr("x-1", tstat.Count),
    Parameter=series_2,
    stops=[0: RGB(255, 255, 255), 0.498: RGB(89, 147, 247), 1: RGB(20, 2, 107)])
gradient_7 = Gradient(
    LowerLimit=0,
    UpperLimit=expr("x-1", tstat_2.Count),
    Parameter=series_3,
    stops=[0: RGB(255, 255, 255), 0.498: RGB(89, 147, 247), 1: RGB(20, 2, 107)])
intersection_2 = SetIntersection(SetA=eval_3.Point, SetB=eval.Point)
intersection_3 = SetIntersection(SetA=eval_4.Point, SetB=eval_2.Point)
item_8 = ListItem(List=flatten(crv_18), Index=Slider(19, range=0..100), Wrap=True)
mindex = MemberIndex(Set=eval.Point, Member=intersection_2)  # -> flatten(Index), Count
mindex_2 = MemberIndex(Set=eval_2.Point, Member=intersection_3)  # -> flatten(Index), Count
cull_i = CullIndex(List=flatten, Indices=mindex.Index, Wrap=True)
cull_i_2 = CullIndex(List=flatten_2, Indices=mindex_2.Index, Wrap=True)
graft_19 = GraftTree(Tree=gradient_6, IncludeEmptyLists=True, IncludeNullItems=True)
graft_20 = GraftTree(Tree=gradient_7, IncludeEmptyLists=True, IncludeNullItems=True)
smoothpline = SmoothPolyline(Polyline=crv_14, Strength=1, Times="50")
previewlw_2 = CustomPreviewLineweights(Geometry=cull_i, Shader=ColourSwatch(SwatchColor=RGB(107, 107, 107)), Thickness="3", Absolute=False)
previewlw_3 = CustomPreviewLineweights(Geometry=crv_14, Shader=graft_19, Thickness="3", Absolute=False)
previewlw_4 = CustomPreviewLineweights(Geometry=crv_17, Shader=graft_20, Thickness="3", Absolute=False)
previewlw_5 = CustomPreviewLineweights(Geometry=cull_i_2, Shader=ColourSwatch(SwatchColor=RGB(107, 107, 107)), Thickness="3", Absolute=False)

# ---- group: The Bridge
pt_39 = Point()  # disabled
pt_40 = Point()  # disabled
mesh_14 = Mesh()  # disabled
data_46 = Data(data_20)  # disabled

# ----
mesh_15 = Mesh(mesh_12)

demesh_2 = DeconstructMesh(Mesh=mesh_15)  # -> Vertices, Faces, Colours, Normals

num_107 = Number(num_106)
bnd_6 = Bounds(Numbers=num_107)
python_20 = GhPythonScript(x=num_107)  # -> out, a; inputs x: list
# ---------- python_20: Python ----------
__author__ = "ARPJ"
__version__ = "2018.08.01"

import rhinoscriptsyntax as rs

def normalise_data(data, cmin=None, cmax=None):
    fmax = cmax if cmax is not None else max([abs(x) for x in data])
    fmin = cmin if cmin is not None else min([abs(x) for x in data])
    fabs = max([abs(fmin), abs(fmax)])

    fscaled = []
    for value in data:
        new_val = value / fabs
        if new_val > 1:
            new_val = 1
        elif new_val < -1:
            new_val = -1
        fscaled.append(new_val)
    return fscaled

a = normalise_data(x)
# ---------- end python_20 ----------
dedomain = DeconstructDomain(Domain=bnd_6)  # -> Start, End
range_4 = Range(Domain=bnd_6, Steps="15")
neg_3 = Negative(Value=dedomain.End)
gradient_8 = Gradient(
    LowerLimit=neg_3,
    UpperLimit=dedomain.End,
    Parameter=range_4,
    stops=[0: RGB(255, 0, 0), 0.176: RGB(255, 238, 0), 0.35: RGB(0, 255, 234), 0.504: RGB(35, 4, 128), 0.664: RGB(0, 252, 215), 0.843: RGB(255, 255, 0), 1: RGB(255, 0, 47)])
gradient_9 = Gradient(
    LowerLimit="-1",
    UpperLimit="1",
    Parameter=python_20.a,
    stops=[0: RGB(255, 0, 0), 0.176: RGB(255, 238, 0), 0.35: RGB(0, 255, 234), 0.504: RGB(35, 4, 128), 0.664: RGB(0, 252, 215), 0.843: RGB(255, 255, 0), 1: RGB(255, 0, 47)])
num_108 = Number(range_4)
col_18 = Colour(gradient_8)

num_109 = Number(num_108)
col_19 = Colour(col_18)
legend_4 = Legend(Colour=col_19, Tags=num_109, LegendType=1)

gradient_10 = Gradient(
    LowerLimit="-1",
    UpperLimit="1",
    Parameter=python_20.a,
    stops=[0: RGB(255, 0, 0), 0.254: RGB(255, 238, 0), 0.423: RGB(0, 255, 234), 0.504: RGB(35, 4, 128), 0.612: RGB(0, 252, 215), 0.744: RGB(255, 255, 0), 1: RGB(255, 0, 47)])
gradient_11 = Gradient(
    LowerLimit="-1",
    UpperLimit="1",
    Parameter=python_20.a,
    stops=[0: RGB(255, 0, 0), 0.254: RGB(255, 238, 0), 0.423: RGB(0, 255, 234), 0.504: RGB(35, 4, 128), 0.56: RGB(0, 252, 215), 0.719: RGB(255, 255, 0), 1: RGB(255, 0, 47)])
gradient_12 = Gradient(
    LowerLimit="-1",
    UpperLimit="1",
    Parameter=python_20.a,
    stops=[0: RGB(255, 0, 0), 0.254: RGB(255, 238, 0), 0.423: RGB(0, 255, 234), 0.767: RGB(35, 4, 128), 0.843: RGB(0, 252, 215), 0.925: RGB(255, 255, 0), 1: RGB(255, 0, 47)])
num_110 = Number(python_20.a)

col_20 = Colour(gradient_12)

col_21 = Colour(col_20)

conmesh = ConstructMesh(Vertices=demesh_2.Vertices, Faces=demesh_2.Faces, Colours=col_21)
move_8 = Move(Geometry=conmesh, Motion=X)  # -> Geometry, Transform
wbedges_3 = WeaverbirdsMeshEdges(MeshOrPolylines=move_8.Geometry)
mblur = BlurMesh(Mesh=conmesh, Iterations=1)
previewlw_6 = CustomPreviewLineweights(Geometry=wbedges_3, Shader=ColourSwatch(SwatchColor=RGB(3, 3, 3)), Absolute=False)
mesh_16 = Mesh(mblur)

# ==== cluster Cluster
mesh = ClusterInput()
vec = ClusterInput()
mesh_2 = Mesh(mesh)
vec_2 = Vector(vec)
facen = FaceNormals(Mesh=mesh_2)  # -> Centers, Normals
pl = PlaneNormal(Origin=facen.Centers, ZAxis=facen.Normals)
move = Move(Geometry=facen.Centers, Motion=vec_2)  # -> Geometry, Transform
project = Project(Geometry=move.Geometry, Plane=pl)  # -> Geometry, Transform
vec2pt = Vector2Pt(PointA=facen.Centers, PointB=project.Geometry, Unitize="True")  # -> Vector, Length
xprod = CrossProduct(VectorA=facen.Normals, VectorB=vec2pt.Vector, Unitize="True")  # -> Vector, Length
vec_3 = Vector(xprod.Vector)
vec_4 = Vector(vec2pt.Vector)
vec_5 = ClusterOutput(vec_3)
vec_6 = ClusterOutput(vec_4)
