# Grasshopper definition four_point_slab_clean.gh (Grasshopper 1.0.7)
# plug-ins: Human, Weaverbird, karambaGH

panel = Panel("Z:\code\libraries\variational_clustering\data\json_files\perimeter_supported_slab_full.json")
shell_thickness_m = Slider(0.15, range=0..1)
concrete_covers_cm = Panel("""2.5
2.5
-2.5
-2.5""")
txt = Text(panel)
num = Number(shell_thickness_m)
num_2 = Number(concrete_covers_cm)

create_cmesh_for_json_export = BooleanToggle(True)
bool = Boolean(create_cmesh_for_json_export)

export_json_file = BooleanToggle(False)
bool_2 = Boolean(export_json_file)

shell_dimension_x_m = Slider(4.5, range=0..10)
shell_dimension_y_m = Slider(6, range=0..10)
num_of_faces_in_x_direction = Slider(45, range=0..100)
num_of_faces_in_y_direction = Slider(60, range=0..120)
num_3 = Number(shell_dimension_x_m)
num_4 = Number(shell_dimension_y_m)
num_5 = Number(num_of_faces_in_x_direction)
num_6 = Number(num_of_faces_in_y_direction)

num_7 = Number(num_4)
num_8 = Number(num_3)
num_9 = Number(num_6)
num_10 = Number(num_5)
division = Division(A=num_8, B="2")
division_2 = Division(A=num_7, B="2")
neg = Negative(Value=division)
neg_2 = Negative(Value=division_2)
dom = ConstructDomain(DomainStart=neg_2, DomainEnd=division_2)
dom_2 = ConstructDomain(DomainStart=neg, DomainEnd=division)
rectangle = Rectangle(Plane=PlaneXY(0, 0, 0), XSize=dom_2, YSize=dom, Radius=0)  # -> Rectangle, Length
mplane = MeshPlane(Boundary=rectangle.Rectangle, WidthCount=num_10, HeightCount=num_9)  # -> Mesh, Area
tri = Triangulate(Mesh=mplane.Mesh)  # -> Mesh, Count
mesh = Mesh(tri.Mesh)
mesh_2 = Mesh(mesh)
demesh = DeconstructMesh(Mesh=mesh_2)  # -> Vertices, Faces, Colours, Normals
crv = Curve(rectangle.Rectangle)
crv_2 = Curve(crv)
explode = Explode(Curve=crv_2, Recursive=True)  # -> Segments, Vertices
graft = GraftTree(Tree=explode.Segments, IncludeEmptyLists=True, IncludeNullItems=True)
crv_cp = CurveClosestPoint(Point=demesh.Vertices, Curve=graft)  # -> Point, Parameter, Distance
smaller = SmallerThan(FirstNumber=crv_cp.Distance, SecondNumber="0.001")  # -> SmallerThan, OrEqualTo
cull = CullPattern(List=crv_cp.Point, CullPattern=smaller.SmallerThan)  # -> simplify(List)
split = SplitTree(Data=cull, Masks=flatten("{0,2}"))  # -> Positive, Negative
lng = ListLength(List=split.Negative)
lng_2 = ListLength(List=split.Positive)
division_3 = Division(A=lng, B=2)
division_4 = Division(A=lng_2, B=2)
split_2 = SplitList(List=split.Negative, Index=division_3)  # -> simplify(ListA), simplify(ListB)
split_3 = SplitList(List=split.Positive, Index=division_4)  # -> simplify(ListA), simplify(ListB)
split_4 = SplitTree(Data=split_2.ListA, Masks=flatten("{1}"))  # -> Positive, Negative
split_5 = SplitTree(Data=split_2.ListB, Masks=flatten("{1}"))  # -> Positive, Negative
split_6 = SplitTree(Data=split_3.ListA, Masks=flatten("{0}"))  # -> Positive, Negative
intersection = SetIntersection(SetA=split.Positive, SetB=flatten(split.Negative))
cset = CreateSet(List=flatten(cull))  # -> Set, Map
split_7 = SplitTree(Data=cull, Masks=flatten("{2, 3}"))  # -> Positive, Negative
pt = Point(intersection)
pt_2 = Point(cset.Set)
pt_3 = Point(split_7.Positive)
pt_4 = Point([split_4.Negative, split_5.Positive])
pt_5 = Point([split_4.Positive, split_5.Negative, split_6.Positive])
pt_6 = Point(cset.Set)
mesh_3 = Mesh(mesh)
num_11 = Number(num)
num_12 = Number(num_2)
matselect = MaterialSelectionKaramba3D(menu=[dropdown(2), dropdown(2)])
matselect_2 = MaterialSelectionKaramba(menu=[dropdown(2), dropdown(2)])
matselect_3 = MaterialSelectionKaramba3D(menu=[dropdown(3), dropdown(8)])
multiplication = Multiplication(A=num_11, B="100")
panel_2 = Panel(multiplication)
cross_section = CrossSectionKaramba3D(
    FamilyNameOfCrossSection="DefaultCroSec",
    MaterialConcrete=matselect_3,
    Height_cm=multiplication,
    MaterialReinforcement=matselect,
    ReinforcementConcreteCovers_cm=num_12,
    PrincipalReinforcementDirection_deg=0,
    mode="Shell RC Standard - Const.")
meshtoshell = MeshToShellKaramba(Mesh=mesh_3, Identifier="slab", CrossSection=cross_section, LimitDistance_m=0.005)  # -> Element, Points, Info
mesh_4 = Mesh(mesh)
Z = UnitZ(Factor=1)
X = UnitX(Factor=1)
pt_7 = Point(pt_6)
rev = Reverse(Vector=Z)
supp = SupportKaramba(PosInd=pt_7, menu=[buttons(on, on, on, off, off, off)])
modifyelem = ModifyElementKaramba3D(Shell=meshtoshell.Element, XOrientations=X, ZOrientations=rev, mode="Shell")
entwine = Entwine(Branch02=supp, FlattenInputs=True)
element = ElementKaramba(flatten(modifyelem))
support = SupportKaramba(flatten(entwine))
element_2 = ElementKaramba(element)
support_2 = SupportKaramba(support)

# ---- group: Optional Colors
range = Range(Domain=Domain(0, 1), Steps=10)
gradient = Gradient(
    LowerLimit=0,
    UpperLimit=1,
    Parameter=range,
    stops=[0: RGB(255, 0, 0), 0.176: RGB(255, 238, 0), 0.35: RGB(0, 255, 234), 0.504: RGB(35, 4, 128), 0.664: RGB(0, 252, 215), 0.843: RGB(255, 255, 0), 1: RGB(255, 0, 47)])

# ----
bool_3 = Boolean(bool)
txt_2 = Text(txt)

bool_4 = Boolean(bool_2)

# ---- group: Optional Colors
range_2 = Range(Domain=Domain(0, 1), Steps=10)
gradient_2 = Gradient(
    LowerLimit=0,
    UpperLimit=1,
    Parameter=range_2,
    stops=[0: RGB(255, 0, 0), 0.176: RGB(255, 238, 0), 0.35: RGB(0, 255, 234), 0.504: RGB(35, 4, 128), 0.664: RGB(0, 252, 215), 0.843: RGB(255, 255, 0), 1: RGB(255, 0, 47)])

# ----
data = Data()
panel_3 = Panel("""bottom layer
top layer
center layer
total """)
panel_4 = Panel("""asx_b
asx_t
asy_b
asy_t
asx_c
asy_c""")
panel_5 = Panel(data)

# ---- group: Display Vector Field - Selection 2
list = ValueList({"n_1": 0, "n_2": 1, "m_1": 2, "m_2": 3, "ps_1_top": 4, "ps_1_bot": 5, "ps_1_mid": 6, "ps_2_top": 7, "ps_2_bot": 8, "ps_2_mid": 9, "custom_1": 10, "custom_2": 11}, selected="ps_2_top")
int = Integer(list)

# ---- group: Vector Field 1 - Selection
list_2 = ValueList({"n_1": 0, "n_2": 1, "m_1": 2, "m_2": 3, "ps_1_top": 4, "ps_1_bot": 5, "ps_1_mid": 6, "ps_2_top": 7, "ps_2_bot": 8, "ps_2_mid": 9, "custom_1": 10, "custom_2": 11}, selected="m_1")
int_2 = Integer(list_2)

# ---- group: Display Vector Field - Selection
list_3 = ValueList({"n_1": 0, "n_2": 1, "m_1": 2, "m_2": 3, "ps_1_top": 4, "ps_1_bot": 5, "ps_1_mid": 6, "ps_2_top": 7, "ps_2_bot": 8, "ps_2_mid": 9, "custom_1": 10, "custom_2": 11}, selected="ps_1_top")
int_3 = Integer(list_3)

# ---- group: Display Mesh - Mode Selection
list_4 = ValueList({"max": 0, "min": 1, "avg": 2, "angle_avg": 3}, selected="avg")
int_4 = Integer(list_4)

# ----
panel_6 = Panel("""max
min
avg
angle_avg""")
int_5 = Integer(int_4)

# ---- group: As 2 - Density Selection
list_5 = ValueList({"asx_": 0, "asy_": 1}, selected="asy_")
int_6 = Integer(list_5)

# ---- group: Display Controls
display_results_on_mesh = BooleanToggle(True)
bool_5 = Boolean(display_results_on_mesh)

display_vector_field = BooleanToggle(True)
bool_6 = Boolean(display_vector_field)

display_seeds = BooleanToggle(False)
bool_7 = Boolean(display_seeds)

display_face_singularities = BooleanToggle(True)
bool_8 = Boolean(display_face_singularities)

display_face_edge_planes = BooleanToggle(False)
bool_9 = Boolean(display_face_edge_planes)

# ---- group: As 1 - Density Selection
list_6 = ValueList({"asx_": 0, "asy_": 1}, selected="asx_")
int_7 = Integer(list_6)

# ---- group: Display Mesh - Results Selection
list_7 = ValueList({"nx": 0, "ny": 1, "nxy": 2, "mx": 3, "my": 4, "mxy": 5, "vx": 6, "vy": 7, "asx_b": 8, "asx_t": 9, "asy_b": 10, "asy_t": 11, "asx_c": 12, "asy_c": 13, "asx_": 14, "asy_": 15, "sp_asx_": 16, "sp_asy_": 17}, selected="asy_")
int_8 = Integer(list_7)

# ----
panel_7 = Panel("""nx
ny
nxy
mx
my
mxy
vx
vy""")
graft_2 = GraftTree(Tree=panel_7, IncludeEmptyLists=True, IncludeNullItems=True)

panel_8 = Panel("""asx_b
asx_t
asy_b
asy_t
asx_c
asy_c
asx_
asy_
spacing_asx_
spacing_asy_""")
int_9 = Integer(int_8)

min_length = Slider(0.2, range=0..2)
dl = Slider(0.01, range=0..0.1)
num_13 = Number(dl)
num_14 = Number(min_length)

dir_1_weight_vector_field = Slider(1, range=0..1)
dir_1_weight_align = Slider(0, range=0..1)
dir_2_weight_separate = Slider(0, range=0..1)
dir_1_weight_separate = Slider(0, range=0..1)
dir_2_weight_vector_field = Slider(1, range=0..1)
dir_2_weight_align = Slider(0, range=0..1)
merge = Merge(
    Data1=dir_1_weight_vector_field,
    Data2=dir_1_weight_separate,
    Data3=dir_1_weight_align,
    Data4=dir_2_weight_vector_field,
    Data5=dir_2_weight_separate,
    Data6=dir_2_weight_align)
num_15 = Number(merge)

# ---- group: Loading - Controls
area_load_kn_m2 = Slider(10, range=0..100)
num_16 = Number(area_load_kn_m2)

# ----
num_17 = Number(num_16)
panel_9 = Panel(num_17)
Z_2 = UnitZ(Factor=panel_9)
rev_2 = Reverse(Vector=Z_2)
loads = LoadsKaramba(Vector=rev_2, Mesh=mesh_4, LCase=0, mode="MeshLoad -Const.", menu=[buttons(off, on, off), buttons(on, on)])
entwine_2 = Entwine(Branch00=loads, FlattenInputs=True)
load = LoadKaramba(flatten(entwine_2))
load_2 = LoadKaramba(load)
assemble = AssembleModelKaramba(Elem=element_2, Support=support_2, Load=load_2, LimitDistance_m=0.005)  # -> Model, Info, Mass_kg, CenterOfGravity
analyze = AnalyzeKaramba3D(Model=assemble.Model)  # -> CalculatedModel, MaximumDisplacement_cm, ResultingForceOfGravity_kN, ElasticEnergy_kNm
model = ModelKaramba(analyze.CalculatedModel)
panel_10 = Panel(analyze.MaximumDisplacement_cm)
model_2 = ModelKaramba(model)

s_forces = ShellForcesKaramba(AnalyzedModel=model_2, LCase=0, mode="Local")  # -> AnalyzedModel, Nxx_kN_m, Nyy_kN_m, Nxy_kN_m, Mxx_kN, Myy_kN, Mxy_kN, Vx_kN_m, Vy_kN_m
graft_3 = GraftTree(Tree=s_forces.Nxx_kN_m, IncludeEmptyLists=True, IncludeNullItems=True)  # -> simplify(Tree)
graft_4 = GraftTree(Tree=s_forces.Nyy_kN_m, IncludeEmptyLists=True, IncludeNullItems=True)  # -> simplify(Tree)
graft_5 = GraftTree(Tree=s_forces.Nxy_kN_m, IncludeEmptyLists=True, IncludeNullItems=True)  # -> simplify(Tree)
graft_6 = GraftTree(Tree=s_forces.Mxx_kN, IncludeEmptyLists=True, IncludeNullItems=True)  # -> simplify(Tree)
graft_7 = GraftTree(Tree=s_forces.Myy_kN, IncludeEmptyLists=True, IncludeNullItems=True)  # -> simplify(Tree)
graft_8 = GraftTree(Tree=s_forces.Mxy_kN, IncludeEmptyLists=True, IncludeNullItems=True)  # -> simplify(Tree)
graft_9 = GraftTree(Tree=s_forces.Vx_kN_m, IncludeEmptyLists=True, IncludeNullItems=True)  # -> simplify(Tree)
graft_10 = GraftTree(Tree=s_forces.Vy_kN_m, IncludeEmptyLists=True, IncludeNullItems=True)  # -> simplify(Tree)
merge_2 = Merge(Data1=graft_3, Data2=graft_4, Data3=graft_5, Data4=graft_6, Data5=graft_7, Data6=graft_8, Data7=graft_9, Data8=graft_10)
flip = FlipMatrix(Data=merge_2)

num_18 = Number(flip)

model_3 = ModelKaramba(model)
modelview = ModelViewKaramba(Model=model_3, LoadCaseFactorsForLinearSuperposition=1, IndexOfVisibleLoadcase=-1)  # -> Model, DeformedMesh, DeformedAxes, DeformedModel
shellview = ShellViewKaramba(Model=modelview.Model, IndexOfLayer=0)  # -> Model, MeshesOfRenderedShells, LegendColors, LegendTags
legend = Legend(Colour=shellview.LegendColors, Tags=shellview.LegendTags, LegendType=1)

pt_8 = Point(flatten(cull))
model_4 = ModelKaramba(model)
shelllineresults = LineResultsOnShellsKaramba3D(
    AnalyzedModel=model_4,
    LayerPosition="-1",
    ListOfSourcesOfPrincipalStressLinesLinesPoints=pt_8,
    SegmentLength_m=0.5,
    DA_deg=5,
    mode="PrincStress")  # -> AnalyzedModel, Lines1, Lines2

line = Line([shelllineresults.Lines1, shelllineresults.Lines2])

# ---- group: RC - Design Controls
shell_thickness_m_2 = Slider(0.15, range=0..1)
concrete_compression_strength_fck = Slider(40, range=0..100)
concrete_tension_strength_factor_fctd = Slider(10, range=0..100)
cover_to_rebar_m = Slider(0.05, range=0..1)
rebar_yield_strength_fy = Slider(500, range=0..1000)

# ---- group: Algorithm - Controls
run_rc_design = BooleanToggle(False)
bool_10 = Boolean(run_rc_design)

# ----
vector_scale = Slider(2.5, range=0..2.5)
num_19 = Number(vector_scale)

vector_scale_2 = Slider(2.5, range=0..2.5)
num_20 = Number(vector_scale_2)

# ---- group: Custom Vector - Controls
x_vector = Slider(1, range=0..1)
y_vector = Slider(0, range=0..1)
z_vector = Slider(0, range=0..1)
vec = VectorXYZ(XComponent=x_vector, YComponent=y_vector, ZComponent=z_vector)  # -> Vector, Length
vec_2 = Vector(vec.Vector)

# ----
vec_3 = Vector(vec_2)

# ---- group: Algorithm - Controls
run_smesh = BooleanToggle(False)
bool_11 = Boolean(run_smesh)

# ----
singularities_tol = Slider(0, range=0..1)
num_21 = Number(singularities_tol)

panel_11 = Panel("""n_1
n_2
m_1
m_2
ps_1_top
ps_1_bot
ps_1_mid
ps_2_top
ps_2_bot
ps_2_mid
custom_1
custom_2""")
int_10 = Integer(int_2)
int_11 = Integer(int_3)
graft_11 = GraftTree(Tree=panel_11, IncludeEmptyLists=True, IncludeNullItems=True)
item = ListItem(List=panel_11, Index=int_11, Wrap=True)
item_2 = ListItem(List=panel_11, Index=int_10, Wrap=True)

max_spacing_dir_2 = Slider(0.4, range=0..1)
bar_diameter_mm_dir_1 = Slider(18, range=0..30)
bar_diameter_mm_dir_2 = Slider(18, range=0..30)
max_spacing_dir_1 = Slider(0.4, range=0..1)
merge_3 = Merge(Data1=bar_diameter_mm_dir_1, Data2=bar_diameter_mm_dir_2)
merge_4 = Merge(Data1=max_spacing_dir_1, Data2=max_spacing_dir_2)
num_22 = Number(merge_4)
num_23 = Number(merge_3)

panel_12 = Panel("""asx_
asy_""")
int_12 = Integer(int_7)
int_13 = Integer(int_6)
item_3 = ListItem(List=panel_12, Index=int_12, Wrap=True)
item_4 = ListItem(List=panel_12, Index=int_13, Wrap=True)

int_14 = Integer(int)
merge_5 = Merge(Data1=panel_7, Data2=panel_8)
item_5 = ListItem(List=panel_11, Index=int_14, Wrap=True)
item_6 = ListItem(List=merge_5, Index=int_9, Wrap=True)
item_7 = ListItem(List=panel_6, Index=int_5, Wrap=True)

# ---- group: Display - Tag
txt_3 = Text(item_7)

txt_4 = Text(item_6)

# ---- group: Internal Forces - Tags
txt_5 = Text(graft_2)

# ----
txt_6 = Text(flatten(txt_5))

# ---- group: as_tag_1
txt_7 = Text(item_3)

# ---- group: as_tag_2
txt_8 = Text(item_4)

# ---- group: Principal Vectors - Tags
txt_9 = Text(graft_11)

# ----
txt_10 = Text(flatten(txt_9))

# ---- group: vector_tag
txt_11 = Text(item_2)

# ---- group: vector_tag - display
txt_12 = Text(item)

# ----
txt_13 = Text(item_5)

# ---- group: RC - Design Controls
num_24 = Number(shell_thickness_m_2)
num_25 = Number(cover_to_rebar_m)
num_26 = Number(concrete_compression_strength_fck)
num_27 = Number(concrete_tension_strength_factor_fctd)
num_28 = Number(rebar_yield_strength_fy)

# ----
crv_3 = Curve()
crv_4 = Curve()

X_2 = UnitX(Factor="6")
swatch = ColourSwatch(SwatchColor=RGB(0, 0, 0))
swatch_2 = ColourSwatch(SwatchColor=RGB(0, 0, 0))
entwine_3 = Entwine(
    Branch00=ColourSwatch(SwatchColor=RGB(255, 255, 255)),
    Branch01=ColourSwatch(SwatchColor=RGB(255, 0, 0)),
    Branch02=ColourSwatch(SwatchColor=RGB(0, 128, 255)),
    FlattenInputs=True)
X_3 = UnitX(Factor="0")
Z_3 = UnitZ(Factor="6")
Z_4 = UnitZ(Factor="6")
panel_13 = Panel("4 to 0.5")
swatch_3 = ColourSwatch(SwatchColor=RGB(0, 0, 0))
panel_14 = Panel("2")
Z_5 = UnitZ(Factor=1)
X_4 = UnitX(Factor=1)

# ---- group: vector_tag
txt_14 = Text(txt_11)

# ---- group: Principal Vectors - Tags
txt_15 = Text(txt_9)

# ----
rev_3 = Reverse(Vector=Z_5)
vec_4 = Vector(rev_3)
vec_5 = Vector(vec_4)
panel_16 = Panel("""1
-1
0""")

# ---- group: Optional Colors
range_3 = Range(Domain=Domain(0, 1), Steps=10)
gradient_3 = Gradient(
    LowerLimit=0,
    UpperLimit=1,
    Parameter=range_3,
    stops=[0: RGB(255, 0, 0), 0.176: RGB(255, 238, 0), 0.35: RGB(0, 255, 234), 0.504: RGB(35, 4, 128), 0.664: RGB(0, 252, 215), 0.843: RGB(255, 255, 0), 1: RGB(255, 0, 47)])

# ---- group: Principal Vectors - Tags
txt_16 = Text(flatten(txt_9))

# ----
txt_17 = Text(flatten(txt_5))
num_29 = Number(num_28)
num_30 = Number(num_27)
bool_12 = Boolean(bool_10)
num_31 = Number(num_24)
num_32 = Number(num_25)
num_33 = Number(num_26)

# ---- group: max spacing
num_34 = Number(num_22)

# ---- group: bar diameter
num_35 = Number(num_23)

# ---- group: display
bool_13 = Boolean(bool_5)

# ---- group: mode
txt_18 = Text(txt_3)

# ---- group: data_tag
txt_19 = Text(txt_4)

# ---- group: vector_tag
txt_20 = Text(txt_13)

# ---- group: display
bool_14 = Boolean(bool_9)

# ---- group: vector_tag
txt_21 = Text(txt_12)

# ---- group: Vector Scale
num_36 = Number(num_19)

num_37 = Number(num_20)

# ---- group: display
bool_15 = Boolean(bool_6)

bool_16 = Boolean(bool_6)

# ---- group: vector_tag
txt_22 = Text(txt_12)

# ---- group: Vector Scale
num_38 = Number(num_21)

# ---- group: display
bool_17 = Boolean(bool_8)

# ----
data_2 = Data(["12998.0798222", "46928.5342330", "1510.48800843", "0.0", "2.484e-05", "2.484e-05"])
data_3 = Data(["38897.5481503", "20753.2442066", "633.862870885", "818.879535086", "2.484e-05", "2.484e-05"])
panel_17 = Panel("0")
# pmoments manual mode: asxt 20753.24421207052
# asxb 818.8795353632014
# asxc 0.0
# asyt 38897.54816365441
# asyb 633.8628710924824
# asyc 0.0
# ast 0.0
karamba_challenge = Panel(data_2)
# pmoments karamba: asxt 12884.912862755218
# asxb 1452.7424064556837
# asxc 0.0
# asyt 46765.87951296979
# asyb 0.0
# asyc 0.0
# ast 0.0
direct_angle = Panel(data_3)

panel_18 = Panel("""1
-1
0""")
graft_12 = GraftTree(Tree=panel_18, IncludeEmptyLists=True, IncludeNullItems=True)
shellvecresults = ResultVectorsOnShellsKaramba(AnalyzedModel=model_2, mode="PrincForce")  # -> AnalyzedModel, Points, FirstPrincipalNormalForceVector_kN_m, SecondPrincipalNormalForceVector_kN_m, FirstPrincipalMomentVector_kN, SecondPrincipalMomentVector_kN, FirstPrincipalNormalForceValue_kN_m, SecondPrincipalNormalForceValue_kN_m, FirstPrincipalMomentValue_kN, SecondPrincipalMomentValue_kN
shellvecresults_2 = ResultVectorsOnShellsKaramba(AnalyzedModel=model_2, LayerOfResults=graft_12, mode="PrincStress")  # -> AnalyzedModel, Points, FirstPrincipalStressVector_kN_cm2, SecondPrincipalStressVector_kN_cm2, FirstPrincipalStressValue_kN_cm2, SecondPrincipalStressValue_kN_cm2
disassemble = DisassembleModelKaramba(Model=model_2)  # -> Model, Point, Beam, Shell, Support, Load, Line, Mesh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

vec_6 = Vector(shellvecresults_2.SecondPrincipalStressVector_kN_cm2)
vec_7 = Vector(shellvecresults_2.FirstPrincipalStressVector_kN_cm2)

vec_8 = Vector(shellvecresults.SecondPrincipalNormalForceVector_kN_m)
vec_9 = Vector(shellvecresults.FirstPrincipalNormalForceVector_kN_m)

vec_10 = Vector(shellvecresults.FirstPrincipalMomentVector_kN)
vec_11 = Vector(shellvecresults.SecondPrincipalMomentVector_kN)

vec_12 = Vector(vec_8)
vec_13 = Vector(vec_9)
vec_14 = Vector(vec_10)
vec_15 = Vector(vec_11)
vec_16 = Vector(vec_7)
vec_17 = Vector(vec_6)

path_mapper = PathMapper(vec_17, source="{A;B}", target="{A;B+7}")
path_mapper_2 = PathMapper(vec_16, source="{A;B}", target="{A;B+4}")
entwine_4 = Entwine(Branch00=vec_13, Branch01=vec_12, Branch02=vec_14, Branch03=vec_15, FlattenInputs=True)  # -> simplify(Result)
merge_6 = Merge(Data1=entwine_4, Data2=simplify(path_mapper_2), Data3=simplify(path_mapper))

mesh_5 = Mesh(disassemble.Mesh)

# ---- group: Vector Fields
vec_18 = Vector(merge_6)

# ----
vec_19 = Vector(vec_18)
mesh_6 = Mesh(mesh_5)

cluster = Cluster(mesh=mesh_6, vec=vec_3)  # -> vec_6, vec_5
entwine_5 = Entwine(Branch00=cluster.vec_6, Branch01=cluster.vec_5, FlattenInputs=True)  # -> simplify(Result)
path_mapper_3 = PathMapper(entwine_5, source="{A}", target="{A+10}")
merge_7 = Merge(Data1=vec_19, Data2=simplify(path_mapper_3))

vec_20 = Vector(merge_7)
mesh_7 = Mesh(mesh_6)
num_39 = Number(num_18)
model_5 = ModelKaramba(model)

mesh_8 = Mesh(mesh_7)
num_40 = Number(num_39)
vec_21 = Vector(vec_20)
python = GhPythonScript(run=bool_3, mesh=mesh_8, vectors=vec_21, vector_tags=txt_10, internal_forces=num_40, force_tags=txt_6)  # -> out, cmesh; inputs mesh: Mesh, vectors: tree of Vector3d, vector_tags: list, internal_forces: tree, force_tags: list
# ---------- python: Python ----------
from compas.datastructures import Mesh
from compas_rhino.helpers import mesh_from_guid


min_force = 1e-6
if run is True:

    # instantiate mesh
    cmesh = mesh_from_guid(Mesh, mesh)
    
    for j, internal_force in enumerate(internal_forces.Branches):
        force_tag = force_tags[j]

        for fkey in cmesh.faces():
            force = internal_force[fkey]
            if force == 0.0:
                force = min_force

            cmesh.set_face_attribute(fkey, force_tag, force)

    for i, vector in enumerate(vectors.Branches):
        vector_tag = vector_tags[i]

        for fkey in cmesh.faces():
            vec = vector[fkey]
            vec = [vec.X, vec.Y, vec.Z]
           
            cmesh.set_face_attribute(fkey, vector_tag, vec)
            
    print("Compas mesh created and loaded")
# ---------- end python ----------
panel_19 = Panel(python.out)
data_4 = Data(python.cmesh)
data_5 = Data(data_4)
python_2 = GhPythonScript(run=bool_4, cmesh=data_5, filepath=txt_2)  # -> out
# ---------- python_2: Python ----------
if run is True:
    cmesh.to_json(filepath)
    print("Exported!")
# ---------- end python_2 ----------
panel_20 = Panel(python_2)

mesh_9 = Mesh(mesh_7)
vec_22 = Vector(vec_20)
model_6 = ModelKaramba(model_5)

vec_23 = Vector(vec_22)
mesh_10 = Mesh(mesh_9)
model_7 = ModelKaramba(model_6)

model_8 = ModelKaramba(model_7)

mesh_11 = Mesh(mesh_10)
bool_18 = Boolean(bool_11)

# ---- group: Principal Vectors
vec_24 = Vector(vec_23)

# ----
s_forces_2 = ShellForcesKaramba(AnalyzedModel=model_8, LCase=0, mode="Local")  # -> AnalyzedModel, Nxx_kN_m, Nyy_kN_m, Nxy_kN_m, Mxx_kN, Myy_kN, Mxy_kN, Vx_kN_m, Vy_kN_m
python_3 = GhPythonScript(run=bool_18, mesh=mesh_11, vectors=vec_24, vectors_tags=txt_15)  # -> out, s_mesh; inputs mesh: Mesh, vectors: tree of Vector3d, vectors_tags: tree
# ---------- python_3: Python ----------
__author__ = "Rafael Pastrana"
__name__ = "Mesh Maker"
__date__ = "2018.07.19"
__version__ = "0.0.1"


# 1. Import dependencies
import sys
import imp
import rhinoscriptsyntax as rs

# 1-b. Replace with your own path here
sys.path.append("Z:\code\libraries\streamlines\src\streamlines")

import custom_mesh
imp.reload(custom_mesh)

from custom_mesh import StructuralMesh
from compas.datastructures import Mesh
from compas_rhino.helpers import mesh_from_guid

# Define Global Variables
NORM = False

# 2. Start System
if run is True:
    print('SYSTEM STARTED')
        
    # instantiate mesh
    mesh = mesh_from_guid(Mesh, mesh)
    my_mesh = StructuralMesh(mesh)
    compas_mesh = Mesh()

    # set vector attributes
    for idx, vector_field in enumerate(vectors.Branches):
        tag = vectors_tags.Branches[idx][0]
        clean_vectors = [[vec.X, vec.Y, vec.Z] for vec in vector_field]
        my_mesh.set_face_vectors(clean_vectors, tag, NORM)
        # my_mesh.set_vertex_vectors(tag)
        my_mesh.set_vertex_vectors_angles(tag)
    
    # output mesh
    s_mesh = my_mesh
# ---------- end python_3 ----------
wbedges = WeaverbirdsMeshEdges(MeshOrPolylines=mesh_11)
lng_3 = ListLength(List=wbedges)
python_4 = GhPythonScript(sigma_x=s_forces_2.Mxx_kN, sigma_y=s_forces_2.Myy_kN, tao_xy=s_forces_2.Mxy_kN)  # -> out, simplify(a), b, c
# ---------- python_4: Python ----------
import math 

def principal_angles(fx, fy, fxy):

	a = 2 * fxy / (fx - fy)
	b = math.atan(a) /  2
	
	return b, b + math.radians(90.0)


def principal_forces(fx, fy, fxy):

	pf_a = (fx + fy) / 2
	pf_b = math.sqrt(((fx - fy) / 2 )** 2 + fxy ** 2)

	return pf_a + pf_b, pf_a - pf_b

a
def transformed_forces(fx, fy, fxy, angle):
	theta = angle
	tfx = (fx + fy) / 2 + (fx - fy) * math.cos(2 * theta) / 2 + fxy * math.sin(2 * theta)
	tfy = fx + fy - tfx
	tfxy = - (fx - fy) * math.sin(2 * theta) / 2 + fxy * math.cos(2 * theta)

	return tfx, tfy, tfxy


a1, a2 = principal_angles(sigma_x, sigma_y, tao_xy)
pf1, pf2 = principal_forces(sigma_x, sigma_y, tao_xy)
m1, m2, mxy = transformed_forces(sigma_x, sigma_y, tao_xy, a1)

if math.fabs(m1 - pf1) < 0.01:
    print("hello")
    c = a1

else:
    print(m1, m2, pf1)
    c = a2
# ---------- end python_4 ----------
data_6 = Data(python_3.s_mesh)

# ---- group: s_mesh
data_7 = Data(data_6)

# ----
panel_21 = Panel(lng_3)
python_5 = GhPythonScript(s_mesh=data_7, vector_tag=txt_14)  # -> out, s_mesh, vector_field
# ---------- python_5: Python ----------
# 1. Import dependencies
import rhinoscriptsyntax as rs
import copy

print('number of edges is: {}'.format(len([e for e in s_mesh.c_mesh.edges()])))

# 2. Start System
my_mesh = s_mesh
v_name = vector_tag

# vector properties
vector_field = [x[0] for x in my_mesh.find_vector_face_centers(v_name)]
vector_field = [rs.CreateVector(x) for x in vector_field]
s_mesh = my_mesh
# ---------- end python_5 ----------
vrot = Rotate(Vector=X_4, Axis=vec_4, Angle=python_4.c)  # -> flatten(Vector)
vec_25 = Vector(unitize(vrot))
vec_26 = Vector(unitize(python_5.vector_field))
vec_27 = Vector(vec_25)
model_9 = ModelKaramba(model_7)
panel_22 = Panel(python_4.c)
vec_28 = Vector(vec_25)
vec_29 = Vector(vec_26)
python_6 = GhPythonScript(x=vec_29, y=vec_28)  # -> out, a; inputs x: list of Vector3d, y: list of Vector3d
# ---------- python_6: Python ----------
from compas.geometry import angle_vectors


a = []

for vectora, vectorb in zip(x, y):
    x = vectora
    y = vectorb
    
    u = [x.X, x.Y, x.Z]
    v = [y.X, y.Y, y.Z]
    a.append(angle_vectors(u, v, deg=True))
# ---------- end python_6 ----------
num_41 = Number(python_6.a)
num_42 = Number(num_41)
sort = SortList(Keys=num_42)  # -> Keys, ValuesA
bnd = Bounds(Numbers=num_42)
panel_23 = Panel(bnd)
graph = QuickGraph(sort.Keys, SortOrder=0)

txt_23 = Text(flatten(txt_5))
data_8 = Data(data_6)

entwine_6 = Entwine(
    Branch00=ColourSwatch(SwatchColor=RGB(0, 124, 247)),
    Branch01=ColourSwatch(SwatchColor=RGB(1, 35, 97)),
    Branch02=ColourSwatch(SwatchColor=RGB(1, 97, 92)),
    FlattenInputs=True)

X_5 = UnitX(Factor="6")

X_6 = UnitX(Factor="6")

disassemble_2 = DisassembleModelKaramba(Model=model_9)  # -> Model, Point, Beam, Shell, Support, Load, Line, Mesh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

modifyelem_2 = ModifyElementKaramba3D(Shell=disassemble_2.Shell, XOrientations=unitize(vec_27), ZOrientations=unitize(vec_5), mode="Shell")

assemble_2 = AssembleModelKaramba(
    Points=disassemble_2.Point,
    Elem=modifyelem_2,
    Support=disassemble_2.Support,
    Load=disassemble_2.Load,
    LimitDistance_m=0.005)  # -> Model, Info, Mass_kg, CenterOfGravity

analyze_2 = AnalyzeKaramba3D(Model=assemble_2.Model)  # -> CalculatedModel, MaximumDisplacement_cm, ResultingForceOfGravity_kN, ElasticEnergy_kNm
panel_24 = Panel(analyze_2.CalculatedModel)
model_10 = ModelKaramba(analyze_2.CalculatedModel)

model_11 = ModelKaramba(model_10)
modelview_2 = ModelViewKaramba(Model=model_11, LoadCaseFactorsForLinearSuperposition=1, IndexOfVisibleLoadcase=-1)  # -> Model, DeformedMesh, DeformedAxes, DeformedModel
shellview_2 = ShellViewKaramba(Model=modelview_2.Model, IndexOfLayer=0)  # -> Model, MeshesOfRenderedShells, LegendColors, LegendTags
legend_2 = Legend(Colour=shellview_2.LegendColors, Tags=shellview_2.LegendTags, LegendType=1)

model_12 = ModelKaramba(model_10)

model_13 = ModelKaramba(model_10)
modelview_3 = ModelViewKaramba(
    Model=model_13,
    LoadCaseFactorsForLinearSuperposition=1,
    IndexOfVisibleLoadcase=-1,
    ListOfColorsForColoringPlots=gradient_3)  # -> Model, DeformedMesh, DeformedAxes, DeformedModel
shellview_3 = ShellViewKaramba(Model=modelview_3.Model, IndexOfLayer=0)  # -> Model, MeshesOfRenderedShells, LegendColors, LegendTags
legend_3 = Legend(Colour=shellview_3.LegendColors, Tags=shellview_3.LegendTags, LegendType=1)

graft_13 = GraftTree(Tree=panel_16, IncludeEmptyLists=True, IncludeNullItems=True)
shellvecresults_3 = ResultVectorsOnShellsKaramba(AnalyzedModel=model_12, LayerOfResults=graft_13, mode="PrincStress")  # -> AnalyzedModel, Points, FirstPrincipalStressVector_kN_cm2, SecondPrincipalStressVector_kN_cm2, FirstPrincipalStressValue_kN_cm2, SecondPrincipalStressValue_kN_cm2
shellvecresults_4 = ResultVectorsOnShellsKaramba(AnalyzedModel=model_12, mode="PrincForce")  # -> AnalyzedModel, Points, FirstPrincipalNormalForceVector_kN_m, SecondPrincipalNormalForceVector_kN_m, FirstPrincipalMomentVector_kN, SecondPrincipalMomentVector_kN, FirstPrincipalNormalForceValue_kN_m, SecondPrincipalNormalForceValue_kN_m, FirstPrincipalMomentValue_kN, SecondPrincipalMomentValue_kN
path_mapper_4 = PathMapper(shellvecresults_3.FirstPrincipalStressValue_kN_cm2, source="{A;B}", target="{A;B+4}")
path_mapper_5 = PathMapper(shellvecresults_3.SecondPrincipalStressValue_kN_cm2, source="{A;B}", target="{A;B+7}")
entwine_7 = Entwine(
    Branch00=shellvecresults_4.FirstPrincipalNormalForceValue_kN_m,
    Branch01=shellvecresults_4.SecondPrincipalNormalForceValue_kN_m,
    Branch02=shellvecresults_4.FirstPrincipalMomentValue_kN,
    Branch03=shellvecresults_4.SecondPrincipalMomentValue_kN,
    FlattenInputs=True)  # -> simplify(Result)
merge_8 = Merge(Data1=entwine_7, Data2=simplify(path_mapper_4), Data3=simplify(path_mapper_5))

s_forces_3 = ShellForcesKaramba(AnalyzedModel=model_12, LCase=0, mode="Local")  # -> AnalyzedModel, Nxx_kN_m, Nyy_kN_m, Nxy_kN_m, Mxx_kN, Myy_kN, Mxy_kN, Vx_kN_m, Vy_kN_m
graft_14 = GraftTree(Tree=s_forces_3.Nxx_kN_m, IncludeEmptyLists=True, IncludeNullItems=True)  # -> simplify(Tree)
graft_15 = GraftTree(Tree=s_forces_3.Nyy_kN_m, IncludeEmptyLists=True, IncludeNullItems=True)  # -> simplify(Tree)
graft_16 = GraftTree(Tree=s_forces_3.Nxy_kN_m, IncludeEmptyLists=True, IncludeNullItems=True)  # -> simplify(Tree)
graft_17 = GraftTree(Tree=s_forces_3.Mxx_kN, IncludeEmptyLists=True, IncludeNullItems=True)  # -> simplify(Tree)
graft_18 = GraftTree(Tree=s_forces_3.Myy_kN, IncludeEmptyLists=True, IncludeNullItems=True)  # -> simplify(Tree)
graft_19 = GraftTree(Tree=s_forces_3.Mxy_kN, IncludeEmptyLists=True, IncludeNullItems=True)  # -> simplify(Tree)
graft_20 = GraftTree(Tree=s_forces_3.Vx_kN_m, IncludeEmptyLists=True, IncludeNullItems=True)  # -> simplify(Tree)
graft_21 = GraftTree(Tree=s_forces_3.Vy_kN_m, IncludeEmptyLists=True, IncludeNullItems=True)  # -> simplify(Tree)
merge_9 = Merge(
    Data1=graft_14,
    Data2=graft_15,
    Data3=graft_16,
    Data4=graft_17,
    Data5=graft_18,
    Data6=graft_19,
    Data7=graft_20,
    Data8=graft_21)
flip_2 = FlipMatrix(Data=merge_9)

xprod = CrossProduct(
    VectorA=shellvecresults_4.FirstPrincipalMomentVector_kN,
    VectorB=shellvecresults_4.SecondPrincipalMomentVector_kN,
    Unitize=False)  # -> Vector, Length
num_43 = Number(flip_2)
num_44 = Number(merge_8)
num_45 = Number(num_43)

# ---- group: Assign Local Internal Forces to sMesh
python_7 = GhPythonScript(s_mesh=data_8, int_forces=num_45, force_tags=txt_23)  # -> out, s_mesh; inputs int_forces: tree, force_tags: list
# ---------- python_7: Python ----------
__author__ = "Rafael Pastrana"
__name__ = "Mesh Maker"
__date__ = "2018.07.19"
__version__ = "0.0.1"


# 1. Import dependencies
import rhinoscriptsyntax as rs
import copy

# 2. Start System
# set vector attributes
my_mesh = s_mesh


for idx, int_force in enumerate(int_forces.Branches):
    tag = force_tags[idx]
    
    for f_key in my_mesh.c_mesh.faces():
        force = int_force[f_key]
        if force == 0:
            force = 1e-7
            
        my_mesh.c_mesh.set_face_attribute(f_key, str(tag), force)

s_mesh = my_mesh
# ---------- end python_7 ----------

# ----
data_9 = Data(python_7.s_mesh)
data_10 = Data(data_9)
num_46 = Number(num_44)

# ---- group: Assign Principal Internal Forces to sMesh
python_8 = GhPythonScript(s_mesh=data_10, int_forces=num_46, force_tags=txt_16)  # -> out, s_mesh; inputs int_forces: tree, force_tags: list
# ---------- python_8: Python ----------
__author__ = "Rafael Pastrana"
__name__ = "Mesh Maker"
__date__ = "2018.07.19"
__version__ = "0.0.1"


# 1. Import dependencies
import rhinoscriptsyntax as rs
import copy

TAG = '_val'
my_mesh = s_mesh

# 2. Start System
# set vector attributes
for idx, int_force in enumerate(int_forces.Branches):
    f_tag = force_tags[idx] + TAG
    
    for f_key in my_mesh.c_mesh.faces():
        force = int_force[f_key]
        if force == 0:
            force = 1e-7
        my_mesh.c_mesh.set_face_attribute(f_key, str(f_tag), force)

s_mesh = my_mesh
# ---------- end python_8 ----------

# ----
data_11 = Data(python_8.s_mesh)
data_12 = Data(data_11)

# ---- group: Make RC Design
python_9 = GhPythonScript(run=bool_12, s_mesh=data_12, heights=num_31, covers=num_32, fck=num_33, fy=num_29, fctd_factor=num_30, force_tags=txt_17)  # -> out, s_mesh, asxb, asxt, asyb, asyt, asxc, asyc, ast; inputs run: Boolean, force_tags: list
# ---------- python_9: Python ----------
"""NOTE 18.08.01: Bottom and Top were inverted for compatibility"""

__author__ = "Rafael Pastrana"
__name__ = "Sandwich"
__date__ = "2018.08.01"
__version__ = "0.0.2"

# 1. Import dependencies
import sys
import imp
import rhinoscriptsyntax as rs

# 1-b. Replace with your own path here
sys.path.append("Z:\projects\streamlines\src\streamlines")

import materials
import basic_sandwich

imp.reload(materials)
imp.reload(basic_sandwich)

from basic_sandwich import ReinforcedShell
from materials import Concrete
from materials import Rebar


# 2. Create Input Material Data
myConcrete = Concrete(fck)
myRebar = Rebar(fy)
#myConcrete.printSummary()

# 3. Perform Reinforcement Design
my_mesh = s_mesh

asxb = []
asyb = []
asxt = []
asyt = []
asxc = []
asyc = []

ast = []
shells = []

if run is True:
    for idx, f_key in enumerate(s_mesh.c_mesh.faces()):
        forces = s_mesh.c_mesh.get_face_attributes(f_key, force_tags)
        myForces = {str(a): b for a, b in zip(force_tags, forces)}
        
        myShell = ReinforcedShell(idx, myConcrete, myRebar, heights, covers)
        myShell.tcred = myShell.concrete.fctd * fctd_factor
        
        # 4. Perform Reinforcement Design Routine
        myShell.applyForces(**myForces)
        
        # new version 25.08.18
        myShell.get_membrane_forces()
        myShell.get_reinforcement_forces()
        myShell.design_reinforcement()
        
        # 5. Append Results to Output Lists. Bottom and top were inverted
        shells.append(myShell)
        
        asxb.append(myShell.asxt)
        asyb.append(myShell.asyt)
        
        asxt.append(myShell.asxb)
        asyt.append(myShell.asyb)
        
        asxc.append(myShell.asxc)
        asyc.append(myShell.asyc)
        
        ast.append(myShell.ast)
        
        # 6. Set Face Attributes. Bottom and top were inverted
        my_mesh.c_mesh.set_face_attribute(f_key, 'asx_b', myShell.asxt)
        my_mesh.c_mesh.set_face_attribute(f_key, 'asx_t', myShell.asxb)
        my_mesh.c_mesh.set_face_attribute(f_key, 'asy_b', myShell.asyt)
        my_mesh.c_mesh.set_face_attribute(f_key, 'asy_t', myShell.asyb)
        
        my_mesh.c_mesh.set_face_attribute(f_key, 'asx_c', myShell.asxc)
        my_mesh.c_mesh.set_face_attribute(f_key, 'asy_c', myShell.asyc)
        
        my_mesh.c_mesh.set_face_attribute(f_key, 'asx_', (myShell.asxc + myShell.asxt + myShell.asxb))
        my_mesh.c_mesh.set_face_attribute(f_key, 'asy_', (myShell.asyc + myShell.asyt + myShell.asyb))
    
        
    # 6. Retrieve Statistics
    print("# of Elements with Crushed Core: {}".format(len([shell for shell in shells if shell.coreCrush == True])))
    print("# of Elements with Crushed Top Cover: {}".format(len([shell for shell in shells if shell.tsupCrush == True])))
    print("# of Elements with Crushed Bottom Cover: {}".format(len([shell for shell in shells if shell.tinfCrush == True])))
    print("----------------------------------")
    print("Shear Force Vo in Crushed Core Elements: {}".format([shell.vo for shell in shells if shell.coreCrush == True]))
    print("----------------------------------")
# ---------- end python_9 ----------

# ----
num_47 = Number(python_9.asxc)
num_48 = Number(python_9.asyc)

# ---- group: Make RC Design
num_49 = Number(python_9.ast)
num_50 = Number(python_9.asyb)
num_51 = Number(python_9.asyt)
num_52 = Number(python_9.asxb)
num_53 = Number(python_9.asxt)

# ----
num_54 = Number(num_47)
num_55 = Number(num_48)

# ---- group: Make RC Design (continued)
num_56 = Number(num_52)
num_57 = Number(num_53)
num_58 = Number(num_50)
num_59 = Number(num_51)
entwine_8 = Entwine(Branch00=num_56, Branch01=num_57, Branch02=num_58, Branch03=num_59, Branch04=num_54, Branch05=num_55, FlattenInputs=True)

# ----
entwine_9 = Entwine(Branch00=num_56, Branch01=num_57, Branch02=num_58, Branch03=num_59, FlattenInputs=True)

data_13 = Data(python_9.out)
num_60 = Number(entwine_8)

data_14 = Data(data_13)
num_61 = Number(num_60)
num_62 = Number(num_60)
bnd_2 = Bounds(Numbers=num_62)
sort_2 = SortList(Keys=num_61)  # -> Keys, ValuesA
concat = Concatenate(FragmentA=graft(panel_4), FragmentB="domain is:", FragmentC=bnd_2, JoinSeparator=" ")
panel_25 = Panel(data_14)
reinforcement_areas_domain_cm2_m = Panel(concat)
graph_2 = QuickGraph(sort_2.Keys, SortOrder=0)
data_15 = Data(python_9.s_mesh)
num_63 = Number(entwine_9)

# ---- group: s_mesh
data_16 = Data(data_15)

# ----
python_10 = GhPythonScript(s_mesh=data_16, diam=num_35, max_sp=num_34)  # -> out, s_mesh, sp_asx, sp_asy; inputs diam: list, max_sp: list
# ---------- python_10: Python ----------
# 1. Import dependencies
import rhinoscriptsyntax as rs
import Rhino.Geometry as rg
import math


# 1-b. Define Globals
TAG = 'spacing_'
TOL = 1e-6
AS_TAGS = ['asx_', 'asy_']
my_mesh = s_mesh

# 1-c. Define Functions

def get_bar_area(diameter):
    return math.pi * math.pow((diameter / 10), 2) / 4

def steel_area_to_spacing(steel_areas, diameter, max):
    spacings = []
    bar_area = get_bar_area(diameter)
    
    for s_area in steel_areas:
        if s_area < TOL:
            s_area = TOL
        spacing = s_area / bar_area
        spacing = 1 / spacing
        
        if spacing > max:
            spacing = max
        spacings.append(spacing)
    return spacings

# 2. Set Data
for f_key in my_mesh.c_mesh.faces():
    for as_tag in AS_TAGS:
        steel_area = my_mesh.c_mesh.get_face_attribute(f_key, as_tag)
        if as_tag[2] == 'x':
            sp = steel_area_to_spacing([steel_area], diam[0], max_sp[0])[0]
            my_mesh.c_mesh.set_face_attribute(f_key, TAG+as_tag, sp)
            my_mesh.c_mesh.set_face_attribute(f_key, 'bar_diameter_x', diam[0])
            
        elif as_tag[2] == 'y':
            sp = steel_area_to_spacing([steel_area], diam[1], max_sp[1])[0]
            my_mesh.c_mesh.set_face_attribute(f_key, TAG+as_tag, sp)
            my_mesh.c_mesh.set_face_attribute(f_key, 'bar_diameter_y', diam[1])
            
# 3. Get Data

s_mesh = my_mesh
keys = [f_key for f_key in my_mesh.c_mesh.faces()]

sp_asx_ = my_mesh.c_mesh.get_faces_attribute(keys, TAG+AS_TAGS[0])
sp_asy_ = my_mesh.c_mesh.get_faces_attribute(keys, TAG+AS_TAGS[1])

t_sp_asx_ = sorted(sp_asx_)
t_sp_asy_ = sorted(sp_asy_)

print('Spacings for ASX_ min is {0}. max is {1}'.format(t_sp_asx_[0], t_sp_asx_[-1]))
print('Spacings for ASY_ min is {0}. max is {1}'.format(t_sp_asy_[0], t_sp_asy_[-1]))
# ---------- end python_10 ----------
data_17 = Data(python_10.out)
data_18 = Data(data_17)
panel_26 = Panel(data_18)
num_64 = Number(python_10.sp_asx)
num_65 = Number(python_10.sp_asy)
data_19 = Data(python_10.s_mesh)

# ---- group: s_mesh
data_20 = Data(data_19)

data_21 = Data(data_19)

data_22 = Data(data_19)

data_23 = Data(data_19)

data_24 = Data(data_19)

# ----
python_11 = GhPythonScript(show=bool_15, s_mesh=data_21, vector_tag=txt_20, v_scale=num_37)  # -> out, s_mesh, line_field, node_line_field, centers_line_field, colors_line_field, colors_node_line_field, colors_centers_line_field, vectors_a, vectors_b; inputs show: Boolean
# ---------- python_11: Python ----------
"""Retrieves data from a Structural Mesh object"""

__author__ = "Rafael Pastrana"
__name__ = "Mesh Displayer"
__date__ = "2018.07.24"
__version__ = "0.0.1"


# 1. Import dependencies
import imp
import rhinoscriptsyntax as rs
import sys
sys.path.append("Z:\projects\streamlines\src\streamlines")
import display
imp.reload(display)
from display import Display
import compas.geometry as cg

dsp = Display()

# 2. Start System
my_mesh = s_mesh
v_name = vector_tag
TAG = '_val'

if show is True:
    # vector properties
    line_field = dsp.draw_face_vectors(my_mesh, v_name, v_scale)
    node_line_field = dsp.draw_node_vectors(my_mesh, v_name, v_scale)
    center_vectors = my_mesh.find_vector_face_centers(v_name)
    centers = list(map(lambda x: my_mesh.c_mesh.face_centroid(x), my_mesh.c_mesh.faces()))
    centers_line_field = dsp.draw_vectors(centers, center_vectors, v_scale)
        
    f_color = []
    for f_key in my_mesh.c_mesh.faces():
        val = my_mesh.c_mesh.get_face_attribute(f_key, v_name+TAG)
        if val:
            if val < 0:
                f_color.append(rs.CreateColor(255,0,0))
            else:
                f_color.append(rs.CreateColor(0,0,255))
        else:
            f_color.append(rs.CreateColor(0,0,255))
            
    n_color = []
    for v_key in my_mesh.c_mesh.vertices():
        val = my_mesh.c_mesh.get_vertex_attribute(v_key, v_name+TAG)
        if val < 0:
            n_color.append(rs.CreateColor(0,0,0))
        else:
            n_color.append(rs.CreateColor(0,0,0))
    
    colors_line_field = f_color
    colors_node_line_field = n_color
    colors_centers_line_field = f_color
    
    vectors_a = list(map(lambda x: my_mesh.c_mesh.get_vertex_attribute(x,v_name+'_a'), my_mesh.c_mesh.vertices()))
    vectors_a = list(map(lambda x: rs.CreateVector(*x), vectors_a))
    
    vectors_b = list(map(lambda x: my_mesh.c_mesh.get_vertex_attribute(x,v_name+'_b'), my_mesh.c_mesh.vertices()))
    vectors_b = list(map(lambda x: rs.CreateVector(*x), vectors_b))
# ---------- end python_11 ----------
python_12 = GhPythonScript(show=bool_16, s_mesh=data_22, vector_tag=txt_21, v_scale=num_36)  # -> out, s_mesh, line_field, node_line_field, centers_line_field, colors_line_field, colors_node_line_field, colors_centers_line_field, vectors_a, vectors_b; inputs show: Boolean; same code as python_11
python_13 = GhPythonScript(show=bool_13, s_mesh=data_20, data_tag=txt_19, mode=txt_18)  # -> out, s_mesh, display_mesh, color_data, data_values; inputs show: Boolean
# ---------- python_13: Python ----------
"""Retrieves data from a Structural Mesh object"""

__author__ = "Rafael Pastrana"
__name__ = "Mesh Displayer"
__date__ = "2018.07.24"
__version__ = "0.0.1"


# 1. Import dependencies
import imp
import rhinoscriptsyntax as rs
import sys
sys.path.append("Z:\projects\streamlines\src\streamlines")
import display
imp.reload(display)
from display import Display
import compas.geometry as cg

dsp = Display()


import Display
imp.reload(Display)
from Display import Display

dsp = Display()
my_mesh = s_mesh

# 2. Start System
if show is True:
    display_mesh = my_mesh.gh_mesh
    color_data = None
    data_values = my_mesh.get_data_on_nodes(data_tag, mode)
    # display_mesh, data_values, color_data = dsp.plot_mesh(my_mesh, data_tag, mode)
# ---------- end python_13 ----------
python_14 = GhPythonScript(s_mesh=data_24, steel_density="7.85")  # -> out, steel_mass, mass_bot, mass_top, mass_center
# ---------- python_14: Python ----------
"""Retrieves data from a Structural Mesh object"""

__author__ = "Rafael Pastrana"
__name__ = "Steel Mass Calculator"
__date__ = "2018.08.02"
__version__ = "0.0.1"


# 1. Import dependencies
import rhinoscriptsyntax as rs

# 2. Define Globals
DENSITY = steel_density  # kg/cm3
TOL = 1e-6
AS_TAGS = ['asx_b', 'asx_t', 'asy_b', 'asy_t', 'asx_c', 'asy_c']

# 3. Start System
my_mesh = s_mesh
face_areas = list(map(lambda x: my_mesh.c_mesh.face_area(x), my_mesh.c_mesh.faces()))

# 4. Get Mass at Bottom Layer
m_asx_b = list(map(lambda x: DENSITY * my_mesh.c_mesh.get_face_attribute(x,AS_TAGS[0]), my_mesh.c_mesh.faces()))
m_asy_b = list(map(lambda x: DENSITY * my_mesh.c_mesh.get_face_attribute(x,AS_TAGS[2]), my_mesh.c_mesh.faces()))

m_asx_t = list(map(lambda x: DENSITY * my_mesh.c_mesh.get_face_attribute(x,AS_TAGS[1]), my_mesh.c_mesh.faces()))
m_asy_t = list(map(lambda x: DENSITY * my_mesh.c_mesh.get_face_attribute(x,AS_TAGS[3]), my_mesh.c_mesh.faces()))

m_asx_c = list(map(lambda x: DENSITY * my_mesh.c_mesh.get_face_attribute(x,AS_TAGS[4]), my_mesh.c_mesh.faces()))
m_asy_c = list(map(lambda x: DENSITY * my_mesh.c_mesh.get_face_attribute(x,AS_TAGS[5]), my_mesh.c_mesh.faces()))

mass_bot = reduce(lambda x, y: x+y, [sum(x)*face_areas[idx] for idx, x in enumerate(zip(m_asx_b, m_asy_b))])
mass_top = reduce(lambda x, y: x+y, [sum(x)*face_areas[idx] for idx, x in enumerate(zip(m_asx_t, m_asy_t))])
mass_center = reduce(lambda x, y: x+y, [sum(x)*face_areas[idx] for idx, x in enumerate(zip(m_asx_c, m_asy_c))])

steel_mass = mass_bot + mass_top + mass_center
# ---------- end python_14 ----------
python_15 = GhPythonScript(s_mesh=data_23)  # -> out, steel_mass, mass_bot, mass_top, mass_center
# ---------- python_15: Python ----------
"""Retrieves data from a Structural Mesh object"""

__author__ = "Rafael Pastrana"
__name__ = "Steel Mass Calculator"
__date__ = "2018.08.02"
__version__ = "0.0.1"


# 1. Import dependencies
import rhinoscriptsyntax as rs

# 2. Define Globals
TOL = 1e-6
AS_TAGS = ['asx_b', 'asx_t', 'asy_b', 'asy_t', 'asx_c', 'asy_c']

# 3. Start System
my_mesh = s_mesh

# 4. Get Mass at Bottom Layer
m_asx_b = list(map(lambda x: my_mesh.c_mesh.get_face_attribute(x,AS_TAGS[0]), my_mesh.c_mesh.faces()))
m_asy_b = list(map(lambda x: my_mesh.c_mesh.get_face_attribute(x,AS_TAGS[2]), my_mesh.c_mesh.faces()))

m_asx_t = list(map(lambda x: my_mesh.c_mesh.get_face_attribute(x,AS_TAGS[1]), my_mesh.c_mesh.faces()))
m_asy_t = list(map(lambda x: my_mesh.c_mesh.get_face_attribute(x,AS_TAGS[3]), my_mesh.c_mesh.faces()))

m_asx_c = list(map(lambda x: my_mesh.c_mesh.get_face_attribute(x,AS_TAGS[4]), my_mesh.c_mesh.faces()))
m_asy_c = list(map(lambda x: my_mesh.c_mesh.get_face_attribute(x,AS_TAGS[5]), my_mesh.c_mesh.faces()))


for thing in [m_asx_b, m_asy_b, m_asx_t, m_asy_t, m_asx_c, m_asy_c]:
    mass_bot = reduce(lambda x, y: x+y, thing)
    print(mass_bot)
# ---------- end python_15 ----------
num_66 = Number(python_15.mass_bot)
num_67 = Number(python_15.mass_top)
num_68 = Number(python_14.mass_bot)
num_69 = Number(num_68)
num_70 = Number(python_15.steel_mass)
num_71 = Number(python_14.steel_mass)
num_72 = Number(num_71)
num_73 = Number(python_14.mass_top)
num_74 = Number(num_73)
num_75 = Number(python_15.mass_center)
num_76 = Number(python_14.mass_center)
num_77 = Number(num_76)
entwine_10 = Entwine(Branch00=num_69, Branch01=num_74, Branch02=num_77, Branch03=num_72, FlattenInputs=True)
concat_2 = Concatenate(FragmentA=graft(panel_3), FragmentB="mass is:", FragmentC=entwine_10, FragmentD="kg", JoinSeparator=" ")
reinforcement_areas_domain_cm2_m_2 = Panel(concat_2)
num_78 = Number(python_13.data_values)
mesh_12 = Mesh(python_13.display_mesh)
mesh_13 = Mesh(mesh_12)
wbnaked = WeaverbirdsNakedBoundary(MeshClosedPolylines=mesh_13)

entwine_11 = Entwine(Branch00=wbnaked, Branch01=crv_3, Branch02=crv_4, FlattenInputs=True)
previewlw = CustomPreviewLineweights(Geometry=entwine_11, Shader=entwine_6, Thickness="4", Absolute=False)

col = Colour(python_13.color_data)
line_2 = Line(python_11.line_field)
line_3 = Line(python_11.centers_line_field)
col_2 = Colour(python_11.colors_centers_line_field)
vec_30 = Vector(python_11.vectors_a)
line_4 = Line(python_12.line_field)
line_5 = Line(python_12.centers_line_field)
col_3 = Colour(python_12.colors_centers_line_field)
vec_31 = Vector(python_12.vectors_a)
col_4 = Colour(python_11.colors_line_field)
vec_32 = Vector(python_11.vectors_b)
col_5 = Colour(python_12.colors_line_field)
vec_33 = Vector(python_12.vectors_b)
line_6 = Line(python_11.node_line_field)

line_7 = Line(line_2)
line_8 = Line(line_6)
line_9 = Line(line_3)

line_10 = Line(flatten(line_8))
line_11 = Line(line_10)
end = EndPoints(Curve=graft(line_11))  # -> Start, End
vec2pt = Vector2Pt(PointA=end.Start, PointB=end.End, Unitize=False)  # -> flatten(Vector), Length
vec2pt_2 = Vector2Pt(PointA=end.Start, PointB=end.End, Unitize="True")  # -> Vector, Length
eval = EvaluateCurve(Curve=graft(line_11), Parameter=0.5)  # -> Point, Tangent, Angle
vlen = VectorLength(Vector=vec2pt.Vector)
multiplication_2 = Multiplication(A=vec2pt_2.Vector, B="0.05")
bnd_3 = Bounds(Numbers=vlen)
rev_4 = Reverse(Vector=multiplication_2)
remap = RemapNumbers(Value=vlen, Source=bnd_3, Target=Domain(0, 1))  # -> Mapped, Clipped
move = Move(Geometry=eval.Point, Motion=rev_4)  # -> Geometry, Transform
move_2 = Move(Geometry=eval.Point, Motion=multiplication_2)  # -> Geometry, Transform
move_3 = Move(Geometry=line_10, Motion=Z_3)  # -> Geometry, Transform
graph_3 = GraphMapper(remap.Mapped, x0=0, x1=1, y0=0, y1=1, container_name="Bezier", cpx=[0, 0, 0.9786925316, 1], cpy=[0, 0, 0.5259319544, 1])
ln = Line(StartPoint=move_2.Geometry, EndPoint=move.Geometry)  # -> flatten(Line)
bnd_4 = Bounds(Numbers=graph_3)
line_12 = Line(ln)
gradient_4 = Gradient(
    LowerLimit="1",
    UpperLimit="-1",
    Parameter=graph_3,
    stops=[0: RGB(255, 0, 0), 0.176: RGB(255, 238, 0), 0.35: RGB(0, 255, 234), 0.504: RGB(35, 4, 128), 0.664: RGB(0, 252, 215), 0.843: RGB(255, 255, 0), 1: RGB(255, 0, 47)])
avr = Average(Input=[end.Start, end.End])  # -> flatten(ArithmeticMean)
remap_2 = RemapNumbers(Value=graph_3, Source=bnd_4, Target="4 to 0.5")  # -> Mapped, Clipped
scale = Scale(Geometry=line_11, Center=avr, Factor=remap_2.Mapped)  # -> Geometry, Transform
line_13 = Line(scale.Geometry)
col_6 = Colour(gradient_4)
preview = CustomPreview(Geometry=line_13, Material=swatch_3)
preview_2 = CustomPreview(Geometry=line_12, Material=gradient_4)
preview_3 = CustomPreview(Geometry=line_11, Material=col_6)
line_14 = Line(python_12.node_line_field)

line_15 = Line(line_4)
line_16 = Line(line_14)
line_17 = Line(line_5)

line_18 = Line(flatten(line_16))
line_19 = Line(line_18)
end_2 = EndPoints(Curve=graft(line_19))  # -> Start, End
vec2pt_3 = Vector2Pt(PointA=end_2.Start, PointB=end_2.End, Unitize=False)  # -> flatten(Vector), Length
vlen_2 = VectorLength(Vector=vec2pt_3.Vector)
bnd_5 = Bounds(Numbers=vlen_2)
remap_3 = RemapNumbers(Value=vlen_2, Source=bnd_5, Target=Domain(0, 1))  # -> Mapped, Clipped
graph_4 = GraphMapper(
    remap_3.Mapped,
    x0=0,
    x1=1,
    y0=0,
    y1=1,
    container_name="Bezier",
    cpx=[0, 0, 1, 1],
    cpy=[0, 0.3821747303, 0.5108695626, 1])
move_4 = Move(Geometry=line_18, Motion=Z_4)  # -> Geometry, Transform
bnd_6 = Bounds(Numbers=graph_4)
gradient_5 = Gradient(
    LowerLimit="1",
    UpperLimit="-1",
    Parameter=graph_4,
    stops=[0: RGB(255, 0, 0), 0.176: RGB(255, 238, 0), 0.35: RGB(0, 255, 234), 0.504: RGB(35, 4, 128), 0.664: RGB(0, 252, 215), 0.843: RGB(255, 255, 0), 1: RGB(255, 0, 47)])
avr_2 = Average(Input=[end_2.Start, end_2.End])  # -> flatten(ArithmeticMean)
remap_4 = RemapNumbers(Value=graph_4, Source=bnd_6, Target="4 to 0.5")  # -> Mapped, Clipped
scale_2 = Scale(Geometry=line_19, Center=avr_2, Factor=remap_4.Mapped)  # -> Geometry, Transform
line_20 = Line(scale_2.Geometry)
col_7 = Colour(gradient_5)
preview_4 = CustomPreview(Geometry=line_19, Material=col_7)
preview_5 = CustomPreview(Geometry=line_20, Material=swatch_3)
data_25 = Data(python_11.s_mesh)
data_26 = Data(python_12.s_mesh)

# ---- group: s_mesh
data_27 = Data(data_26)

# ----
python_16 = GhPythonScript(show=bool_17, s_mesh=data_27, vector_tag=txt_22, tol=num_38)  # -> out, s_mesh, face_neg, face_null, face_pos; inputs show: Boolean
# ---------- python_16: Python ----------
"""Retrieves data from a Structural Mesh object"""

__author__ = "Rafael Pastrana"
__name__ = "Mesh Displayer"
__date__ = "2018.07.24"
__version__ = "0.0.1"


# 1. Import dependencies
import rhinoscriptsyntax as rs

# 2. Start System
my_mesh = s_mesh
v_name = vector_tag

if show is True:
    my_mesh.get_face_labels(v_name, tol)
    face_neg, face_null, face_pos = my_mesh.stream_face_labels()
# ---------- end python_16 ----------
pt_9 = Point(python_16.face_pos)
data_28 = Data(python_16.s_mesh)

# ---- group: s_mesh
data_29 = Data(data_28)

# ----
python_17 = GhPythonScript(show=bool_14, s_mesh=data_29)  # -> out, s_mesh, face_planes, edge_planes; inputs show: Boolean
# ---------- python_17: Python ----------
"""Retrieves data from a Structural Mesh object"""

__author__ = "Rafael Pastrana"
__name__ = "Mesh Displayer"
__date__ = "2018.07.24"
__version__ = "0.0.1"


# 1. Import dependencies
import rhinoscriptsyntax as rs

# 2. Start System
my_mesh = s_mesh

if show is True:
    # plane properties
    face_planes = list(map(lambda x: my_mesh.cMesh.get_face_attribute(x,'plane'), my_mesh.cMesh.faces()))
    face_planes = [rs.PlaneFromNormal(x[0], x[1]) for x in face_planes]
    
    edge_planes = list(map(lambda x: my_mesh.cMesh.get_edge_attribute(x,'plane'), my_mesh.cMesh.edges()))
    edge_planes = [rs.PlaneFromNormal(x[0], x[1]) for x in edge_planes if x is not None]

s_mesh = s_mesh
# ---------- end python_17 ----------
data_30 = Data(python_17.s_mesh)
pln = Plane(python_17.face_planes)
pln_2 = Plane(python_17.edge_planes)
pt_10 = Point(python_16.face_neg)
pt_11 = Point(python_16.face_null)

pt_12 = Point(pt_10)
pt_13 = Point(pt_11)
pt_14 = Point(pt_9)  # disabled

entwine_12 = Entwine(Branch00=pt_12, Branch01=pt_13, Branch02=pt_14, FlattenInputs=True)
move_5 = Move(Geometry=entwine_12, Motion=X_3)  # -> Geometry, Transform
circle = CircleCNR(Center=move_5.Geometry, Normal=Vector(0, 0, 1), Radius="0.05")
preview_6 = CustomPreview(Geometry=circle, Material=entwine_3)
col_8 = Colour(python_11.colors_node_line_field)

col_9 = Colour(col_4)
col_10 = Colour(col_8)
col_11 = Colour(col_2)

entwine_13 = Entwine(Branch00=line_7, Branch01=line_8, Branch02=line_9, FlattenInputs=True)
entwine_14 = Entwine(Branch00=col_9, Branch01=col_10, Branch02=col_11, FlattenInputs=True)
move_6 = Move(Geometry=entwine_13, Motion=X_5)  # -> Geometry, Transform
preview_7 = CustomPreview(Geometry=line_10, Material=ColourSwatch(SwatchColor=RGB(255, 255, 255)))

col_12 = Colour(python_12.colors_node_line_field)

col_13 = Colour(col_5)
col_14 = Colour(col_12)
col_15 = Colour(col_3)

entwine_15 = Entwine(Branch00=line_15, Branch01=line_16, Branch02=line_17, FlattenInputs=True)
entwine_16 = Entwine(Branch00=col_13, Branch01=col_14, Branch02=col_15, FlattenInputs=True)
move_7 = Move(Geometry=entwine_15, Motion=X_6)  # -> Geometry, Transform
preview_8 = CustomPreview(Geometry=line_18, Material=ColourSwatch(SwatchColor=RGB(255, 255, 255)))

# ----
# ortho: asxt 29982.352815635506
# asxb 2252.8620993430886
# asxc 0.0
# asyt 46283.602919279474
# asyb 1569.8032661436623
# asyc 0.0
# ast 0.0
panel_27 = Panel(python_15.out)

mesh_14 = Mesh(mesh_12)

demesh_2 = DeconstructMesh(Mesh=mesh_14)  # -> Vertices, Faces, Colours, Normals

num_79 = Number(num_78)
bnd_7 = Bounds(Numbers=num_79)
python_18 = GhPythonScript(x=num_79)  # -> out, a; inputs x: list
# ---------- python_18: Python ----------
__author__ = "ARPJ"
__version__ = "2018.08.01"

import rhinoscriptsyntax as rs

def normalise_data(data, cmin=None, cmax=None):
    fmax = cmax if cmax is not None else max([abs(x) for x in data])
    fmin = cmin if cmin is not None else min([abs(x) for x in data])
    fabs = max([abs(fmin), abs(fmax)])

    fscaled = []
    for value in data:
        new_val = value / fabs
        if new_val > 1:
            new_val = 1
        elif new_val < -1:
            new_val = -1
        fscaled.append(new_val)
    return fscaled

a = normalise_data(x)
# ---------- end python_18 ----------
dedomain = DeconstructDomain(Domain=bnd_7)  # -> Start, End
range_4 = Range(Domain=bnd_7, Steps="15")
neg_3 = Negative(Value=dedomain.End)
gradient_6 = Gradient(
    LowerLimit=neg_3,
    UpperLimit=dedomain.End,
    Parameter=range_4,
    stops=[0: RGB(255, 0, 0), 0.176: RGB(255, 238, 0), 0.35: RGB(0, 255, 234), 0.504: RGB(35, 4, 128), 0.664: RGB(0, 252, 215), 0.843: RGB(255, 255, 0), 1: RGB(255, 0, 47)])
gradient_7 = Gradient(
    LowerLimit="-1",
    UpperLimit="1",
    Parameter=python_18.a,
    stops=[0: RGB(255, 0, 0), 0.176: RGB(255, 238, 0), 0.35: RGB(0, 255, 234), 0.504: RGB(35, 4, 128), 0.664: RGB(0, 252, 215), 0.843: RGB(255, 255, 0), 1: RGB(255, 0, 47)])
col_16 = Colour(gradient_6)
num_80 = Number(range_4)

num_81 = Number(num_80)
col_17 = Colour(col_16)
legend_4 = Legend(Colour=col_17, Tags=num_81, LegendType=1)

gradient_8 = Gradient(
    LowerLimit="-1",
    UpperLimit="1",
    Parameter=python_18.a,
    stops=[0: RGB(255, 0, 0), 0.254: RGB(255, 238, 0), 0.423: RGB(0, 255, 234), 0.504: RGB(35, 4, 128), 0.612: RGB(0, 252, 215), 0.744: RGB(255, 255, 0), 1: RGB(255, 0, 47)])
gradient_9 = Gradient(
    LowerLimit="-1",
    UpperLimit="1",
    Parameter=python_18.a,
    stops=[0: RGB(255, 0, 0), 0.254: RGB(255, 238, 0), 0.423: RGB(0, 255, 234), 0.504: RGB(35, 4, 128), 0.56: RGB(0, 252, 215), 0.719: RGB(255, 255, 0), 1: RGB(255, 0, 47)])
gradient_10 = Gradient(
    LowerLimit="-1",
    UpperLimit="1",
    Parameter=python_18.a,
    stops=[0: RGB(255, 0, 0), 0.254: RGB(255, 238, 0), 0.423: RGB(0, 255, 234), 0.767: RGB(35, 4, 128), 0.843: RGB(0, 252, 215), 0.925: RGB(255, 255, 0), 1: RGB(255, 0, 47)])

col_18 = Colour(gradient_10)

col_19 = Colour(col_18)

conmesh = ConstructMesh(Vertices=demesh_2.Vertices, Faces=demesh_2.Faces, Colours=col_19)
move_8 = Move(Geometry=conmesh, Motion=X_2)  # -> Geometry, Transform
wbedges_2 = WeaverbirdsMeshEdges(MeshOrPolylines=move_8.Geometry)
mblur = BlurMesh(Mesh=conmesh, Iterations=1)
previewlw_2 = CustomPreviewLineweights(Geometry=wbedges_2, Shader=ColourSwatch(SwatchColor=RGB(3, 3, 3)), Absolute=False)
mesh_15 = Mesh(mblur)
num_82 = Number(python_18.a)

# ==== cluster Cluster
mesh = ClusterInput()
vec = ClusterInput()
mesh_2 = Mesh(mesh)
vec_2 = Vector(vec)
facen = FaceNormals(Mesh=mesh_2)  # -> Centers, Normals
pl = PlaneNormal(Origin=facen.Centers, ZAxis=facen.Normals)
move = Move(Geometry=facen.Centers, Motion=vec_2)  # -> Geometry, Transform
project = Project(Geometry=move.Geometry, Plane=pl)  # -> Geometry, Transform
vec2pt = Vector2Pt(PointA=facen.Centers, PointB=project.Geometry, Unitize="True")  # -> Vector, Length
xprod = CrossProduct(VectorA=facen.Normals, VectorB=vec2pt.Vector, Unitize="True")  # -> Vector, Length
vec_3 = Vector(xprod.Vector)
vec_4 = Vector(vec2pt.Vector)
vec_5 = ClusterOutput(vec_3)
vec_6 = ClusterOutput(vec_4)
