# Grasshopper definition funnel_shell_xy.gh (Grasshopper 1.0.7)
# plug-ins: Karamba, Weaverbird

# shell
mesh = Mesh(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)

# ---- group: reorient mesh
cluster = Cluster_2(mesh=mesh)

# ---- group: Define Cross Sections / Define Materials
matselect = MaterialSelectionKaramba3D(menu=[dropdown(3), dropdown(6)])

# ---- group: Define Cross Sections
range = Range(Domain="5 to 40", Steps=10)
expression = Expression(x="Shell", y=range, Expression="x&\" \"&y")
cross_section = CrossSectionKaramba3D(
    FamilyNameOfCrossSection="Shell",
    NameOfCrossSection=graft(expression),
    Material=matselect,
    Height_cm=graft(range),
    mode="Shell - Const")  # -> flatten(CrossSection)
crosecselect = CrossSectionSelectorKaramba3D(CrossSections=cross_section)  # -> CrossSection, Info

# ----
mesh_2 = Mesh(cluster)
mesh_3 = Mesh(mesh_2)
wbcatmullclark = WeaverbirdsCatmullClarkSubdivision(MeshCurves=mesh_3, Level="2", SmoothNakedEdges=0)

# ---- group: Define Elements
meshtoshell = MeshToShellKaramba3D(Mesh=wbcatmullclark, Identifier="S", CrossSection=crosecselect.CrossSection, LimitDistance_m=0.005)  # -> Element, Points, Info

# ---- group: Define Loads
Z = UnitZ(Factor="-1")
mesh_4 = Mesh(wbcatmullclark)
loads = LoadsKaramba3D(Vector=Vector(0, 0, -1), LCase=0, mode="Gravity")
loads_2 = LoadsKaramba3D(Vector=Z, Mesh=mesh_4, LCase=0, mode="MeshLoad -Const.", menu=[buttons(off, on, off), buttons(on, off)])

# ----
pt = Point(meshtoshell.Points)
pt_2 = Point(pt)

# ---- group: find lowermost points
cluster_2 = Cluster_3(pt=pt_2)

# ----
pt_3 = Point(cluster_2)
pt_4 = Point(pt_3)

# ---- group: Define Supports
supp = SupportKaramba(PosInd=pt_4, menu=[buttons(on, on, on, off, off, off)])

# ---- group: Assemble Model
assemble = AssembleModelKaramba3D(Elem=meshtoshell.Element, Support=flatten(supp), Load=flatten([loads, loads_2]), LimitDistance_m=0.005)  # -> Model, Info, Mass_kg, CenterOfGravity

# ----
analyze = AnalyzeKaramba3D(Model=assemble.Model)  # -> CalculatedModel, MaximumDisplacement_cm, ResultingForceOfGravity_kN, ElasticEnergy_kNm
model = ModelKaramba3D(analyze.CalculatedModel)
model_2 = ModelKaramba(model)
panel = Panel("""1
-1
0""")
graft = GraftTree(Tree=panel, IncludeEmptyLists=True, IncludeNullItems=True)
shellvecresults = ResultVectorsOnShellsKaramba(AnalyzedModel=model_2, mode="PrincForce")  # -> AnalyzedModel, Points, FirstPrincipalNormalForceVector_kN_m, SecondPrincipalNormalForceVector_kN_m, FirstPrincipalMomentVector_kN, SecondPrincipalMomentVector_kN, FirstPrincipalNormalForceValue_kN_m, SecondPrincipalNormalForceValue_kN_m, FirstPrincipalMomentValue_kN, SecondPrincipalMomentValue_kN
shellvecresults_2 = ResultVectorsOnShellsKaramba(AnalyzedModel=model_2, LayerOfResults=graft, mode="PrincStress")  # -> AnalyzedModel, Points, FirstPrincipalStressVector_kN_cm2, SecondPrincipalStressVector_kN_cm2, FirstPrincipalStressValue_kN_cm2, SecondPrincipalStressValue_kN_cm2
disassemble = DisassembleModelKaramba(Model=model_2)  # -> Model, Point, Beam, Shell, Support, Load, Line, Mesh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

vec = Vector(shellvecresults_2.SecondPrincipalStressVector_kN_cm2)
vec_2 = Vector(shellvecresults_2.FirstPrincipalStressVector_kN_cm2)

vec_3 = Vector(shellvecresults.SecondPrincipalNormalForceVector_kN_m)
vec_4 = Vector(shellvecresults.FirstPrincipalNormalForceVector_kN_m)

vec_5 = Vector(shellvecresults.FirstPrincipalMomentVector_kN)
vec_6 = Vector(shellvecresults.SecondPrincipalMomentVector_kN)

vec_7 = Vector(simplify(vec_2))
vec_8 = Vector(simplify(vec))
vec_9 = Vector(vec_3)
vec_10 = Vector(vec_4)
vec_11 = Vector(vec_5)
vec_12 = Vector(vec_6)

path_mapper = PathMapper(vec_8, source="{A}", target="{A+7}")
path_mapper_2 = PathMapper(vec_7, source="{A}", target="{A+4}")
entwine = Entwine(Branch00=vec_10, Branch01=vec_9, Branch02=vec_11, Branch03=vec_12, FlattenInputs=True)  # -> simplify(Result)
merge = Merge(Data1=entwine, Data2=simplify(path_mapper_2), Data3=simplify(path_mapper))

# ---- group: Vector Fields
vec_13 = Vector(merge)

# ----
mesh_5 = Mesh(disassemble.Mesh)
vec_14 = Vector(vec_13)
mesh_6 = Mesh(mesh_5)

cluster_3 = Cluster(mesh=mesh_6, vec="{1, 0, 0}")  # -> vec_6, vec_5
entwine_2 = Entwine(Branch00=cluster_3.vec_6, Branch01=cluster_3.vec_5, FlattenInputs=True)  # -> simplify(Result)
path_mapper_3 = PathMapper(entwine_2, source="{A}", target="{A+10}")
merge_2 = Merge(Data1=vec_14, Data2=simplify(path_mapper_3))

mesh_7 = Mesh(mesh_6)
vec_15 = Vector(merge_2)

vec_16 = Vector(vec_15)
mesh_8 = Mesh(mesh_7)

# ---- group: Display Controls
display_vector_field = BooleanToggle(True)
bool = Boolean(display_vector_field)

display_face_singularities = BooleanToggle(True)
bool_2 = Boolean(display_face_singularities)

# ---- group: Display Vector Field - Selection
list = ValueList({"n_1": 0, "n_2": 1, "m_1": 2, "m_2": 3, "ps_1_top": 4, "ps_1_bot": 5, "ps_1_mid": 6, "ps_2_top": 7, "ps_2_bot": 8, "ps_2_mid": 9, "custom_1": 10, "custom_2": 11}, selected="ps_1_mid")
int = Integer(list)

# ---- group: Display Vector Field - Selection 2
list_2 = ValueList({"n_1": 0, "n_2": 1, "m_1": 2, "m_2": 3, "ps_1_top": 4, "ps_1_bot": 5, "ps_1_mid": 6, "ps_2_top": 7, "ps_2_bot": 8, "ps_2_mid": 9, "custom_1": 10, "custom_2": 11}, selected="ps_2_mid")
int_2 = Integer(list_2)

# ---- group: Vector Field - Display Scale
vector_scale = Slider(0.5, range=0..2.5)
num = Number(vector_scale)

# ---- group: Vector Field - Singularities Detection Tolerance
singularities_tol = Slider(0, range=0..1)
num_2 = Number(singularities_tol)

# ---- group: Vector Field - Display Scale
vector_scale_2 = Slider(0.5, range=0..2.5)
num_3 = Number(vector_scale_2)

# ---- group: Mesh and Vectors - 3d to 2d
cluster_4 = Cluster_4(mesh=mesh_8, vec=vec_16)  # -> crv_2, mesh_4

# ----
mesh_9 = Mesh(cluster_4.mesh_4)
crv = Curve(cluster_4.crv_2)
crv_2 = Curve(crv)

# ---- group: curve to vector
cluster_5 = Cluster_5(crv=crv_2)

# ----
vec_17 = Vector(cluster_5)

mesh_10 = Mesh(mesh_9)

# ---- group: Principal Vectors
vec_18 = Vector(vec_17)

# ----
panel_2 = Panel("""n_1
n_2
m_1
m_2
ps_1_top
ps_1_bot
ps_1_mid
ps_2_top
ps_2_bot
ps_2_mid
custom_1
custom_2""")
int_3 = Integer(int)
int_4 = Integer(int_2)
graft_2 = GraftTree(Tree=panel_2, IncludeEmptyLists=True, IncludeNullItems=True)
item = ListItem(List=panel_2, Index=int_3, Wrap=True)
item_2 = ListItem(List=panel_2, Index=int_4, Wrap=True)

# ---- group: Principal Vectors - Tags
txt = Text(graft_2)

txt_2 = Text(txt)

# ----
python = GhPythonScript(mesh=mesh_10, vectors=vec_18, vectors_tags=txt_2)  # -> out, s_mesh; inputs mesh: Mesh, vectors: tree of Vector3d, vectors_tags: tree
# ---------- python: Python ----------
__author__ = "Rafael Pastrana"
__name__ = "Mesh Maker"
__date__ = "2018.07.19"
__version__ = "0.0.1"


# 1. Import dependencies
import sys
import imp
import rhinoscriptsyntax as rs

# 1-b. Replace with your own path here
# sys.path.append("Z:\projects\streamlines\src\streamlines")

# import custom_mesh
# imp.reload(custom_mesh)

# from custom_mesh import StructuralMesh
from streamlines.custom_mesh import StructuralMesh

# Define Global Variables
NORM = False
run = True

# 2. Start System
if run is True:
    print('SYSTEM STARTED')
        
    # instantiate mesh
    my_mesh = StructuralMesh(mesh)

    # set vector attributes
    for idx, vector_field in enumerate(vectors.Branches):
        tag = vectors_tags.Branches[idx][0]
        clean_vectors = [[vec.X, vec.Y, vec.Z] for vec in vector_field]
        my_mesh.set_face_vectors(clean_vectors, tag, NORM)
        # my_mesh.set_vertex_vectors(tag)
        my_mesh.set_vertex_vectors_angles(tag)
    
    # output mesh
    s_mesh = my_mesh
# ---------- end python ----------
data = Data(python.s_mesh)

# ---- group: vector_tag - display 1
txt_3 = Text(item)

# ---- group: vector_tag - display_2
txt_4 = Text(item_2)

# ---- group: vector_tag
txt_5 = Text(txt_4)

txt_6 = Text(txt_3)

# ---- group: Vector Scale
num_4 = Number(num)

num_5 = Number(num_3)

# ---- group: display
bool_3 = Boolean(bool)

bool_4 = Boolean(bool)

# ---- group: vector_tag
txt_7 = Text(txt_3)

# ---- group: s_mesh
data_2 = Data(data)

# ---- group: Vector Scale
num_6 = Number(num_2)

# ---- group: display
bool_5 = Boolean(bool_2)

# ----
python_2 = GhPythonScript(show=bool_5, s_mesh=data_2, vector_tag=txt_7, tol=num_6)  # -> out, s_mesh, face_neg, face_null, face_pos; inputs show: Boolean
# ---------- python_2: Python ----------
"""Retrieves data from a Structural Mesh object"""

__author__ = "Rafael Pastrana"
__name__ = "Mesh Displayer"
__date__ = "2018.07.24"
__version__ = "0.0.1"


# 1. Import dependencies
import rhinoscriptsyntax as rs

# 2. Start System
my_mesh = s_mesh
v_name = vector_tag

if show is True:
    my_mesh.get_face_labels(v_name, tol)
    face_neg, face_null, face_pos = my_mesh.stream_face_labels()
# ---------- end python_2 ----------
data_3 = Data(python_2.s_mesh)

# ---- group: s_mesh
data_4 = Data(data_3)

# ----
python_3 = GhPythonScript(show=bool_4, s_mesh=data_4, vector_tag=txt_6, v_scale=num_4)  # -> out, s_mesh, line_field, node_line_field, centers_line_field, colors_line_field, colors_node_line_field, colors_centers_line_field, vectors_a, vectors_b; inputs show: Boolean
# ---------- python_3: Python ----------
"""Retrieves data from a Structural Mesh object"""

__author__ = "Rafael Pastrana"
__name__ = "Mesh Displayer"
__date__ = "2018.07.24"
__version__ = "0.0.1"


# 1. Import dependencies
import imp
import rhinoscriptsyntax as rs
import sys

# sys.path.append("Z:\projects\streamlines\src\streamlines")
# import display
# imp.reload(display)
# from display import Display

from streamlines.display import Display
import compas.geometry as cg

dsp = Display()

# 2. Start System
my_mesh = s_mesh
v_name = vector_tag
TAG = '_val'

if show is True:
    # vector properties
    line_field = dsp.draw_face_vectors(my_mesh, v_name, v_scale)
    node_line_field = dsp.draw_node_vectors(my_mesh, v_name, v_scale)
    center_vectors = my_mesh.find_vector_face_centers(v_name)
    centers = list(map(lambda x: my_mesh.c_mesh.face_centroid(x), my_mesh.c_mesh.faces()))
    centers_line_field = dsp.draw_vectors(centers, center_vectors, v_scale)
        
    f_color = []
    for f_key in my_mesh.c_mesh.faces():
        val = my_mesh.c_mesh.get_face_attribute(f_key, v_name+TAG)
        if val:
            if val < 0:
                f_color.append(rs.CreateColor(255,0,0))
            else:
                f_color.append(rs.CreateColor(0,0,255))
        else:
            f_color.append(rs.CreateColor(0,0,255))
            
    n_color = []
    for v_key in my_mesh.c_mesh.vertices():
        val = my_mesh.c_mesh.get_vertex_attribute(v_key, v_name+TAG)
        if val < 0:
            n_color.append(rs.CreateColor(0,0,0))
        else:
            n_color.append(rs.CreateColor(0,0,0))
    
    colors_line_field = f_color
    colors_node_line_field = n_color
    colors_centers_line_field = f_color
    
    vectors_a = list(map(lambda x: my_mesh.c_mesh.get_vertex_attribute(x,v_name+'_a'), my_mesh.c_mesh.vertices()))
    vectors_a = list(map(lambda x: rs.CreateVector(*x), vectors_a))
    
    vectors_b = list(map(lambda x: my_mesh.c_mesh.get_vertex_attribute(x,v_name+'_b'), my_mesh.c_mesh.vertices()))
    vectors_b = list(map(lambda x: rs.CreateVector(*x), vectors_b))
# ---------- end python_3 ----------
vec_19 = Vector(python_3.vectors_b)
data_5 = Data(python_3.s_mesh)

# ---- group: s_mesh
data_6 = Data(data_5)

# ----
python_4 = GhPythonScript(show=bool_3, s_mesh=data_6, vector_tag=txt_5, v_scale=num_5)  # -> out, s_mesh, line_field, node_line_field, centers_line_field, colors_line_field, colors_node_line_field, colors_centers_line_field, vectors_a, vectors_b; inputs show: Boolean; same code as python_3
line = Line(python_4.line_field)
line_2 = Line(python_4.centers_line_field)
col = Colour(python_4.colors_centers_line_field)
vec_20 = Vector(python_4.vectors_a)
col_2 = Colour(python_4.colors_line_field)
vec_21 = Vector(python_4.vectors_b)
line_3 = Line(python_4.node_line_field)
line_4 = Line(python_3.line_field)
line_5 = Line(python_3.node_line_field)
line_6 = Line(python_3.centers_line_field)
col_3 = Colour(python_3.colors_line_field)
col_4 = Colour(python_3.colors_centers_line_field)
vec_22 = Vector(python_3.vectors_a)
data_7 = Data(python_4.s_mesh)
col_5 = Colour(python_3.colors_node_line_field)
col_6 = Colour(python_4.colors_node_line_field)
pt_5 = Point(python_2.face_neg)
pt_6 = Point(python_2.face_null)
pt_7 = Point(python_2.face_pos)

model_3 = ModelKaramba3D(model)
pt_8 = Point(pt)
rdpoints = RemoveDuplicatePointsKaramba3D(Point=pt_8, LimitDistance=0.005)  # -> OutPoint, Info, Indexes
dup = DuplicateData(Data="0", Number="10", Order=True)
entwine_3 = Entwine(Branch00="1", Branch01=dup, FlattenInputs=True)  # -> flatten(Result)
cull = CullPattern(List=rdpoints.OutPoint, CullPattern=entwine_3)
shelllineresults = LineResultsOnShellsKaramba3D(
    AnalyzedModel=model_3,
    LayerPosition="0",
    ListOfSourcesOfPrincipalStressLinesLinesPoints=cull,
    SegmentLength_m=0.5,
    DA_deg=5,
    mode="PrincStress")  # -> AnalyzedModel, Lines1, Lines2
entwine_4 = Entwine(Branch00=shelllineresults.Lines1, Branch01=shelllineresults.Lines2, FlattenInputs=True)
project = Project(Geometry=entwine_4, Plane=PlaneXY(0, 0, 0))  # -> Geometry, Transform
entwine_5 = Entwine(Branch00=ColourSwatch(SwatchColor=RGB(255, 0, 0)), Branch01=ColourSwatch(SwatchColor=RGB(0, 0, 255)), FlattenInputs=True)
preview = CustomPreview(Geometry=project.Geometry, Shader=entwine_5)

# ---- group: Optional Colors
range_2 = Range(Domain=Domain(0, 1), Steps=10)
gradient = Gradient(
    LowerLimit=0,
    UpperLimit=1,
    Parameter=range_2,
    stops=[0: RGB(255, 0, 0), 0.176: RGB(255, 238, 0), 0.35: RGB(0, 255, 234), 0.504: RGB(35, 4, 128), 0.664: RGB(0, 252, 215), 0.843: RGB(255, 255, 0), 1: RGB(255, 0, 47)])

# ----
model_4 = ModelKaramba(model)
modelview = ModelViewKaramba(Model=model_4, LoadCaseFactorsForLinearSuperposition=1, IndexOfVisibleLoadcase=-1, ListOfColorsForColoringPlots=gradient)  # -> Model, DeformedMesh, DeformedAxes, DeformedModel
shellview = ShellViewKaramba(Model=modelview.Model, IndexOfLayer=0)  # -> Model, MeshesOfRenderedShells, LegendColors, LegendTags
legend = Legend(Colour=shellview.LegendColors, Tags=shellview.LegendTags, LegendType=1)

line_7 = Line(line_5)
line_8 = Line(line_3)
end = EndPoints(Curve=graft(line_7))  # -> Start, End
end_2 = EndPoints(Curve=graft(line_8))  # -> Start, End
vec2pt = Vector2Pt(PointA=end.Start, PointB=end.End, Unitize=False)  # -> flatten(Vector), Length
vec2pt_2 = Vector2Pt(PointA=end_2.Start, PointB=end_2.End, Unitize=False)  # -> flatten(Vector), Length
vlen = VectorLength(Vector=vec2pt.Vector)
vlen_2 = VectorLength(Vector=vec2pt_2.Vector)
bnd = Bounds(Numbers=vlen)
bnd_2 = Bounds(Numbers=vlen_2)
remap = RemapNumbers(Value=vlen, Source=bnd, Target=Domain(0, 1))  # -> Mapped, Clipped
remap_2 = RemapNumbers(Value=vlen_2, Source=bnd_2, Target=Domain(0, 1))  # -> Mapped, Clipped
gradient_2 = Gradient(
    LowerLimit="1",
    UpperLimit="-1",
    Parameter=remap.Mapped,
    stops=[0: RGB(255, 0, 0), 0.176: RGB(255, 238, 0), 0.35: RGB(0, 255, 234), 0.504: RGB(35, 4, 128), 0.664: RGB(0, 252, 215), 0.843: RGB(255, 255, 0), 1: RGB(255, 0, 47)])
gradient_3 = Gradient(
    LowerLimit="1",
    UpperLimit="-1",
    Parameter=remap_2.Mapped,
    stops=[0: RGB(255, 0, 0), 0.176: RGB(255, 238, 0), 0.35: RGB(0, 255, 234), 0.504: RGB(35, 4, 128), 0.664: RGB(0, 252, 215), 0.843: RGB(255, 255, 0), 1: RGB(255, 0, 47)])
preview_2 = CustomPreview(Geometry=line_7, Material=gradient_2)
preview_3 = CustomPreview(Geometry=line_8, Material=gradient_3)

# ---- group: Display Vector Field Singularities
pt_9 = Point(pt_5)
pt_10 = Point(pt_6)
pt_11 = Point(pt_7)  # disabled

entwine_6 = Entwine(Branch00=pt_9, Branch01=pt_10, Branch02=pt_11, FlattenInputs=True)
entwine_7 = Entwine(
    Branch00=ColourSwatch(SwatchColor=RGB(255, 0, 0)),
    Branch01=ColourSwatch(SwatchColor=RGB(0, 255, 38)),
    Branch02=ColourSwatch(SwatchColor=RGB(0, 128, 255)),
    FlattenInputs=True)
cir = Circle(Plane=entwine_6, Radius="0.05")
preview_4 = CustomPreview(Geometry=cir, Material=entwine_7)

# ----
boundary = BoundarySurfaces(Edges=cir)

# ==== cluster Cluster
mesh = ClusterInput()
vec = ClusterInput()
mesh_2 = Mesh(mesh)
vec_2 = Vector(vec)
facen = FaceNormals(Mesh=mesh_2)  # -> Centers, Normals
pl = PlaneNormal(Origin=facen.Centers, ZAxis=facen.Normals)
move = Move(Geometry=facen.Centers, Motion=vec_2)  # -> Geometry, Transform
project = Project(Geometry=move.Geometry, Plane=pl)  # -> Geometry, Transform
vec2pt = Vector2Pt(PointA=facen.Centers, PointB=project.Geometry, Unitize="True")  # -> Vector, Length
xprod = CrossProduct(VectorA=facen.Normals, VectorB=vec2pt.Vector, Unitize="True")  # -> Vector, Length
vec_3 = Vector(xprod.Vector)
vec_4 = Vector(vec2pt.Vector)
vec_5 = ClusterOutput(vec_3)
vec_6 = ClusterOutput(vec_4)

# ==== cluster Cluster_2
mesh = ClusterInput()
mesh_2 = Mesh(mesh)
project = Project(Geometry=mesh_2, Plane=PlaneXY(0, 0, 0))  # -> Geometry, Transform
bbox = BoundingBox(Content=mesh_2, Plane=PlaneXY(0, 0, 0))  # -> Box, Box_2
demesh = DeconstructMesh(Mesh=project.Geometry)  # -> Vertices, Faces, Colours, Normals
wbedges = WeaverbirdsMeshEdges(MeshOrPolylines=project.Geometry)
debrep = DeconstructBrep(Brep=bbox.Box)  # -> Faces, Edges, Vertices
eval = EvaluateCurve(Curve=reparameterize(wbedges), Parameter="0.5")  # -> Point, Tangent, Angle
avr = Average(Input=demesh.Vertices)
item = ListItem(List=reverse(debrep.Faces), Index=0, Wrap=True)
cp = ClosestPoint(Point=avr, Cloud=eval.Point)  # -> ClosestPoint, CPIndex, Distance
evalsrf = EvaluateSurface(Surface=reparameterize(item), Point="{0.5, 0.5, 0.0}")  # -> Point, Normal, UDirection, VDirection, Frame
item_2 = ListItem(List=wbedges, Index=cp.CPIndex, Wrap=True)
deplane = DeconstructPlane(Plane=evalsrf.Frame)  # -> Origin, XAxis, YAxis, ZAxis
end = EndPoints(Curve=item_2)  # -> Start, End
vec2pt = Vector2Pt(PointA=end.Start, PointB=end.End, Unitize=False)  # -> Vector, Length
angle = Angle(VectorA=deplane.XAxis, VectorB=vec2pt.Vector, Plane=evalsrf.Frame)  # -> Angle, Reflex
xy = XYPlane(Origin=Point(0, 0, 0))
prot = RotatePlane(Plane=evalsrf.Frame, Angle=angle.Angle)
orient = Orient(Geometry=mesh_2, Source=prot, Target=xy)  # -> Geometry, Transform
mesh_3 = Mesh(orient.Geometry)
mesh_4 = ClusterOutput(mesh_3)

# ==== cluster Cluster_3
pt = ClusterInput()
pt_2 = Point(pt)
pdecon = Deconstruct(Point=pt_2)  # -> XComponent, YComponent, ZComponent
sort = SortList(Keys=pdecon.ZComponent, ValuesA=pt_2)  # -> Keys, ValuesA
dcon = DeleteConsecutive(Set=sort.Keys, Wrap=False)  # -> Set, Count
item = ListItem(List=dcon.Set, Index=0, Wrap=True)
smaller = SmallerThan(FirstNumber=sort.Keys, SecondNumber=item)  # -> SmallerThan, OrEqualTo
cull = CullPattern(List=sort.ValuesA, CullPattern=smaller.OrEqualTo)
pt_3 = Point(cull)
pt_4 = ClusterOutput(pt_3)

# ==== cluster Cluster_4
vec = ClusterInput()
mesh = ClusterInput()
mesh_2 = Mesh(mesh)
vec_2 = Vector(vec)
tstat = TreeStatistics(Tree=vec_2)  # -> Paths, Length, Count
project = Project(Geometry=mesh_2, Plane=PlaneXY(0, 0, 0))  # -> Geometry, Transform
faceb = FaceBoundaries(Mesh=mesh_2)
facen = FaceNormals(Mesh=mesh_2)  # -> Centers, Normals
faceb_2 = FaceBoundaries(Mesh=project.Geometry)
line = LineSDL(Start=facen.Centers, Direction=vec_2, Length="0.10")  # -> simplify(Line)
graft = GraftTree(Tree=faceb_2, IncludeEmptyLists=True, IncludeNullItems=True)  # -> simplify(Tree)
clx = CurveLine(Curve=reparameterize(faceb), Line=line)  # -> Points, simplify(Params), Count
dup = DuplicateData(Data=graft, Number=tstat.Count, Order=True)
graft_2 = GraftTree(Tree=dup, IncludeEmptyLists=True, IncludeNullItems=True)  # -> simplify(Tree)
path_mapper = PathMapper(graft_2, source="{A;B}", target="{B;A}")
data = Data(path_mapper)
eval = EvaluateCurve(Curve=reparameterize(graft(data)), Parameter=clx.Params)  # -> Point, Tangent, Angle
pline = PolyLine(Vertices=eval.Point, Closed=False)
mesh_3 = Mesh(project.Geometry)
mesh_4 = ClusterOutput(mesh_3)
crv = Curve(pline)
crv_2 = ClusterOutput(crv)

# ==== cluster Cluster_5
crv = ClusterInput()
crv_2 = Curve(crv)
end = EndPoints(Curve=crv_2)  # -> Start, End
vec2pt = Vector2Pt(PointA=end.Start, PointB=end.End, Unitize=False)  # -> Vector, Length
trim = TrimTree(Tree=simplify(vec2pt.Vector), Depth=1)
vec = Vector(trim)
vec_2 = ClusterOutput(vec)
