# Grasshopper definition knit_candela.gh (Grasshopper 1.0.7)
# plug-ins: Human, Weaverbird, karambaGH

mesh = Mesh(<mesh referenced from the Rhino model>)
mesh_2 = Mesh(mesh)
weaverbird_s_catmull_clark_subdivision = WeaverbirdsCatmullClarkSubdivision(MeshCurves=mesh_2, Level="2", SmoothNakedEdges=1)
mesh_3 = Mesh(weaverbird_s_catmull_clark_subdivision)
number = Number(Slider(0, range=0..100))
number_2 = Number(Slider(0.05, range=0..0.1))
mesh_4 = Mesh(mesh_3)
deconstruct_mesh = DeconstructMesh(Mesh=mesh_4)  # -> Vertices, Faces, Colours, Normals
tri = Triangulate(Mesh=mesh_4)  # -> Mesh, Count
concrete_covers_cm = Panel("""2.5
2.5
-2.5
-2.5""")
mesh_5 = Mesh(tri.Mesh)
point = Point(deconstruct_mesh.Vertices)
point_2 = Point(point)
deconstruct = Deconstruct(Point=point_2)  # -> XComponent, YComponent, ZComponent
smaller_than = SmallerThan(FirstNumber=deconstruct.ZComponent, SecondNumber="0.1")  # -> SmallerThan, OrEqualTo
cull_pattern = CullPattern(List=point_2, CullPattern=smaller_than.SmallerThan)
matselect = MaterialSelectionKaramba(menu=[dropdown(3), dropdown(8)])
matselect_2 = MaterialSelectionKaramba(menu=[dropdown(2), dropdown(2)])
num = Number(number_2)
mesh_6 = Mesh(mesh_5)
num_2 = Number(number)
point_3 = Point(cull_pattern)
multiplication = Multiplication(A=num, B="100")
multiplication_2 = Multiplication(A=concrete_covers_cm, B=2)
panel = Panel(multiplication)
cross_sections = CrossSectionsKaramba(
    FamilyNameOfCrossSection="DefaultCroSec",
    MaterialConcrete=matselect,
    Height_cm=panel,
    MaterialReinforcement=matselect_2,
    ReinforcementConcreteCovers_cm=multiplication_2,
    PrincipalReinforcementDirection_deg=0,
    mode="Shell RC Standard - Const.")
mesh_7 = Mesh(mesh_5)
pt = Point(point_3)
meshtoshell = MeshToShellKaramba(Mesh=mesh_6, Identifier="slab", CrossSection=cross_sections, LimitDistance_m=0.005)  # -> Element, Points, Info
pt_2 = ConstructPoint(XCoordinate=0, YCoordinate=0, ZCoordinate=0)
vec = VectorXYZ(XComponent="1.0", YComponent=num_2, ZComponent=0)  # -> Vector, Length
supp = SupportKaramba(PosInd=pt, menu=[buttons(on, on, on, off, off, on)])
vdisex = VectorDisplayEx(Point=pt_2, Vector=vec.Vector, Colour=RGB(0, 0, 0), Width=2)
orientate = OrientateElemKaramba(Shell=meshtoshell.Element, XOrientations=vec.Vector, mode="Shell")
entwine = Entwine(Branch02=supp, FlattenInputs=True)
element = ElementKaramba(flatten(orientate))
support = SupportKaramba(flatten(entwine))
element_2 = ElementKaramba(element)
support_2 = SupportKaramba(support)
pt_3 = Point()

# ---- group: Optional Colors
range = Range(Domain=Domain(0, 1), Steps=10)
gradient = Gradient(
    LowerLimit=0,
    UpperLimit=1,
    Parameter=range,
    stops=[0: RGB(255, 0, 0), 0.176: RGB(255, 238, 0), 0.35: RGB(0, 255, 234), 0.504: RGB(35, 4, 128), 0.664: RGB(0, 252, 215), 0.843: RGB(255, 255, 0), 1: RGB(255, 0, 47)])

range_2 = Range(Domain=Domain(0, 1), Steps=10)
gradient_2 = Gradient(
    LowerLimit=0,
    UpperLimit=1,
    Parameter=range_2,
    stops=[0: RGB(255, 0, 0), 0.176: RGB(255, 238, 0), 0.35: RGB(0, 255, 234), 0.504: RGB(35, 4, 128), 0.664: RGB(0, 252, 215), 0.843: RGB(255, 255, 0), 1: RGB(255, 0, 47)])

# ----
panel_2 = Panel("""nx
ny
nxy
mx
my
mxy
vx
vy""")
graft = GraftTree(Tree=panel_2, IncludeEmptyLists=True, IncludeNullItems=True)

# ---- group: Display Vector Field - Selection 2
list = ValueList({"n_1": 0, "n_2": 1, "m_1": 2, "m_2": 3, "ps_1_top": 4, "ps_1_bot": 5, "ps_1_mid": 6, "ps_2_top": 7, "ps_2_bot": 8, "ps_2_mid": 9, "custom_1": 10, "custom_2": 11}, selected="ps_2_mid")
int = Integer(list)

# ---- group: Vector Field 1 - Selection
list_2 = ValueList({"n_1": 0, "n_2": 1, "m_1": 2, "m_2": 3, "ps_1_top": 4, "ps_1_bot": 5, "ps_1_mid": 6, "ps_2_top": 7, "ps_2_bot": 8, "ps_2_mid": 9, "custom_1": 10, "custom_2": 11}, selected="ps_1_mid")
int_2 = Integer(list_2)

# ---- group: Display Vector Field - Selection
list_3 = ValueList({"n_1": 0, "n_2": 1, "m_1": 2, "m_2": 3, "ps_1_top": 4, "ps_1_bot": 5, "ps_1_mid": 6, "ps_2_top": 7, "ps_2_bot": 8, "ps_2_mid": 9, "custom_1": 10, "custom_2": 11}, selected="ps_1_mid")
int_3 = Integer(list_3)

# ---- group: Display Mesh - Mode Selection
list_4 = ValueList({"max": 0, "min": 1, "avg": 2, "angle_avg": 3}, selected="avg")
int_4 = Integer(list_4)

# ---- group: As 2 - Density Selection
list_5 = ValueList({"asx_": 0, "asy_": 1}, selected="asy_")
int_5 = Integer(list_5)

# ---- group: RC - Design Controls
shell_thickness_m = Slider(0.14, range=0..1)
concrete_compression_strength_fck = Slider(40, range=0..100)
concrete_tension_strength_factor_fctd = Slider(10, range=0..100)
rebar_yield_strength_fy = Slider(500, range=0..1000)
cover_to_rebar_m = Slider(0.05, range=0..1)

# ---- group: Display Controls
display_results_on_mesh = BooleanToggle(True)
bool = Boolean(display_results_on_mesh)

display_vector_field = BooleanToggle(True)
bool_2 = Boolean(display_vector_field)

display_seeds = BooleanToggle(False)
bool_3 = Boolean(display_seeds)

display_face_singularities = BooleanToggle(True)
bool_4 = Boolean(display_face_singularities)

display_face_edge_planes = BooleanToggle(False)
bool_5 = Boolean(display_face_edge_planes)

# ---- group: As 1 - Density Selection
list_6 = ValueList({"asx_": 0, "asy_": 1}, selected="asx_")
int_6 = Integer(list_6)

# ---- group: Display Mesh - Results Selection
list_7 = ValueList({"nx": 0, "ny": 1, "nxy": 2, "mx": 3, "my": 4, "mxy": 5, "vx": 6, "vy": 7, "asx_b": 8, "asx_t": 9, "asy_b": 10, "asy_t": 11, "asx_c": 12, "asy_c": 13, "asx_": 14, "asy_": 15, "sp_asx_": 16, "sp_asy_": 17}, selected="asy_")
int_7 = Integer(list_7)

# ----
panel_3 = Panel("""asx_b
asx_t
asy_b
asy_t
asx_c
asy_c
asx_
asy_
spacing_asx_
spacing_asy_""")
int_8 = Integer(int_7)

min_length = Slider(0.2, range=0..2)
dl = Slider(0.01, range=0..0.1)
num_3 = Number(dl)
num_4 = Number(min_length)

dir_1_weight_vector_field = Slider(1, range=0..1)
dir_1_weight_separate = Slider(0, range=0..1)
dir_1_weight_align = Slider(0, range=0..1)
dir_2_weight_separate = Slider(0, range=0..1)
dir_2_weight_vector_field = Slider(1, range=0..1)
dir_2_weight_align = Slider(0, range=0..1)
merge = Merge(
    Data1=dir_1_weight_vector_field,
    Data2=dir_1_weight_separate,
    Data3=dir_1_weight_align,
    Data4=dir_2_weight_vector_field,
    Data5=dir_2_weight_separate,
    Data6=dir_2_weight_align)
num_5 = Number(merge)

# ---- group: Loading - Controls
area_load_kn_m2 = Slider(10, range=0..100)
num_6 = Number(area_load_kn_m2)

# ----
num_7 = Number(num_6)
panel_4 = Panel(num_7)
Z = UnitZ(Factor=panel_4)
rev = Reverse(Vector=Z)
loads_karamba3d = LoadsKaramba3D(Vector=rev, Mesh=mesh_7, LCase=0, mode="MeshLoad -Const.", menu=[buttons(off, on, off), buttons(on, on)])
entwine_2 = Entwine(Branch00=loads_karamba3d, FlattenInputs=True)
load = LoadKaramba(flatten(entwine_2))
load_2 = LoadKaramba(load)
assemble = AssembleModelKaramba(Elem=element_2, Support=support_2, Load=load_2, LimitDistance_m=0.005)  # -> Model, Info, Mass_kg, CenterOfGravity
analyzethi = AnalyzeThIKaramba(Model=assemble.Model)  # -> CalculatedModel, MaximumDisplacement_m, ResultingForceOfGravity_kN, ElasticEnergy_kNm
panel_5 = Panel(analyzethi.MaximumDisplacement_m)
model = ModelKaramba(analyzethi.CalculatedModel)
model_2 = ModelKaramba(model)
shelllineresults = LineResultsOnShellsKaramba(
    AnalyzedModel=model_2,
    Layer="-1",
    ListOfSourcesOfPrincipalStressLinesLinesPoints=pt_3,
    SegmentLength_m=0.5,
    DA_deg=5,
    mode="PrincStress")  # -> AnalyzedModel, Lines1, Lines2
model_3 = ModelKaramba(model)

model_4 = ModelKaramba(model)
modelview = ModelViewKaramba(Model=model_4, LoadCaseFactorsForLinearSuperposition=1, IndexOfVisibleLoadcase=-1, ListOfColorsForColoringPlots=gradient)  # -> Model, DeformedMesh, DeformedAxes, DeformedModel
shellview = ShellViewKaramba(Model=modelview.Model, IndexOfLayer=0)  # -> Model, MeshesOfRenderedShells, LegendColors, LegendTags
legend = Legend(Colour=shellview.LegendColors, Tags=shellview.LegendTags, LegendType=1)

# ---- group: Algorithm - Controls
run_rc_design = BooleanToggle(True)
bool_6 = Boolean(run_rc_design)

run_smesh = BooleanToggle(True)
bool_7 = Boolean(run_smesh)

# ----
export_smesh_json = BooleanToggle(False)

# ---- group: Custom Vector - Controls
x_vector = Slider(1, range=0..1)
y_vector = Slider(0, range=0..1)
z_vector = Slider(0, range=0..1)
vec_2 = VectorXYZ(XComponent=x_vector, YComponent=y_vector, ZComponent=z_vector)  # -> Vector, Length
vec_3 = Vector(vec_2.Vector)

# ----
vec_4 = Vector(vec_3)

vector_scale = Slider(2.5, range=0..2.5)
num_8 = Number(vector_scale)

vector_scale_2 = Slider(2.5, range=0..2.5)
num_9 = Number(vector_scale_2)

singularities_tol = Slider(0, range=0..1)
num_10 = Number(singularities_tol)

panel_6 = Panel("""n_1
n_2
m_1
m_2
ps_1_top
ps_1_bot
ps_1_mid
ps_2_top
ps_2_bot
ps_2_mid
custom_1
custom_2""")
int_9 = Integer(int_2)
int_10 = Integer(int_3)
graft_2 = GraftTree(Tree=panel_6, IncludeEmptyLists=True, IncludeNullItems=True)
item = ListItem(List=panel_6, Index=int_10, Wrap=True)
item_2 = ListItem(List=panel_6, Index=int_9, Wrap=True)

panel_7 = Panel("""max
min
avg
angle_avg""")
int_11 = Integer(int_4)

panel_8 = Panel("""asx_
asy_""")
int_12 = Integer(int_6)
int_13 = Integer(int_5)
item_3 = ListItem(List=panel_8, Index=int_12, Wrap=True)
item_4 = ListItem(List=panel_8, Index=int_13, Wrap=True)

int_14 = Integer(int)
merge_2 = Merge(Data1=panel_2, Data2=panel_3)
item_5 = ListItem(List=panel_6, Index=int_14, Wrap=True)
item_6 = ListItem(List=merge_2, Index=int_8, Wrap=True)
item_7 = ListItem(List=panel_7, Index=int_11, Wrap=True)

# ---- group: Internal Forces - Tags
txt = Text(graft)

# ---- group: Display - Tag
txt_2 = Text(item_6)

# ---- group: as_tag_1
txt_3 = Text(item_3)

# ---- group: as_tag_2
txt_4 = Text(item_4)

# ---- group: Principal Vectors - Tags
txt_5 = Text(graft_2)

# ---- group: vector_tag
txt_6 = Text(item_2)

# ---- group: vector_tag - display
txt_7 = Text(item)

# ---- group: Display - Tag
txt_8 = Text(item_7)

# ----
txt_9 = Text(item_5)

# ---- group: RC - Design Controls
num_11 = Number(shell_thickness_m)
num_12 = Number(cover_to_rebar_m)
num_13 = Number(concrete_compression_strength_fck)
num_14 = Number(concrete_tension_strength_factor_fctd)
num_15 = Number(rebar_yield_strength_fy)

# ----
bool_8 = Boolean(export_smesh_json)

crv = Curve()
crv_2 = Curve()

bool_9 = Boolean(bool_3)

X = UnitX(Factor="6")
swatch = ColourSwatch(SwatchColor=RGB(0, 0, 0))
swatch_2 = ColourSwatch(SwatchColor=RGB(0, 0, 0))
entwine_3 = Entwine(
    Branch00=ColourSwatch(SwatchColor=RGB(255, 255, 255)),
    Branch01=ColourSwatch(SwatchColor=RGB(255, 0, 0)),
    Branch02=ColourSwatch(SwatchColor=RGB(0, 128, 255)),
    FlattenInputs=True)
Z_2 = UnitZ(Factor="6")
Z_3 = UnitZ(Factor="6")
X_2 = UnitX(Factor="0")
panel_9 = Panel("4 to 0.5")
swatch_3 = ColourSwatch(SwatchColor=RGB(0, 0, 0))
panel_10 = Panel("2")

# ---- group: Principal Vectors - Tags
txt_10 = Text(txt_5)

txt_11 = Text(txt_5)

# ---- group: vector_tag
txt_12 = Text(txt_6)

# ---- group: Optional Colors
range_3 = Range(Domain=Domain(0, 1), Steps=10)
gradient_3 = Gradient(
    LowerLimit=0,
    UpperLimit=1,
    Parameter=range_3,
    stops=[0: RGB(255, 0, 0), 0.176: RGB(255, 238, 0), 0.35: RGB(0, 255, 234), 0.504: RGB(35, 4, 128), 0.664: RGB(0, 252, 215), 0.843: RGB(255, 255, 0), 1: RGB(255, 0, 47)])

# ----
panel_12 = Panel("""1
-1
0""")

# ---- group: Principal Vectors - Tags
txt_13 = Text(flatten(txt_5))

# ----
txt_14 = Text(flatten(txt))
bool_10 = Boolean(bool_6)
num_16 = Number(num_11)
num_17 = Number(num_12)
num_18 = Number(num_13)
num_19 = Number(num_15)
num_20 = Number(num_14)
panel_13 = Panel("True")

# ---- group: display
bool_11 = Boolean(bool)

# ---- group: mode
txt_15 = Text(txt_8)

# ---- group: data_tag
txt_16 = Text(txt_2)

# ---- group: vector_tag
txt_17 = Text(txt_9)

txt_18 = Text(txt_7)

# ---- group: Vector Scale
num_21 = Number(num_10)

# ---- group: vector_tag
txt_19 = Text(txt_7)

# ---- group: display
bool_12 = Boolean(bool_4)

bool_13 = Boolean(bool_5)

# ---- group: Vector Scale
num_22 = Number(num_8)

num_23 = Number(num_9)

# ---- group: display
bool_14 = Boolean(bool_2)

bool_15 = Boolean(bool_2)

# ----
panel_14 = Panel("0")

proximity_factor_to_others = Slider(0.05, range=0..1)
number_of_samples = Slider(20, range=0..500)
strat_factor = Slider(1, range=0..1)
proximity_at_start = Slider(0.8, range=0..1)
iterations = Slider(2000, range=0..10000)
proximity_to_itself = Slider(1, range=0..10)
int_15 = Integer(number_of_samples)
num_24 = Number(strat_factor)
num_25 = Number(proximity_factor_to_others)
num_26 = Number(iterations)
num_27 = Number(proximity_at_start)
num_28 = Number(proximity_to_itself)

uniform_spacing = BooleanToggle(False)
min_sp_m = Slider(0.5, range=0..1)
dl_2 = Slider(0.02, range=0..0.1)
min_length_2 = Slider(0.01, range=0..4)
num_29 = Number(dl_2)
num_30 = Number(min_length_2)
bool_16 = Boolean(uniform_spacing)
num_31 = Number(min_sp_m)

run_streamlines_jobard = BooleanToggle(False)
bool_17 = Boolean(run_streamlines_jobard)

run_streamlines_jobard_2 = BooleanToggle(False)
bool_18 = Boolean(run_streamlines_jobard_2)

uniform_spacing_2 = BooleanToggle(False)
min_sp_m_2 = Slider(0.5, range=0..1)
dl_3 = Slider(0.02, range=0..0.1)
min_length_3 = Slider(0.2, range=0..4)
num_32 = Number(min_length_3)
bool_19 = Boolean(uniform_spacing_2)
num_33 = Number(min_sp_m_2)
num_34 = Number(dl_3)

number_of_samples_2 = Slider(15, range=0..300)
proximity_at_start_2 = Slider(0.9, range=0..1)
strat_factor_2 = Slider(1, range=0..1)
proximity_factor_to_others_2 = Slider(0.05, range=0..1)
proximity_to_itself_2 = Slider(1, range=0..10)
iterations_2 = Slider(1000, range=0..10000)
int_16 = Integer(number_of_samples_2)
num_35 = Number(strat_factor_2)
num_36 = Number(proximity_factor_to_others_2)
num_37 = Number(proximity_at_start_2)
num_38 = Number(proximity_to_itself_2)
num_39 = Number(iterations_2)

percentage_of_max_demand_dir_1 = Slider(0.67, range=0..1)
percentage_of_max_demand_dir_2 = Slider(0.67, range=0..1)
bar_diameter_mm_dir_1 = Slider(18, range=0..30)
bar_diameter_mm_dir_2 = Slider(18, range=0..30)
max_spacing_dir_2 = Slider(0.4, range=0..1)
max_spacing_dir_1 = Slider(0.4, range=0..1)
merge_3 = Merge(Data1=bar_diameter_mm_dir_1, Data2=bar_diameter_mm_dir_2)
merge_4 = Merge(Data1=max_spacing_dir_1, Data2=max_spacing_dir_2)
merge_5 = Merge(Data1=percentage_of_max_demand_dir_1, Data2=percentage_of_max_demand_dir_2)
num_40 = Number(merge_4)
num_41 = Number(merge_5)
num_42 = Number(merge_3)

# ---- group: bar diameter
num_43 = Number(num_42)

# ---- group: max spacing
num_44 = Number(num_40)

# ---- group: % demand
num_45 = Number(num_41)

# ----
bool_20 = Boolean(bool_17)
txt_20 = Text(txt_3)
num_46 = Number(num_5)
num_47 = Number(num_29)
num_48 = Number(num_30)
txt_21 = Text(txt_6)
num_49 = Number(num_31)
bool_21 = Boolean(bool_16)
int_17 = Integer(int_15)
num_50 = Number(num_24)
num_51 = Number(num_25)
num_52 = Number(num_27)
num_53 = Number(num_28)
num_54 = Number(num_26)
num_55 = Number(num_32)
num_56 = Number(num_5)
num_57 = Number(num_37)
bool_22 = Boolean(bool_18)
num_58 = Number(num_34)
txt_22 = Text(txt_6)
txt_23 = Text(txt_4)
num_59 = Number(num_33)
bool_23 = Boolean(bool_19)
int_18 = Integer(int_16)
num_60 = Number(num_35)
num_61 = Number(num_36)
num_62 = Number(num_38)
num_63 = Number(num_39)
crv_3 = Curve()
crv_4 = Curve()
flatten = FlattenTree(Tree=crv_3, Path="{0}")
flatten_2 = FlattenTree(Tree=crv_4, Path="{0}")
eval = EvaluateCurve(Curve=reparameterize(flatten), Parameter="0.5")  # -> Point, Tangent, Angle
eval_2 = EvaluateCurve(Curve=reparameterize(flatten_2), Parameter="0.5")  # -> Point, Tangent, Angle

panel_15 = Panel("""1
-1
0""")
graft_3 = GraftTree(Tree=panel_15, IncludeEmptyLists=True, IncludeNullItems=True)
shellvecresults = ResultVectorsOnShellsKaramba(AnalyzedModel=model_3, mode="PrincForce")  # -> AnalyzedModel, Points, FirstPrincipalNormalForceVector_kN_m, SecondPrincipalNormalForceVector_kN_m, FirstPrincipalMomentVector_kN, SecondPrincipalMomentVector_kN, FirstPrincipalNormalForceValue_kN_m, SecondPrincipalNormalForceValue_kN_m, FirstPrincipalMomentValue_kN, SecondPrincipalMomentValue_kN
shellvecresults_2 = ResultVectorsOnShellsKaramba(AnalyzedModel=model_3, LayerOfResults=graft_3, mode="PrincStress")  # -> AnalyzedModel, Points, FirstPrincipalStressVector_kN_cm2, SecondPrincipalStressVector_kN_cm2, FirstPrincipalStressValue_kN_cm2, SecondPrincipalStressValue_kN_cm2
disassemble = DisassembleModelKaramba(Model=model_3)  # -> Model, Point, Beam, Shell, Support, Load, Line, Mesh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

vec_5 = Vector(shellvecresults_2.SecondPrincipalStressVector_kN_cm2)
vec_6 = Vector(shellvecresults_2.FirstPrincipalStressVector_kN_cm2)

vec_7 = Vector(shellvecresults.SecondPrincipalNormalForceVector_kN_m)
vec_8 = Vector(shellvecresults.FirstPrincipalNormalForceVector_kN_m)

vec_9 = Vector(shellvecresults.FirstPrincipalMomentVector_kN)
vec_10 = Vector(shellvecresults.SecondPrincipalMomentVector_kN)

vec_11 = Vector(vec_7)
vec_12 = Vector(vec_8)
vec_13 = Vector(vec_9)
vec_14 = Vector(vec_10)
vec_15 = Vector(vec_6)
vec_16 = Vector(vec_5)

path_mapper = PathMapper(vec_16, source="{A;B}", target="{A;B+7}")
path_mapper_2 = PathMapper(vec_15, source="{A;B}", target="{A;B+4}")
entwine_4 = Entwine(Branch00=vec_12, Branch01=vec_11, Branch02=vec_13, Branch03=vec_14, FlattenInputs=True)  # -> simplify(Result)
merge_6 = Merge(Data1=entwine_4, Data2=simplify(path_mapper_2), Data3=simplify(path_mapper))

mesh_8 = Mesh(disassemble.Mesh)

# ---- group: Vector Fields
vec_17 = Vector(merge_6)

# ----
vec_18 = Vector(vec_17)
mesh_9 = Mesh(mesh_8)

cluster = Cluster(mesh=mesh_9, vec=vec_4)  # -> vec_6, vec_5
entwine_5 = Entwine(Branch00=cluster.vec_6, Branch01=cluster.vec_5, FlattenInputs=True)  # -> simplify(Result)
path_mapper_3 = PathMapper(entwine_5, source="{A}", target="{A+10}")
merge_7 = Merge(Data1=vec_18, Data2=simplify(path_mapper_3))

vec_19 = Vector(merge_7)
mesh_10 = Mesh(mesh_9)
model_5 = ModelKaramba(model)

mesh_11 = Mesh(mesh_10)
vec_20 = Vector(vec_19)
model_6 = ModelKaramba(model_5)

mesh_12 = Mesh(mesh_11)
vec_21 = Vector(vec_20)
model_7 = ModelKaramba(model_6)

# ---- group: Principal Vectors
vec_22 = Vector(vec_21)

vec_23 = Vector(vec_21)

# ----
mesh_13 = Mesh(mesh_12)
bool_24 = Boolean(bool_7)

mesh_14 = Mesh(mesh_12)
bool_25 = Boolean(bool_8)

python = GhPythonScript(run=bool_24, mesh=mesh_13, vectors=vec_22, vectors_tags=txt_10)  # -> out, s_mesh; inputs mesh: Mesh, vectors: tree of Vector3d, vectors_tags: tree
# ---------- python: Python ----------
__author__ = "Rafael Pastrana"
__name__ = "Mesh Maker"
__date__ = "2018.07.19"
__version__ = "0.0.1"


# 1. Import dependencies
import sys
import imp
import rhinoscriptsyntax as rs

# 1-b. Replace with your own path here
sys.path.append("Z:\code\libraries\streamlines\src\streamlines")

import custom_mesh
imp.reload(custom_mesh)

from custom_mesh import StructuralMesh
from compas.datastructures import Mesh
from compas_rhino.helpers import mesh_from_guid

# Define Global Variables
NORM = False

# 2. Start System
if run is True:
    print('SYSTEM STARTED')
        
    # instantiate mesh
    mesh = mesh_from_guid(Mesh, mesh)
    my_mesh = StructuralMesh(mesh)
    compas_mesh = Mesh()

    # set vector attributes
    for idx, vector_field in enumerate(vectors.Branches):
        tag = vectors_tags.Branches[idx][0]
        clean_vectors = [[vec.X, vec.Y, vec.Z] for vec in vector_field]
        my_mesh.set_face_vectors(clean_vectors, tag, NORM)
        # my_mesh.set_vertex_vectors(tag)
        my_mesh.set_vertex_vectors_angles(tag)
    
    # output mesh
    s_mesh = my_mesh
# ---------- end python ----------
wbedges = WeaverbirdsMeshEdges(MeshOrPolylines=mesh_13)
wbedges_2 = WeaverbirdsMeshEdges(MeshOrPolylines=mesh_14)
python_2 = GhPythonScript(
    run=bool_25,
    mesh=mesh_14,
    vectors=vec_23,
    vectors_tags=txt_11,
    filepath="Z:\code\libraries\streamlines\examples\knitcandela.json")  # -> out, s_mesh; inputs mesh: Mesh, vectors: tree of Vector3d, vectors_tags: tree
# ---------- python_2: Python ----------
__author__ = "Rafael Pastrana"
__name__ = "Mesh Maker"
__date__ = "2018.07.19"
__version__ = "0.0.1"


# 1. Import dependencies
import sys
import imp
import rhinoscriptsyntax as rs

# 1-b. Replace with your own path here
sys.path.append("Z:\code\libraries\streamlines\src\streamlines")

import custom_mesh
imp.reload(custom_mesh)

from custom_mesh import StructuralMesh
from compas.datastructures import Mesh
from compas_rhino.helpers import mesh_from_guid

# Define Global Variables
NORM = False

# 2. Start System
if run is True:
    print('SYSTEM STARTED')
        
    # instantiate mesh
    compas_mesh = mesh_from_guid(Mesh, mesh)

    # set vector attributes
    for idx, vector_field in enumerate(vectors.Branches):
        tag = vectors_tags.Branches[idx][0]
        clean_vectors = [[vec.X, vec.Y, vec.Z] for vec in vector_field]
        # my_mesh.set_face_vectors(clean_vectors, tag, NORM)
        # my_mesh.set_vertex_vectors(tag)
        # my_mesh.set_vertex_vectors_angles(tag)
        help(compas_mesh.set_face_attribute)
        
        for jdx, vector in enumerate(clean_vectors):
            compas_mesh.set_face_attribute(jdx, tag, vector)
        # compas_mesh.set_faces_attributes(tag, clean_vectors)
        
    
    # output mesh
    
    compas_mesh.dump(filepath)
# ---------- end python_2 ----------
lng = ListLength(List=wbedges)
lng_2 = ListLength(List=wbedges_2)
data = Data(python.s_mesh)
data_2 = Data(python_2.s_mesh)
panel_16 = Panel(lng)
panel_17 = Panel(lng_2)

# ---- group: s_mesh
data_3 = Data(data)

# ----
python_3 = GhPythonScript(s_mesh=data_3, vector_tag=txt_12)  # -> out, s_mesh, vector_field
# ---------- python_3: Python ----------
# 1. Import dependencies
import rhinoscriptsyntax as rs
import copy

print('number of edges is: {}'.format(len([e for e in s_mesh.c_mesh.edges()])))

# 2. Start System
my_mesh = s_mesh
v_name = vector_tag

# vector properties
vector_field = [x[0] for x in my_mesh.find_vector_face_centers(v_name)]
vector_field = [rs.CreateVector(x) for x in vector_field]
s_mesh = my_mesh
# ---------- end python_3 ----------
vec_24 = Vector(python_3.vector_field)
model_8 = ModelKaramba(model_7)
vec_25 = Vector(vec_24)

disassemble_2 = DisassembleModelKaramba(Model=model_8)  # -> Model, Point, Beam, Shell, Support, Load, Line, Mesh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
orientate_2 = OrientateElemKaramba(Shell=disassemble_2.Shell, XOrientations=unitize(vec_25), mode="Shell")
assemble_2 = AssembleModelKaramba(
    Points=disassemble_2.Point,
    Elem=orientate_2,
    Support=disassemble_2.Support,
    Load=disassemble_2.Load,
    LimitDistance_m=0.005)  # -> Model, Info, Mass_kg, CenterOfGravity
analyzethi_2 = AnalyzeThIKaramba(Model=assemble_2.Model)  # -> CalculatedModel, MaximumDisplacement_m, ResultingForceOfGravity_kN, ElasticEnergy_kNm

model_9 = ModelKaramba(analyzethi_2.CalculatedModel)

model_10 = ModelKaramba(model_9)
modelview_2 = ModelViewKaramba(Model=model_10, LoadCaseFactorsForLinearSuperposition=1, IndexOfVisibleLoadcase=-1)  # -> Model, DeformedMesh, DeformedAxes, DeformedModel
shellview_2 = ShellViewKaramba(Model=modelview_2.Model, IndexOfLayer=0)  # -> Model, MeshesOfRenderedShells, LegendColors, LegendTags
legend_2 = Legend(Colour=shellview_2.LegendColors, Tags=shellview_2.LegendTags, LegendType=1)

model_11 = ModelKaramba(model_9)
modelview_3 = ModelViewKaramba(
    Model=model_11,
    LoadCaseFactorsForLinearSuperposition=1,
    IndexOfVisibleLoadcase=-1,
    ListOfColorsForColoringPlots=gradient_3)  # -> Model, DeformedMesh, DeformedAxes, DeformedModel
shellview_3 = ShellViewKaramba(Model=modelview_3.Model, IndexOfLayer=0)  # -> Model, MeshesOfRenderedShells, LegendColors, LegendTags
legend_3 = Legend(Colour=shellview_3.LegendColors, Tags=shellview_3.LegendTags, LegendType=1)

panel_18 = Panel(analyzethi_2.MaximumDisplacement_m)
model_12 = ModelKaramba(model_9)

graft_4 = GraftTree(Tree=panel_12, IncludeEmptyLists=True, IncludeNullItems=True)
shellvecresults_3 = ResultVectorsOnShellsKaramba(AnalyzedModel=model_12, LayerOfResults=graft_4, mode="PrincStress")  # -> AnalyzedModel, Points, FirstPrincipalStressVector_kN_cm2, SecondPrincipalStressVector_kN_cm2, FirstPrincipalStressValue_kN_cm2, SecondPrincipalStressValue_kN_cm2
shellvecresults_4 = ResultVectorsOnShellsKaramba(AnalyzedModel=model_12, mode="PrincForce")  # -> AnalyzedModel, Points, FirstPrincipalNormalForceVector_kN_m, SecondPrincipalNormalForceVector_kN_m, FirstPrincipalMomentVector_kN, SecondPrincipalMomentVector_kN, FirstPrincipalNormalForceValue_kN_m, SecondPrincipalNormalForceValue_kN_m, FirstPrincipalMomentValue_kN, SecondPrincipalMomentValue_kN
path_mapper_4 = PathMapper(shellvecresults_3.SecondPrincipalStressValue_kN_cm2, source="{A;B}", target="{A;B+7}")
path_mapper_5 = PathMapper(shellvecresults_3.FirstPrincipalStressValue_kN_cm2, source="{A;B}", target="{A;B+4}")
entwine_6 = Entwine(
    Branch00=shellvecresults_4.FirstPrincipalNormalForceValue_kN_m,
    Branch01=shellvecresults_4.SecondPrincipalNormalForceValue_kN_m,
    Branch02=shellvecresults_4.FirstPrincipalMomentValue_kN,
    Branch03=shellvecresults_4.SecondPrincipalMomentValue_kN,
    FlattenInputs=True)  # -> simplify(Result)
merge_8 = Merge(Data1=entwine_6, Data2=simplify(path_mapper_5), Data3=simplify(path_mapper_4))

s_forces = ShellForcesKaramba(AnalyzedModel=model_12, LCase=0, mode="Local")  # -> AnalyzedModel, Nxx_kN_m, Nyy_kN_m, Nxy_kN_m, Mxx_kN, Myy_kN, Mxy_kN, Vx_kN_m, Vy_kN_m
graft_5 = GraftTree(Tree=s_forces.Nxx_kN_m, IncludeEmptyLists=True, IncludeNullItems=True)  # -> simplify(Tree)
graft_6 = GraftTree(Tree=s_forces.Nyy_kN_m, IncludeEmptyLists=True, IncludeNullItems=True)  # -> simplify(Tree)
graft_7 = GraftTree(Tree=s_forces.Nxy_kN_m, IncludeEmptyLists=True, IncludeNullItems=True)  # -> simplify(Tree)
graft_8 = GraftTree(Tree=s_forces.Mxx_kN, IncludeEmptyLists=True, IncludeNullItems=True)  # -> simplify(Tree)
graft_9 = GraftTree(Tree=s_forces.Myy_kN, IncludeEmptyLists=True, IncludeNullItems=True)  # -> simplify(Tree)
graft_10 = GraftTree(Tree=s_forces.Mxy_kN, IncludeEmptyLists=True, IncludeNullItems=True)  # -> simplify(Tree)
graft_11 = GraftTree(Tree=s_forces.Vx_kN_m, IncludeEmptyLists=True, IncludeNullItems=True)  # -> simplify(Tree)
graft_12 = GraftTree(Tree=s_forces.Vy_kN_m, IncludeEmptyLists=True, IncludeNullItems=True)  # -> simplify(Tree)
merge_9 = Merge(
    Data1=graft_5,
    Data2=graft_6,
    Data3=graft_7,
    Data4=graft_8,
    Data5=graft_9,
    Data6=graft_10,
    Data7=graft_11,
    Data8=graft_12)
flip = FlipMatrix(Data=merge_9)

num_64 = Number(merge_8)
num_65 = Number(flip)

txt_24 = Text(flatten(txt))
data_4 = Data(data)

num_66 = Number(num_65)

# ---- group: Assign Local Internal Forces to sMesh
python_4 = GhPythonScript(s_mesh=data_4, int_forces=num_66, force_tags=txt_24)  # -> out, s_mesh; inputs int_forces: tree, force_tags: list
# ---------- python_4: Python ----------
__author__ = "Rafael Pastrana"
__name__ = "Mesh Maker"
__date__ = "2018.07.19"
__version__ = "0.0.1"


# 1. Import dependencies
import rhinoscriptsyntax as rs
import copy

# 2. Start System
# set vector attributes
my_mesh = s_mesh


for idx, int_force in enumerate(int_forces.Branches):
    tag = force_tags[idx]
    
    for f_key in my_mesh.c_mesh.faces():
        force = int_force[f_key]
        if force == 0:
            force = 1e-7
            
        my_mesh.c_mesh.set_face_attribute(f_key, str(tag), force)

s_mesh = my_mesh
# ---------- end python_4 ----------

# ----
data_5 = Data(python_4.s_mesh)
data_6 = Data(data_5)
num_67 = Number(num_64)

# ---- group: Assign Principal Internal Forces to sMesh
python_5 = GhPythonScript(s_mesh=data_6, int_forces=num_67, force_tags=txt_13)  # -> out, s_mesh; inputs int_forces: tree, force_tags: list
# ---------- python_5: Python ----------
__author__ = "Rafael Pastrana"
__name__ = "Mesh Maker"
__date__ = "2018.07.19"
__version__ = "0.0.1"


# 1. Import dependencies
import rhinoscriptsyntax as rs
import copy

TAG = '_val'
my_mesh = s_mesh

# 2. Start System
# set vector attributes
for idx, int_force in enumerate(int_forces.Branches):
    f_tag = force_tags[idx] + TAG
    
    for f_key in my_mesh.c_mesh.faces():
        force = int_force[f_key]
        if force == 0:
            force = 1e-7
        my_mesh.c_mesh.set_face_attribute(f_key, str(f_tag), force)

s_mesh = my_mesh
# ---------- end python_5 ----------

# ----
data_7 = Data(python_5.s_mesh)
data_8 = Data(data_7)

panel_19 = Panel("""bottom layer
top layer
center layer
total """)
panel_20 = Panel("""asx_b
asx_t
asy_b
asy_t
asx_c
asy_c""")

entwine_7 = Entwine(
    Branch00=ColourSwatch(SwatchColor=RGB(0, 124, 247)),
    Branch01=ColourSwatch(SwatchColor=RGB(1, 35, 97)),
    Branch02=ColourSwatch(SwatchColor=RGB(1, 97, 92)),
    FlattenInputs=True)

X_3 = UnitX(Factor="6")

X_4 = UnitX(Factor="6")

entwine_8 = Entwine(
    Branch00=ColourSwatch(SwatchColor=RGB(227, 9, 118)),
    Branch01=ColourSwatch(SwatchColor=RGB(214, 204, 4)),
    FlattenInputs=True)

# ---- group: Make RC Design
python_6 = GhPythonScript(run=bool_10, s_mesh=data_8, heights=num_16, covers=num_17, fck=num_18, fy=num_19, fctd_factor=num_20, force_tags=txt_14)  # -> out, s_mesh, asxb, asxt, asyb, asyt, asxc, asyc, ast; inputs run: Boolean, force_tags: list
# ---------- python_6: Python ----------
"""NOTE 18.08.01: Bottom and Top were inverted for compatibility"""

__author__ = "Rafael Pastrana"
__name__ = "Sandwich"
__date__ = "2018.08.01"
__version__ = "0.0.2"

# 1. Import dependencies
import sys
import imp
import rhinoscriptsyntax as rs

# 1-b. Replace with your own path here
sys.path.append("Z:\projects\streamlines\src\streamlines")

import materials
import basic_sandwich

imp.reload(materials)
imp.reload(basic_sandwich)

from basic_sandwich import ReinforcedShell
from materials import Concrete
from materials import Rebar


# 2. Create Input Material Data
myConcrete = Concrete(fck)
myRebar = Rebar(fy)
#myConcrete.printSummary()

# 3. Perform Reinforcement Design
my_mesh = s_mesh

asxb = []
asyb = []
asxt = []
asyt = []
asxc = []
asyc = []

ast = []
shells = []

if run is True:
    for idx, f_key in enumerate(s_mesh.c_mesh.faces()):
        forces = s_mesh.c_mesh.get_face_attributes(f_key, force_tags)
        myForces = {str(a): b for a, b in zip(force_tags, forces)}
        
        myShell = ReinforcedShell(idx, myConcrete, myRebar, heights, covers)
        myShell.tcred = myShell.concrete.fctd * fctd_factor
        
        # 4. Perform Reinforcement Design Routine
        myShell.applyForces(**myForces)
        
        # new version 25.08.18
        myShell.get_membrane_forces()
        myShell.get_reinforcement_forces()
        myShell.design_reinforcement()
        
        # 5. Append Results to Output Lists. Bottom and top were inverted
        shells.append(myShell)
        
        asxb.append(myShell.asxt)
        asyb.append(myShell.asyt)
        
        asxt.append(myShell.asxb)
        asyt.append(myShell.asyb)
        
        asxc.append(myShell.asxc)
        asyc.append(myShell.asyc)
        
        ast.append(myShell.ast)
        
        # 6. Set Face Attributes. Bottom and top were inverted
        my_mesh.c_mesh.set_face_attribute(f_key, 'asx_b', myShell.asxt)
        my_mesh.c_mesh.set_face_attribute(f_key, 'asx_t', myShell.asxb)
        my_mesh.c_mesh.set_face_attribute(f_key, 'asy_b', myShell.asyt)
        my_mesh.c_mesh.set_face_attribute(f_key, 'asy_t', myShell.asyb)
        
        my_mesh.c_mesh.set_face_attribute(f_key, 'asx_c', myShell.asxc)
        my_mesh.c_mesh.set_face_attribute(f_key, 'asy_c', myShell.asyc)
        
        my_mesh.c_mesh.set_face_attribute(f_key, 'asx_', (myShell.asxc + myShell.asxt + myShell.asxb))
        my_mesh.c_mesh.set_face_attribute(f_key, 'asy_', (myShell.asyc + myShell.asyt + myShell.asyb))
    
        
    # 6. Retrieve Statistics
    print("# of Elements with Crushed Core: {}".format(len([shell for shell in shells if shell.coreCrush == True])))
    print("# of Elements with Crushed Top Cover: {}".format(len([shell for shell in shells if shell.tsupCrush == True])))
    print("# of Elements with Crushed Bottom Cover: {}".format(len([shell for shell in shells if shell.tinfCrush == True])))
    print("----------------------------------")
    print("Shear Force Vo in Crushed Core Elements: {}".format([shell.vo for shell in shells if shell.coreCrush == True]))
    print("----------------------------------")
# ---------- end python_6 ----------

num_68 = Number(python_6.asyt)
num_69 = Number(python_6.ast)
num_70 = Number(python_6.asyb)
num_71 = Number(python_6.asxb)
num_72 = Number(python_6.asxt)

# ----
num_73 = Number(python_6.asxc)
num_74 = Number(python_6.asyc)
num_75 = Number(num_73)
num_76 = Number(num_74)

# ---- group: Make RC Design (continued)
num_77 = Number(num_71)
num_78 = Number(num_72)
num_79 = Number(num_70)
num_80 = Number(num_68)
entwine_9 = Entwine(Branch00=num_77, Branch01=num_78, Branch02=num_79, Branch03=num_80, Branch04=num_75, Branch05=num_76, FlattenInputs=True)

# ----
entwine_10 = Entwine(Branch00=num_77, Branch01=num_78, Branch02=num_79, Branch03=num_80, FlattenInputs=True)

data_9 = Data(python_6.out)
num_81 = Number(entwine_9)

data_10 = Data(python_6.s_mesh)
num_82 = Number(entwine_10)

# ---- group: s_mesh
data_11 = Data(data_10)

# ----
python_7 = GhPythonScript(s_mesh=data_11, diam=num_43, max_sp=num_44)  # -> out, s_mesh, sp_asx, sp_asy; inputs diam: list, max_sp: list
# ---------- python_7: Python ----------
# 1. Import dependencies
import rhinoscriptsyntax as rs
import Rhino.Geometry as rg
import math


# 1-b. Define Globals
TAG = 'spacing_'
TOL = 1e-6
AS_TAGS = ['asx_', 'asy_']
my_mesh = s_mesh

# 1-c. Define Functions

def get_bar_area(diameter):
    return math.pi * math.pow((diameter / 10), 2) / 4

def steel_area_to_spacing(steel_areas, diameter, max):
    spacings = []
    bar_area = get_bar_area(diameter)
    
    for s_area in steel_areas:
        if s_area < TOL:
            s_area = TOL
        spacing = s_area / bar_area
        spacing = 1 / spacing
        
        if spacing > max:
            spacing = max
        spacings.append(spacing)
    return spacings

# 2. Set Data
for f_key in my_mesh.c_mesh.faces():
    for as_tag in AS_TAGS:
        steel_area = my_mesh.c_mesh.get_face_attribute(f_key, as_tag)
        if as_tag[2] == 'x':
            sp = steel_area_to_spacing([steel_area], diam[0], max_sp[0])[0]
            my_mesh.c_mesh.set_face_attribute(f_key, TAG+as_tag, sp)
            my_mesh.c_mesh.set_face_attribute(f_key, 'bar_diameter_x', diam[0])
            
        elif as_tag[2] == 'y':
            sp = steel_area_to_spacing([steel_area], diam[1], max_sp[1])[0]
            my_mesh.c_mesh.set_face_attribute(f_key, TAG+as_tag, sp)
            my_mesh.c_mesh.set_face_attribute(f_key, 'bar_diameter_y', diam[1])
            
# 3. Get Data

s_mesh = my_mesh
keys = [f_key for f_key in my_mesh.c_mesh.faces()]

sp_asx_ = my_mesh.c_mesh.get_faces_attribute(keys, TAG+AS_TAGS[0])
sp_asy_ = my_mesh.c_mesh.get_faces_attribute(keys, TAG+AS_TAGS[1])

t_sp_asx_ = sorted(sp_asx_)
t_sp_asy_ = sorted(sp_asy_)

print('Spacings for ASX_ min is {0}. max is {1}'.format(t_sp_asx_[0], t_sp_asx_[-1]))
print('Spacings for ASY_ min is {0}. max is {1}'.format(t_sp_asy_[0], t_sp_asy_[-1]))
# ---------- end python_7 ----------
data_12 = Data(python_7.out)
num_83 = Number(python_7.sp_asx)
num_84 = Number(python_7.sp_asy)
data_13 = Data(python_7.s_mesh)

# ---- group: s_mesh
data_14 = Data(data_13)

# ----
python_8 = GhPythonScript(s_mesh=data_14, perc=num_45)  # -> out, s_mesh, face_centers, seeds_x, seeds_y; inputs perc: list
# ---------- python_8: Python ----------
# 1. Import dependencies
import rhinoscriptsyntax as rs
import Rhino.Geometry as rg
import math


# 1-b. Define Globals
my_mesh = s_mesh
TAG = 'spacing_'
TOL = 1e-6
AS_TAGS = ['asx_', 'asy_']
seeds_x = []
seeds_y = []
face_centers = []

# 1-c. Define Functions

# 2. Set and Get Data
as_dir_1 = TAG + AS_TAGS[0]
as_dir_2 = TAG + AS_TAGS[1]
keys = [f_key for f_key in my_mesh.c_mesh.faces()]

max_dir_1 = sorted(my_mesh.c_mesh.get_faces_attribute(keys, as_dir_1))[-1]
max_dir_2 = sorted(my_mesh.c_mesh.get_faces_attribute(keys, as_dir_2))[-1]
print('Max AS in dir X is {} cm2/m. In dir Y is {} cm2/m'.format(max_dir_1, max_dir_2))

for f_key in my_mesh.c_mesh.faces():
    my_as_dir_1 = my_mesh.c_mesh.get_face_attribute(f_key, as_dir_1)
    my_as_dir_2 = my_mesh.c_mesh.get_face_attribute(f_key, as_dir_2)
    pt = rg.Point3d(*my_mesh.c_mesh.face_centroid(f_key))
    
    face_centers.append(pt)
    if my_as_dir_1 <= max_dir_1 * perc[0]:
        seeds_x.append((pt, my_as_dir_1))
    if my_as_dir_2 <= max_dir_2 * perc[1]:
        seeds_y.append((pt, my_as_dir_2))

s_mesh = my_mesh
seeds_x = [seed[0] for seed in sorted(seeds_x, key=lambda x: x[1])]
seeds_y = [seed[0] for seed in sorted(seeds_y, key=lambda x: x[1])]

print('Number of Seeds in X direction is {}'.format(len(seeds_x)))
print('Number of Seeds in Y direction is {}'.format(len(seeds_y)))
# ---------- end python_8 ----------
pt_4 = Point(python_8.seeds_y)

# ---- group: seeds Y
pt_5 = Point(pt_4)

# ----
pt_6 = Point(python_8.seeds_x)

# ---- group: seeds X
pt_7 = Point(pt_6)

# ----
entwine_11 = Entwine(Branch00=pt_7, Branch01=pt_5, FlattenInputs=True)
filter = StreamFilter(Gate=bool_9, Stream1=entwine_11)
dots = DotDisplay(Point=filter, Colour=entwine_8, Size="0.01")

data_15 = Data(python_8.out)
data_16 = Data(python_8.s_mesh)  # disabled
pt_8 = Point(python_8.face_centers)  # disabled

# ---- group: s_mesh
data_17 = Data(data_13)

data_18 = Data(data_13)

data_19 = Data(data_13)

data_20 = Data(data_13)

# ----
python_9 = GhPythonScript(show=bool_14, s_mesh=data_18, vector_tag=txt_17, v_scale=num_23)  # -> out, s_mesh, line_field, node_line_field, centers_line_field, colors_line_field, colors_node_line_field, colors_centers_line_field, vectors_a, vectors_b; inputs show: Boolean
# ---------- python_9: Python ----------
"""Retrieves data from a Structural Mesh object"""

__author__ = "Rafael Pastrana"
__name__ = "Mesh Displayer"
__date__ = "2018.07.24"
__version__ = "0.0.1"


# 1. Import dependencies
import imp
import rhinoscriptsyntax as rs
import sys
sys.path.append("Z:\projects\streamlines\src\streamlines")
import display
imp.reload(display)
from display import Display
import compas.geometry as cg

dsp = Display()

# 2. Start System
my_mesh = s_mesh
v_name = vector_tag
TAG = '_val'

if show is True:
    # vector properties
    line_field = dsp.draw_face_vectors(my_mesh, v_name, v_scale)
    node_line_field = dsp.draw_node_vectors(my_mesh, v_name, v_scale)
    center_vectors = my_mesh.find_vector_face_centers(v_name)
    centers = list(map(lambda x: my_mesh.c_mesh.face_centroid(x), my_mesh.c_mesh.faces()))
    centers_line_field = dsp.draw_vectors(centers, center_vectors, v_scale)
        
    f_color = []
    for f_key in my_mesh.c_mesh.faces():
        val = my_mesh.c_mesh.get_face_attribute(f_key, v_name+TAG)
        if val:
            if val < 0:
                f_color.append(rs.CreateColor(255,0,0))
            else:
                f_color.append(rs.CreateColor(0,0,255))
        else:
            f_color.append(rs.CreateColor(0,0,255))
            
    n_color = []
    for v_key in my_mesh.c_mesh.vertices():
        val = my_mesh.c_mesh.get_vertex_attribute(v_key, v_name+TAG)
        if val < 0:
            n_color.append(rs.CreateColor(0,0,0))
        else:
            n_color.append(rs.CreateColor(0,0,0))
    
    colors_line_field = f_color
    colors_node_line_field = n_color
    colors_centers_line_field = f_color
    
    vectors_a = list(map(lambda x: my_mesh.c_mesh.get_vertex_attribute(x,v_name+'_a'), my_mesh.c_mesh.vertices()))
    vectors_a = list(map(lambda x: rs.CreateVector(*x), vectors_a))
    
    vectors_b = list(map(lambda x: my_mesh.c_mesh.get_vertex_attribute(x,v_name+'_b'), my_mesh.c_mesh.vertices()))
    vectors_b = list(map(lambda x: rs.CreateVector(*x), vectors_b))
# ---------- end python_9 ----------
python_10 = GhPythonScript(show=bool_15, s_mesh=data_19, vector_tag=txt_19, v_scale=num_22)  # -> out, s_mesh, line_field, node_line_field, centers_line_field, colors_line_field, colors_node_line_field, colors_centers_line_field, vectors_a, vectors_b; inputs show: Boolean; same code as python_9
python_11 = GhPythonScript(show=bool_11, s_mesh=data_17, data_tag=txt_16, mode=txt_15)  # -> out, s_mesh, display_mesh, color_data, data_values; inputs show: Boolean
# ---------- python_11: Python ----------
"""Retrieves data from a Structural Mesh object"""

__author__ = "Rafael Pastrana"
__name__ = "Mesh Displayer"
__date__ = "2018.07.24"
__version__ = "0.0.1"


# 1. Import dependencies
import imp
import copy
import rhinoscriptsyntax as rs
import sys
sys.path.append("Z:\Dropbox\Documentos\ETH Zuerich\ETH MAS Thesis\code\current")

import Display
imp.reload(Display)
from Display import Display

dsp = Display()
my_mesh = s_mesh

# 2. Start System
if show is True:
    display_mesh = my_mesh.gh_mesh
    color_data = None
    data_values = my_mesh.get_data_on_nodes(data_tag, mode)
    # display_mesh, data_values, color_data = dsp.plot_mesh(my_mesh, data_tag, mode)
# ---------- end python_11 ----------
data_21 = Data(python_11.s_mesh)
python_12 = GhPythonScript(s_mesh=data_20, steel_density="7.85")  # -> out, steel_mass, mass_bot, mass_top, mass_center
# ---------- python_12: Python ----------
"""Retrieves data from a Structural Mesh object"""

__author__ = "Rafael Pastrana"
__name__ = "Steel Mass Calculator"
__date__ = "2018.08.02"
__version__ = "0.0.1"


# 1. Import dependencies
import rhinoscriptsyntax as rs

# 2. Define Globals
DENSITY = steel_density  # kg/cm3
TOL = 1e-6
AS_TAGS = ['asx_b', 'asx_t', 'asy_b', 'asy_t', 'asx_c', 'asy_c']

# 3. Start System
my_mesh = s_mesh
face_areas = list(map(lambda x: my_mesh.c_mesh.face_area(x), my_mesh.c_mesh.faces()))

# 4. Get Mass at Bottom Layer
m_asx_b = list(map(lambda x: DENSITY * my_mesh.c_mesh.get_face_attribute(x,AS_TAGS[0]), my_mesh.c_mesh.faces()))
m_asy_b = list(map(lambda x: DENSITY * my_mesh.c_mesh.get_face_attribute(x,AS_TAGS[2]), my_mesh.c_mesh.faces()))

m_asx_t = list(map(lambda x: DENSITY * my_mesh.c_mesh.get_face_attribute(x,AS_TAGS[1]), my_mesh.c_mesh.faces()))
m_asy_t = list(map(lambda x: DENSITY * my_mesh.c_mesh.get_face_attribute(x,AS_TAGS[3]), my_mesh.c_mesh.faces()))

m_asx_c = list(map(lambda x: DENSITY * my_mesh.c_mesh.get_face_attribute(x,AS_TAGS[4]), my_mesh.c_mesh.faces()))
m_asy_c = list(map(lambda x: DENSITY * my_mesh.c_mesh.get_face_attribute(x,AS_TAGS[5]), my_mesh.c_mesh.faces()))

mass_bot = reduce(lambda x, y: x+y, [sum(x)*face_areas[idx] for idx, x in enumerate(zip(m_asx_b, m_asy_b))])
mass_top = reduce(lambda x, y: x+y, [sum(x)*face_areas[idx] for idx, x in enumerate(zip(m_asx_t, m_asy_t))])
mass_center = reduce(lambda x, y: x+y, [sum(x)*face_areas[idx] for idx, x in enumerate(zip(m_asx_c, m_asy_c))])

steel_mass = mass_bot + mass_top + mass_center
# ---------- end python_12 ----------
python_13 = GhPythonScript(x=data_21)  # -> out, a
# ---------- python_13: Python ----------
__author__ = "ARPJ"
__version__ = "2018.08.01"

import rhinoscriptsyntax as rs

print('number of edges is: {}'.format(len([e for e in x.c_mesh.edges()])))
# ---------- end python_13 ----------
num_85 = Number(python_12.steel_mass)
num_86 = Number(python_12.mass_bot)
num_87 = Number(python_12.mass_top)
num_88 = Number(python_12.mass_center)
num_89 = Number(num_88)

num_90 = Number(num_85)
num_91 = Number(num_86)
num_92 = Number(num_87)
data_22 = Data(data_12)
data_23 = Data(data_15)
num_93 = Number(num_81)
data_24 = Data(data_9)
entwine_12 = Entwine(Branch00=num_91, Branch01=num_92, Branch02=num_89, Branch03=num_90, FlattenInputs=True)
num_94 = Number(num_81)
bnd = Bounds(Numbers=num_93)
sort = SortList(Keys=num_94)  # -> Keys, ValuesA
concat = Concatenate(FragmentA=graft(panel_20), FragmentB="domain is:", FragmentC=bnd, JoinSeparator=" ")
concat_2 = Concatenate(FragmentA=graft(panel_19), FragmentB="mass is:", FragmentC=entwine_12, FragmentD="kg", JoinSeparator=" ")
panel_21 = Panel(data_22)
panel_22 = Panel(data_23)
panel_23 = Panel(data_24)
reinforcement_areas_domain_cm2_m = Panel(concat)
graph = QuickGraph(sort.Keys, SortOrder=0)
reinforcement_areas_domain_cm2_m_2 = Panel(concat_2)

panel_24 = Panel(python_13.out)
num_95 = Number(python_11.data_values)
mesh_15 = Mesh(python_11.display_mesh)
mesh_16 = Mesh(mesh_15)
wbnaked = WeaverbirdsNakedBoundary(MeshClosedPolylines=mesh_16)

entwine_13 = Entwine(Branch00=wbnaked, Branch01=crv, Branch02=crv_2, FlattenInputs=True)
previewlw = CustomPreviewLineweights(Geometry=entwine_13, Shader=entwine_7, Thickness="4", Absolute=False)

col = Colour(python_11.color_data)
line = Line(python_9.centers_line_field)
line_2 = Line(python_9.line_field)
col_2 = Colour(python_9.colors_line_field)
col_3 = Colour(python_9.colors_centers_line_field)
vec_26 = Vector(python_9.vectors_a)
line_3 = Line(python_10.line_field)
line_4 = Line(python_10.centers_line_field)
col_4 = Colour(python_10.colors_line_field)
col_5 = Colour(python_10.colors_centers_line_field)
vec_27 = Vector(python_10.vectors_a)
vec_28 = Vector(python_9.vectors_b)
vec_29 = Vector(python_10.vectors_b)
line_5 = Line(python_9.node_line_field)

line_6 = Line(line_2)
line_7 = Line(line_5)
line_8 = Line(line)

line_9 = Line(flatten(line_7))
line_10 = Line(line_9)
end = EndPoints(Curve=graft(line_10))  # -> Start, End
vec2pt = Vector2Pt(PointA=end.Start, PointB=end.End, Unitize=False)  # -> flatten(Vector), Length
evaluate_curve = EvaluateCurve(Curve=graft(line_10), Parameter=0.5)  # -> Point, Tangent, Angle
vec2pt_2 = Vector2Pt(PointA=end.Start, PointB=end.End, Unitize="True")  # -> Vector, Length
vlen = VectorLength(Vector=vec2pt.Vector)
multiplication_3 = Multiplication(A=vec2pt_2.Vector, B=Slider(0.04, range=0..0.1))
reverse = Reverse(Vector=multiplication_3)
bnd_2 = Bounds(Numbers=vlen)
remap = RemapNumbers(Value=vlen, Source=bnd_2, Target=Domain(0, 1))  # -> Mapped, Clipped
move = Move(Geometry=line_9, Motion=Z_2)  # -> Geometry, Transform
move_2 = Move(Geometry=evaluate_curve.Point, Motion=reverse)  # -> Geometry, Transform
move_3 = Move(Geometry=evaluate_curve.Point, Motion=multiplication_3)  # -> Geometry, Transform
graph_2 = GraphMapper(remap.Mapped, x0=0, x1=1, y0=0, y1=1, container_name="Bezier", cpx=[0, 0, 0.9786925316, 1], cpy=[0, 0, 0.5259319544, 1])
line_11 = Line(StartPoint=move_3.Geometry, EndPoint=move_2.Geometry)  # -> flatten(Line)
bnd_3 = Bounds(Numbers=graph_2)
line_12 = Line(line_11)
gradient_4 = Gradient(
    LowerLimit="1",
    UpperLimit="-1",
    Parameter=graph_2,
    stops=[0: RGB(255, 0, 0), 0.176: RGB(255, 238, 0), 0.35: RGB(0, 255, 234), 0.504: RGB(35, 4, 128), 0.664: RGB(0, 252, 215), 0.843: RGB(255, 255, 0), 1: RGB(255, 0, 47)])
avr = Average(Input=[end.Start, end.End])  # -> flatten(ArithmeticMean)
remap_2 = RemapNumbers(Value=graph_2, Source=bnd_3, Target="4 to 0.5")  # -> Mapped, Clipped
scale = Scale(Geometry=line_10, Center=avr, Factor=remap_2.Mapped)  # -> Geometry, Transform
line_13 = Line(scale.Geometry)
col_6 = Colour(gradient_4)
preview = CustomPreview(Geometry=line_12, Material=gradient_4)
preview_2 = CustomPreview(Geometry=line_13, Material=swatch_3)
preview_3 = CustomPreview(Geometry=line_10, Material=col_6)
col_7 = Colour(col_6)
line_14 = Line(line_13)
graft_13 = GraftTree(Tree=col_7, IncludeEmptyLists=True, IncludeNullItems=True)
graft_14 = GraftTree(Tree=line_14, IncludeEmptyLists=True, IncludeNullItems=True)
createatts = CreateAttributes(LayerName="colored_vectors", Color=graft_13, enableFullPath=False)
bake = BakeGeometry(Bake=Button(), Geometry=graft_14, Attributes=createatts, DeleteOldBakes=False, PreserveTrees=False)
line_15 = Line(python_10.node_line_field)

line_16 = Line(line_3)
line_17 = Line(line_15)
line_18 = Line(line_4)

line_19 = Line(flatten(line_17))
line_20 = Line(line_19)
end_2 = EndPoints(Curve=graft(line_20))  # -> Start, End
vec2pt_3 = Vector2Pt(PointA=end_2.Start, PointB=end_2.End, Unitize=False)  # -> flatten(Vector), Length
vlen_2 = VectorLength(Vector=vec2pt_3.Vector)
bnd_4 = Bounds(Numbers=vlen_2)
remap_3 = RemapNumbers(Value=vlen_2, Source=bnd_4, Target=Domain(0, 1))  # -> Mapped, Clipped
move_4 = Move(Geometry=line_19, Motion=Z_3)  # -> Geometry, Transform
graph_3 = GraphMapper(
    remap_3.Mapped,
    x0=0,
    x1=1,
    y0=0,
    y1=1,
    container_name="Bezier",
    cpx=[0, 0, 1, 1],
    cpy=[0, 0.3821747303, 0.5108695626, 1])
bnd_5 = Bounds(Numbers=graph_3)
gradient_5 = Gradient(
    LowerLimit="1",
    UpperLimit="-1",
    Parameter=graph_3,
    stops=[0: RGB(255, 0, 0), 0.176: RGB(255, 238, 0), 0.35: RGB(0, 255, 234), 0.504: RGB(35, 4, 128), 0.664: RGB(0, 252, 215), 0.843: RGB(255, 255, 0), 1: RGB(255, 0, 47)])
avr_2 = Average(Input=[end_2.Start, end_2.End])  # -> flatten(ArithmeticMean)
remap_4 = RemapNumbers(Value=graph_3, Source=bnd_5, Target="4 to 0.5")  # -> Mapped, Clipped
scale_2 = Scale(Geometry=line_20, Center=avr_2, Factor=remap_4.Mapped)  # -> Geometry, Transform
line_21 = Line(scale_2.Geometry)
col_8 = Colour(gradient_5)
preview_4 = CustomPreview(Geometry=line_20, Material=col_8)
preview_5 = CustomPreview(Geometry=line_21, Material=swatch_3)
line_22 = Line(line_21)
col_9 = Colour(col_8)
graft_15 = GraftTree(Tree=col_9, IncludeEmptyLists=True, IncludeNullItems=True)
graft_16 = GraftTree(Tree=line_22, IncludeEmptyLists=True, IncludeNullItems=True)
createatts_2 = CreateAttributes(LayerName="colored_vectors", Color=graft_15, enableFullPath=False)
bake_2 = BakeGeometry(Bake=Button(), Geometry=graft_16, Attributes=createatts_2, DeleteOldBakes=False, PreserveTrees=False)
data_25 = Data(python_9.s_mesh)
col_10 = Colour(python_9.colors_node_line_field)

col_11 = Colour(col_2)
col_12 = Colour(col_10)
col_13 = Colour(col_3)

entwine_14 = Entwine(Branch00=line_6, Branch01=line_7, Branch02=line_8, FlattenInputs=True)
entwine_15 = Entwine(Branch00=col_11, Branch01=col_12, Branch02=col_13, FlattenInputs=True)
move_5 = Move(Geometry=entwine_14, Motion=X_3)  # -> Geometry, Transform
preview_6 = CustomPreview(Geometry=line_9, Material=ColourSwatch(SwatchColor=RGB(255, 255, 255)))

data_26 = Data(python_10.s_mesh)

# ---- group: s_mesh
data_27 = Data(data_26)

# ----
python_14 = GhPythonScript(show=bool_12, s_mesh=data_27, vector_tag=txt_18, tol=num_21)  # -> out, s_mesh, face_neg, face_null, face_pos; inputs show: Boolean
# ---------- python_14: Python ----------
"""Retrieves data from a Structural Mesh object"""

__author__ = "Rafael Pastrana"
__name__ = "Mesh Displayer"
__date__ = "2018.07.24"
__version__ = "0.0.1"


# 1. Import dependencies
import rhinoscriptsyntax as rs

# 2. Start System
my_mesh = s_mesh
v_name = vector_tag

if show is True:
    my_mesh.get_face_labels(v_name, tol)
    face_neg, face_null, face_pos = my_mesh.stream_face_labels()
# ---------- end python_14 ----------
data_28 = Data(python_14.s_mesh)

# ---- group: s_mesh
data_29 = Data(data_28)

# ----
python_15 = GhPythonScript(show=bool_13, s_mesh=data_29)  # -> out, s_mesh, face_planes, edge_planes; inputs show: Boolean
# ---------- python_15: Python ----------
"""Retrieves data from a Structural Mesh object"""

__author__ = "Rafael Pastrana"
__name__ = "Mesh Displayer"
__date__ = "2018.07.24"
__version__ = "0.0.1"


# 1. Import dependencies
import rhinoscriptsyntax as rs

# 2. Start System
my_mesh = s_mesh

if show is True:
    # plane properties
    face_planes = list(map(lambda x: my_mesh.cMesh.get_face_attribute(x,'plane'), my_mesh.cMesh.faces()))
    face_planes = [rs.PlaneFromNormal(x[0], x[1]) for x in face_planes]
    
    edge_planes = list(map(lambda x: my_mesh.cMesh.get_edge_attribute(x,'plane'), my_mesh.cMesh.edges()))
    edge_planes = [rs.PlaneFromNormal(x[0], x[1]) for x in edge_planes if x is not None]

s_mesh = s_mesh
# ---------- end python_15 ----------
pt_9 = Point(python_14.face_neg)
pt_10 = Point(python_14.face_null)
pt_11 = Point(python_14.face_pos)

pt_12 = Point(pt_9)
pt_13 = Point(pt_10)
pt_14 = Point(pt_11)  # disabled

entwine_16 = Entwine(Branch00=pt_12, Branch01=pt_13, Branch02=pt_14, FlattenInputs=True)
move_6 = Move(Geometry=entwine_16, Motion=X_2)  # -> Geometry, Transform
circle_cnr = CircleCNR(Center=move_6.Geometry, Normal=Vector(0, 0, 1), Radius="0.05")
custom_preview = CustomPreview(Geometry=circle_cnr, Material=entwine_3)
data_30 = Data(python_15.s_mesh)
pln = Plane(python_15.edge_planes)
pln_2 = Plane(python_15.face_planes)
col_14 = Colour(python_10.colors_node_line_field)

col_15 = Colour(col_4)
col_16 = Colour(col_14)
col_17 = Colour(col_5)

entwine_17 = Entwine(Branch00=line_16, Branch01=line_17, Branch02=line_18, FlattenInputs=True)
entwine_18 = Entwine(Branch00=col_15, Branch01=col_16, Branch02=col_17, FlattenInputs=True)
move_7 = Move(Geometry=entwine_17, Motion=X_4)  # -> Geometry, Transform
preview_7 = CustomPreview(Geometry=line_19, Material=ColourSwatch(SwatchColor=RGB(255, 255, 255)))

data_31 = Data(data_13)
data_32 = Data(data_13)
python_16 = GhPythonScript(
    run=bool_20,
    s_mesh=flatten(data_31),
    weights=num_46,
    dL=num_47,
    min_length=num_48,
    vector_tag=txt_21,
    as_tag=txt_20,
    min_sp=num_49,
    uni_sp=bool_21,
    num_samples=int_17,
    strat_factor=num_50,
    others_prox=num_51,
    start_prox=num_52,
    self_prox=num_53,
    iterations=num_54)  # -> out, str_system; inputs weights: list, uni_sp: Boolean, num_samples: Int32, iterations: Int32
# ---------- python_16: Python ----------
fac__author__ = "Rafael Pastrana"
__name__ = "Streamliner"
__date__ = "2018.08.05"
__version__ = "0.0.4"


# 0. Import dependencies
import sys
import imp
import rhinoscriptsyntax as rs
import clr
clr.AddReference("Grasshopper")
import Grasshopper.Kernel.Data.GH_Path as ghpath
import Grasshopper.DataTree as datatree
import System
import ghpythonlib.parallel as gh_parallel
 
# 0-b. Replace with your own path here
sys.path.append("Z:\projects\streamlines\src\streamlines")
import streamsystem
imp.reload(streamsystem)
from streamsystem import Streamsystem


# 1. Define Globals 
TAG = 'spacing_'
TOL = 1e-6
AS_TAGS = [TAG+'asx_', TAG+'asy_']
MIN_SP = min_sp  # minimum backup separation for objects
UNI_SP = uni_sp  # Ignore Separation Map from RC Design?

W_1 = [weights[0], weights[1], weights[2]]
W_2= [weights[3], weights[4], weights[5]]
vec_tag_dict = {'n_1':'n_2', 'n_2':'n_1', 'm_1':'m_2', 'm_2':'m_1', 'ps_1_top':'ps_2_top', 'ps_1_bot':'ps_2_bot', 'ps_1_mid':'ps_2_mid', 'ps_2_top':'ps_1_top', 'ps_2_bot':'ps_1_bot', 'ps_2_mid':'ps_1_mid', 'custom_1':'custom_2', 'custom_2':'custom_1'}

# 2. Establish Tag Convention
if as_tag == 'asx_':
    as_dir = AS_TAGS[0]
    w = W_1
    vector_tag = vector_tag

elif as_tag == 'asy_':
    as_dir = AS_TAGS[1]
    w = W_2
    vector_tag = vec_tag_dict[vector_tag]

# 3. Create Data Trees for collecting output
streamlines = datatree[System.Object]()
streamlines_objects = datatree[System.Object]()
short_streamlines = datatree[System.Object]()
offsets = datatree[System.Object]()

# 4. Run Streamlines on Direction 1
if run :
    str_system = Streamsystem(s_mesh, as_dir, dL, MIN_SP, UNI_SP)
    str_system.set_tracing_data(vector_tag, w, min_length)
    str_system.make_streamlines_jobard(strat_factor, others_prox, start_prox, self_prox, num_samples, iterations)
# ---------- end python_16 ----------
python_17 = GhPythonScript(
    run=bool_22,
    s_mesh=flatten(data_32),
    weights=num_56,
    dL=num_58,
    min_length=num_55,
    vector_tag=txt_22,
    as_tag=txt_23,
    min_sp=num_59,
    uni_sp=bool_23,
    num_samples=int_18,
    strat_factor=num_60,
    others_prox=num_61,
    start_prox=num_57,
    self_prox=num_62,
    iterations=num_63)  # -> out, str_system; inputs weights: list, uni_sp: Boolean, num_samples: Int32, iterations: Int32
# ---------- python_17: Python ----------
__author__ = "Rafael Pastrana"
__name__ = "Streamliner"
__date__ = "2018.08.05"
__version__ = "0.0.4"


# 0. Import dependencies
import sys
import imp
import rhinoscriptsyntax as rs
import clr
clr.AddReference("Grasshopper")
import Grasshopper.Kernel.Data.GH_Path as ghpath
import Grasshopper.DataTree as datatree
import System
import ghpythonlib.parallel as gh_parallel
 
# 0-b. Replace with your own path here
sys.path.append("Z:\projects\streamlines\src\streamlines")
import streamsystem
imp.reload(streamsystem)
from streamsystem import Streamsystem


# 1. Define Globals 
TAG = 'spacing_'
TOL = 1e-6
AS_TAGS = [TAG+'asx_', TAG+'asy_']
MIN_SP = min_sp  # minimum backup separation for objects
UNI_SP = uni_sp  # Ignore Separation Map from RC Design?

W_1 = [weights[0], weights[1], weights[2]]
W_2= [weights[3], weights[4], weights[5]]
vec_tag_dict = {'n_1':'n_2', 'n_2':'n_1', 'm_1':'m_2', 'm_2':'m_1', 'ps_1_top':'ps_2_top', 'ps_1_bot':'ps_2_bot', 'ps_1_mid':'ps_2_mid', 'ps_2_top':'ps_1_top', 'ps_2_bot':'ps_1_bot', 'ps_2_mid':'ps_1_mid', 'custom_1':'custom_2', 'custom_2':'custom_1'}

# 2. Establish Tag Convention
if as_tag == 'asx_':
    as_dir = AS_TAGS[0]
    w = W_1
    vector_tag = vector_tag

elif as_tag == 'asy_':
    as_dir = AS_TAGS[1]
    w = W_2
    vector_tag = vec_tag_dict[vector_tag]

# 3. Create Data Trees for collecting output
streamlines = datatree[System.Object]()
streamlines_objects = datatree[System.Object]()
short_streamlines = datatree[System.Object]()
offsets = datatree[System.Object]()

# 4. Run Streamlines on Direction 1
if run :
    str_system = Streamsystem(s_mesh, as_dir, dL, MIN_SP, UNI_SP)
    str_system.set_tracing_data(vector_tag, w, min_length)
    str_system.make_streamlines_jobard(strat_factor, others_prox, start_prox, self_prox, num_samples, iterations)

# 5. Collect Streamlines
#    for idx, streamline in enumerate(str_system.streamlines):
#        rh_pts = []
#        for point in streamline.polyline.points:
#            rh_pts.append(rs.AddPoint(*point))
#        streamlines.AddRange(rh_pts, ghpath(idx))
#        streamlines_objects.Add(streamline, ghpath(idx))
#        
#    for idx, streamline in enumerate(str_system.short_streamlines):
#        rh_pts = []
#        for point in streamline.polyline.points:
#            rh_pts.append(rs.AddPoint(*point))
#        short_streamlines.AddRange(rh_pts, ghpath(idx))
#   
#    for idx, streamline in enumerate(str_system.offsets):
#        rh_pts = []
#        for point in streamline.polyline.points:
#            rh_pts.append(rs.AddPoint(*point))
#        offsets.AddRange(rh_pts, ghpath(idx))
#        
#    seed_pts = str_system.seed_pts
#    first_pt = str_system.first_pt


# if run_2:
#     print('dir 2')
#     myStreamSystem = StreamSystem(s_mesh, seeds_2, as_dir_2, dL, MIN_SP, UNI_SP)
#     myStreamSystem.set_data_mebarki(vector_tag_2, W_2, min_length)
# 
#     all_seeds = seeds_2
#     if PARALLEL is True:
#         rh_pts = gh_parallel.run(myStreamSystem.make_streamline_mebarki_parallel, [all_seeds], True)
#     else:
#         rh_pts = myStreamSystem.make_streamline_mebarki_parallel([all_seeds])
# 
#     for idx, pts in enumerate(rh_pts):
#         if pts:
#            streamlines_2.AddRange(pts, ghpath(idx))
# ---------- end python_17 ----------
data_33 = Data(python_16.str_system)
data_34 = Data(python_17.str_system)
panel_25 = Panel(python_16.out)
data_35 = Data(data_33)
data_36 = Data(data_34)
panel_26 = Panel(python_17.out)
python_18 = GhPythonScript(streamsystem=data_35)  # -> out, offsets, first_pt, seed_pts, streamlines, streamlines_objects, short_streamlines
# ---------- python_18: Python ----------
__author__ = "Rafael Pastrana"
__name__ = "Streamliner"
__date__ = "2018.08.05"
__version__ = "0.0.4"


# 0. Import dependencies
import sys
import imp
import rhinoscriptsyntax as rs
import clr
clr.AddReference("Grasshopper")
import Grasshopper.Kernel.Data.GH_Path as ghpath
import Grasshopper.DataTree as datatree
import System
import ghpythonlib.parallel as gh_parallel
 
# 0-b. Replace with your own path here
# sys.path.append("Z:\Dropbox\Documentos\ETH Zuerich\ETH MAS Thesis\code\current")
#import streamsystem
#imp.reload(streamsystem)
#from streamsystem import Streamsystem


# 1. Define Globals 
streamlines = datatree[System.Object]()
streamlines_objects = datatree[System.Object]()
short_streamlines = datatree[System.Object]()
offsets = datatree[System.Object]()


# 5. Collect Streamlines
if streamsystem is not None:
    str_system = streamsystem
    
    for idx, streamline in enumerate(str_system.streamlines):
        rh_pts = []
        for point in streamline.polyline.points:
            rh_pts.append(rs.AddPoint(*point))
        streamlines.AddRange(rh_pts, ghpath(idx))
        streamlines_objects.Add(streamline, ghpath(idx))
        
    for idx, streamline in enumerate(str_system.short_streamlines):
        rh_pts = []
        for point in streamline.polyline.points:
            rh_pts.append(rs.AddPoint(*point))
        short_streamlines.AddRange(rh_pts, ghpath(idx))
    
    for idx, streamline in enumerate(str_system.offsets):
        rh_pts = []
        for point in streamline.polyline.points:
            rh_pts.append(rs.AddPoint(*point))
        offsets.AddRange(rh_pts, ghpath(idx))
        
    seed_pts = str_system.seed_pts
    first_pt = str_system.first_pt
# ---------- end python_18 ----------
python_19 = GhPythonScript(streamsystem=data_36)  # -> out, offsets, first_pt, seed_pts, streamlines, streamlines_objects, short_streamlines
# ---------- python_19: Python ----------
__author__ = "Rafael Pastrana"
__name__ = "Streamliner"
__date__ = "2018.08.05"
__version__ = "0.0.4"


# 0. Import dependencies
import sys
import imp
import rhinoscriptsyntax as rs
import clr
clr.AddReference("Grasshopper")
import Grasshopper.Kernel.Data.GH_Path as ghpath
import Grasshopper.DataTree as datatree
import System
import ghpythonlib.parallel as gh_parallel
 
# 0-b. Replace with your own path here
sys.path.append("Z:\Dropbox\Documentos\ETH Zuerich\ETH MAS Thesis\code\current")
#import streamsystem
#imp.reload(streamsystem)
#from streamsystem import Streamsystem


# 1. Define Globals 
streamlines = datatree[System.Object]()
streamlines_objects = datatree[System.Object]()
short_streamlines = datatree[System.Object]()
offsets = datatree[System.Object]()


# 5. Collect Streamlines
if streamsystem is not None:
    str_system = streamsystem
    
    for idx, streamline in enumerate(str_system.streamlines):
        rh_pts = []
        for point in streamline.polyline.points:
            rh_pts.append(rs.AddPoint(*point))
        streamlines.AddRange(rh_pts, ghpath(idx))
        streamlines_objects.Add(streamline, ghpath(idx))
        
    for idx, streamline in enumerate(str_system.short_streamlines):
        rh_pts = []
        for point in streamline.polyline.points:
            rh_pts.append(rs.AddPoint(*point))
        short_streamlines.AddRange(rh_pts, ghpath(idx))
    
    for idx, streamline in enumerate(str_system.offsets):
        rh_pts = []
        for point in streamline.polyline.points:
            rh_pts.append(rs.AddPoint(*point))
        offsets.AddRange(rh_pts, ghpath(idx))
        
    seed_pts = str_system.seed_pts
    first_pt = str_system.first_pt
# ---------- end python_19 ----------
pt_15 = Point(python_18.first_pt)
pt_16 = Point(python_18.seed_pts)
pt_17 = Point(python_18.short_streamlines)
pt_18 = Point(python_18.offsets)
pt_19 = Point(python_18.streamlines)
data_37 = Data(python_18.streamlines_objects)
pt_20 = Point(python_19.streamlines)
pt_21 = Point(python_19.short_streamlines)
pt_22 = Point(python_19.seed_pts)
data_38 = Data(python_19.streamlines_objects)
pt_23 = Point(python_19.first_pt)
pt_24 = Point(python_19.offsets)

pt_25 = Point(pt_18)
pt_26 = Point(pt_17)
pt_27 = Point(pt_19)
pline = PolyLine(Vertices=pt_27, Closed=False)
pline_2 = PolyLine(Vertices=pt_25, Closed=False)
pline_3 = PolyLine(Vertices=pt_26, Closed=False)
crv_5 = Curve(pline)
crv_6 = Curve(pline_2)
crv_7 = Curve(pline_3)

pt_28 = Point(pt_21)
pt_29 = Point(pt_24)
pt_30 = Point(pt_20)
pline_4 = PolyLine(Vertices=pt_30, Closed=False)
pline_5 = PolyLine(Vertices=pt_29, Closed=False)
pline_6 = PolyLine(Vertices=pt_28, Closed=False)
crv_8 = Curve(pline_5)
crv_9 = Curve(pline_4)
crv_10 = Curve(pline_6)

crv_11 = Curve(crv_5)
crv_12 = Curve(crv_5)
crv_13 = Curve(crv_9)
crv_14 = Curve(crv_9)
tstat = TreeStatistics(Tree=crv_11)  # -> Paths, Length, Count
flatten_3 = FlattenTree(Tree=crv_12, Path="{0}")
tstat_2 = TreeStatistics(Tree=crv_14)  # -> Paths, Length, Count
flatten_4 = FlattenTree(Tree=crv_13, Path="{0}")
crv_15 = Curve(crv_9)
series = Series(Start=0, Step=1, Count=tstat.Count)
eval_3 = EvaluateCurve(Curve=reparameterize(flatten_3), Parameter="0.5")  # -> Point, Tangent, Angle
series_2 = Series(Start=0, Step=1, Count=tstat_2.Count)
eval_4 = EvaluateCurve(Curve=reparameterize(flatten_4), Parameter="0.5")  # -> Point, Tangent, Angle
gradient_6 = Gradient(
    LowerLimit=0,
    UpperLimit=expr("x-1", tstat.Count),
    Parameter=series,
    stops=[0: RGB(255, 255, 255), 0.498: RGB(89, 147, 247), 1: RGB(20, 2, 107)])
gradient_7 = Gradient(
    LowerLimit=0,
    UpperLimit=expr("x-1", tstat_2.Count),
    Parameter=series_2,
    stops=[0: RGB(255, 255, 255), 0.498: RGB(89, 147, 247), 1: RGB(20, 2, 107)])
intersection = SetIntersection(SetA=eval_3.Point, SetB=eval.Point)
intersection_2 = SetIntersection(SetA=eval_4.Point, SetB=eval_2.Point)
item_8 = ListItem(List=flatten(crv_15), Index=Slider(19, range=0..100), Wrap=True)
mindex = MemberIndex(Set=eval.Point, Member=intersection)  # -> flatten(Index), Count
mindex_2 = MemberIndex(Set=eval_2.Point, Member=intersection_2)  # -> flatten(Index), Count
cull_i = CullIndex(List=flatten, Indices=mindex.Index, Wrap=True)
cull_i_2 = CullIndex(List=flatten_2, Indices=mindex_2.Index, Wrap=True)
graft_17 = GraftTree(Tree=gradient_6, IncludeEmptyLists=True, IncludeNullItems=True)
graft_18 = GraftTree(Tree=gradient_7, IncludeEmptyLists=True, IncludeNullItems=True)
smoothpline = SmoothPolyline(Polyline=crv_11, Strength=1, Times="50")
previewlw_2 = CustomPreviewLineweights(Geometry=cull_i, Shader=ColourSwatch(SwatchColor=RGB(107, 107, 107)), Thickness="3", Absolute=False)
previewlw_3 = CustomPreviewLineweights(Geometry=crv_11, Shader=graft_17, Thickness="3", Absolute=False)
previewlw_4 = CustomPreviewLineweights(Geometry=crv_14, Shader=graft_18, Thickness="3", Absolute=False)
previewlw_5 = CustomPreviewLineweights(Geometry=cull_i_2, Shader=ColourSwatch(SwatchColor=RGB(107, 107, 107)), Thickness="3", Absolute=False)

# ---- group: The Bridge
pt_31 = Point()  # disabled
pt_32 = Point()  # disabled
mesh_17 = Mesh()  # disabled
data_39 = Data(data_13)  # disabled

# ----
mesh_18 = Mesh(mesh_15)

demesh = DeconstructMesh(Mesh=mesh_18)  # -> Vertices, Faces, Colours, Normals

num_96 = Number(num_95)
bnd_6 = Bounds(Numbers=num_96)
python_20 = GhPythonScript(x=num_96)  # -> out, a; inputs x: list
# ---------- python_20: Python ----------
__author__ = "ARPJ"
__version__ = "2018.08.01"

import rhinoscriptsyntax as rs

def normalise_data(data, cmin=None, cmax=None):
    fmax = cmax if cmax is not None else max([abs(x) for x in data])
    fmin = cmin if cmin is not None else min([abs(x) for x in data])
    fabs = max([abs(fmin), abs(fmax)])

    fscaled = []
    for value in data:
        new_val = value / fabs
        if new_val > 1:
            new_val = 1
        elif new_val < -1:
            new_val = -1
        fscaled.append(new_val)
    return fscaled

a = normalise_data(x)
# ---------- end python_20 ----------
dedomain = DeconstructDomain(Domain=bnd_6)  # -> Start, End
range_4 = Range(Domain=bnd_6, Steps="15")
neg = Negative(Value=dedomain.End)
gradient_8 = Gradient(
    LowerLimit=neg,
    UpperLimit=dedomain.End,
    Parameter=range_4,
    stops=[0: RGB(255, 0, 0), 0.176: RGB(255, 238, 0), 0.35: RGB(0, 255, 234), 0.504: RGB(35, 4, 128), 0.664: RGB(0, 252, 215), 0.843: RGB(255, 255, 0), 1: RGB(255, 0, 47)])
gradient_9 = Gradient(
    LowerLimit="-1",
    UpperLimit="1",
    Parameter=python_20.a,
    stops=[0: RGB(255, 0, 0), 0.176: RGB(255, 238, 0), 0.35: RGB(0, 255, 234), 0.504: RGB(35, 4, 128), 0.664: RGB(0, 252, 215), 0.843: RGB(255, 255, 0), 1: RGB(255, 0, 47)])
num_97 = Number(range_4)
col_18 = Colour(gradient_8)

num_98 = Number(num_97)
col_19 = Colour(col_18)
legend_4 = Legend(Colour=col_19, Tags=num_98, LegendType=1)

gradient_10 = Gradient(
    LowerLimit="-1",
    UpperLimit="1",
    Parameter=python_20.a,
    stops=[0: RGB(255, 0, 0), 0.254: RGB(255, 238, 0), 0.423: RGB(0, 255, 234), 0.504: RGB(35, 4, 128), 0.612: RGB(0, 252, 215), 0.744: RGB(255, 255, 0), 1: RGB(255, 0, 47)])
gradient_11 = Gradient(
    LowerLimit="-1",
    UpperLimit="1",
    Parameter=python_20.a,
    stops=[0: RGB(255, 0, 0), 0.254: RGB(255, 238, 0), 0.423: RGB(0, 255, 234), 0.504: RGB(35, 4, 128), 0.56: RGB(0, 252, 215), 0.719: RGB(255, 255, 0), 1: RGB(255, 0, 47)])
gradient_12 = Gradient(
    LowerLimit="-1",
    UpperLimit="1",
    Parameter=python_20.a,
    stops=[0: RGB(255, 0, 0), 0.254: RGB(255, 238, 0), 0.423: RGB(0, 255, 234), 0.767: RGB(35, 4, 128), 0.843: RGB(0, 252, 215), 0.925: RGB(255, 255, 0), 1: RGB(255, 0, 47)])
num_99 = Number(python_20.a)

col_20 = Colour(gradient_12)

col_21 = Colour(col_20)

conmesh = ConstructMesh(Vertices=demesh.Vertices, Faces=demesh.Faces, Colours=col_21)
move_8 = Move(Geometry=conmesh, Motion=X)  # -> Geometry, Transform
wbedges_3 = WeaverbirdsMeshEdges(MeshOrPolylines=move_8.Geometry)
mblur = BlurMesh(Mesh=conmesh, Iterations=1)
previewlw_6 = CustomPreviewLineweights(Geometry=wbedges_3, Shader=ColourSwatch(SwatchColor=RGB(3, 3, 3)), Absolute=False)
mesh_19 = Mesh(mblur)

# ==== cluster Cluster
mesh = ClusterInput()
vec = ClusterInput()
mesh_2 = Mesh(mesh)
vec_2 = Vector(vec)
facen = FaceNormals(Mesh=mesh_2)  # -> Centers, Normals
pl = PlaneNormal(Origin=facen.Centers, ZAxis=facen.Normals)
move = Move(Geometry=facen.Centers, Motion=vec_2)  # -> Geometry, Transform
project = Project(Geometry=move.Geometry, Plane=pl)  # -> Geometry, Transform
vec2pt = Vector2Pt(PointA=facen.Centers, PointB=project.Geometry, Unitize="True")  # -> Vector, Length
xprod = CrossProduct(VectorA=facen.Normals, VectorB=vec2pt.Vector, Unitize="True")  # -> Vector, Length
vec_3 = Vector(xprod.Vector)
vec_4 = Vector(vec2pt.Vector)
vec_5 = ClusterOutput(vec_3)
vec_6 = ClusterOutput(vec_4)
