# Grasshopper definition three_point_slab.gh (Grasshopper 1.0.7)
# plug-ins: NGon 2, Sandbox Topology, Human, Weaverbird, TT Toolbox, karambaGH

shell_dimension_x = Slider(4.5, range=0..10)
shell_global_orientation = Slider(0, range=0..1)
shell_dimension_y_m = Slider(6, range=0..10)
num_of_faces_in_x_direction = Slider(45, range=0..100)
num_of_faces_in_y_direction = Slider(30, range=0..120)
num = Number(shell_dimension_x)
num_2 = Number(shell_dimension_y_m)
num_3 = Number(num_of_faces_in_x_direction)
num_4 = Number(num_of_faces_in_y_direction)
num_5 = Number(shell_global_orientation)

num_6 = Number(num_2)
num_7 = Number(num)
division = Division(A=num_7, B="6")
addition = Addition(A="6", B=1)
division_2 = Division(A=num_6, B="6")
series = Series(Start=0, Step=1, Count=addition)
division_3 = Division(A=num_6, B=2)
division_4 = Division(A=num_7, B=2)
multiplication = Multiplication(A=division, B=series)
multiplication_2 = Multiplication(A=division_2, B=series)
pt = ConstructPoint(XCoordinate=division_4, YCoordinate=division_3, ZCoordinate=0)
num_8 = Number(num_2)
graft = GraftTree(Tree=multiplication, IncludeEmptyLists=True, IncludeNullItems=True)
num_9 = Number(num_3)
num_10 = Number(num_4)
num_11 = Number(num)
xy = XYPlane(Origin=Point(0, 0, 0))
xy_2 = XYPlane(Origin=pt)
division_5 = Division(A=num_11, B="2")
division_6 = Division(A=num_8, B="2")
pt_2 = ConstructPoint(XCoordinate=graft, YCoordinate=multiplication_2, ZCoordinate=0)
neg = Negative(Value=division_5)
neg_2 = Negative(Value=division_6)
panel = Panel("""1
3
5""")
orient = Orient(Geometry=pt_2, Source=xy_2, Target=xy)  # -> Geometry, Transform
dom = ConstructDomain(DomainStart=neg_2, DomainEnd=division_6)
dom_2 = ConstructDomain(DomainStart=neg, DomainEnd=division_5)
panel_2 = Panel("""4
2
4""")
panel_3 = Panel("""4
1
4""")
rectangle = Rectangle(Plane=PlaneXY(0, 0, 0), XSize=dom_2, YSize=dom, Radius=0)  # -> Rectangle, Length
tii = TreeItemIndex(DataTree=orient.Geometry, BranchIndex=panel, ItemIndex=panel_3)
tii_2 = TreeItemIndex(DataTree=orient.Geometry, BranchIndex=panel, ItemIndex=panel_2)
mplane = MeshPlane(Boundary=rectangle.Rectangle, WidthCount=num_9, HeightCount=num_10)  # -> Mesh, Area
pt_3 = Point(tii_2)
pt_4 = Point(tii)
num_12 = Number()
tri = Triangulate(Mesh=mplane.Mesh)  # -> Mesh, Count
concrete_covers_cm = Panel("""2.5
2.5
-2.5
-2.5""")
mesh = Mesh(tri.Mesh)
mesh_2 = Mesh(mesh)
demesh = DeconstructMesh(Mesh=mesh_2)  # -> Vertices, Faces, Colours, Normals
crv = Curve(rectangle.Rectangle)
crv_2 = Curve(crv)
explode = Explode(Curve=crv_2, Recursive=True)  # -> Segments, Vertices
graft_2 = GraftTree(Tree=explode.Segments, IncludeEmptyLists=True, IncludeNullItems=True)
crv_cp = CurveClosestPoint(Point=demesh.Vertices, Curve=graft_2)  # -> Point, Parameter, Distance
smaller = SmallerThan(FirstNumber=crv_cp.Distance, SecondNumber="0.001")  # -> SmallerThan, OrEqualTo
cull = CullPattern(List=crv_cp.Point, CullPattern=smaller.SmallerThan)  # -> simplify(List)
split = SplitTree(Data=cull, Masks=flatten("{0,2}"))  # -> Positive, Negative
intersection = SetIntersection(SetA=split.Positive, SetB=flatten(split.Negative))  # -> flatten(Union)
difference = SetDifference(SetA=split.Positive, SetB=flatten(intersection))
difference_2 = SetDifference(SetA=split.Negative, SetB=flatten(intersection))
matselect = MaterialSelectionKaramba(menu=[dropdown(3), dropdown(8)])
matselect_2 = MaterialSelectionKaramba(menu=[dropdown(2), dropdown(2)])
num_13 = Number()
mesh_3 = Mesh(mesh)
num_14 = Number(num_5)
cps = ClosestPoints(Point=intersection, Cloud=flatten(difference_2), Count="1")  # -> ClosestPoint, CPIndex, Distance
panel_4 = Panel("""1
-1""")
multiplication_3 = Multiplication(A=num_13, B="100")
multiplication_4 = Multiplication(A=concrete_covers_cm, B=2)
panel_5 = Panel(multiplication_3)
cross_sections = CrossSectionsKaramba(
    FamilyNameOfCrossSection="DefaultCroSec",
    MaterialConcrete=matselect,
    Height_cm=panel_5,
    MaterialReinforcement=matselect_2,
    ReinforcementConcreteCovers_cm=multiplication_4,
    PrincipalReinforcementDirection_deg=0,
    mode="Shell RC Standard - Const.")
crv_3 = Curve(graft_2)
crv_4 = Curve(crv_3)
len = Length(Curve=crv_4)
multiplication_5 = Multiplication(A=num_12, B=len)
pt_5 = Point(cull)
pt_6 = Point(pt_5)
lng = ListLength(List=pt_6)
division_7 = Division(A=multiplication_5, B=lng)
panel_6 = Panel(division_7)
split_2 = SplitTree(Data=simplify(panel_6), Masks=flatten("{0,2}"))  # -> Positive, Negative
multiplication_6 = Multiplication(A=split_2.Negative, B=reverse(graft(panel_4)))
multiplication_7 = Multiplication(A=split_2.Positive, B=graft(panel_4))
pt_7 = Point(intersection)
pt_8 = Point(cps.ClosestPoint)
mesh_4 = Mesh(mesh)
pt_9 = Point(pt_7)
vec = VectorXYZ(XComponent=multiplication_6, YComponent=0, ZComponent=0)  # -> Vector, Length
vec_2 = VectorXYZ(XComponent=0, YComponent=multiplication_7, ZComponent=0)  # -> Vector, Length
panel_7 = Panel("""0
1""")
panel_8 = Panel("""0
1""")
pt_10 = Point(pt_8)  # disabled
meshtoshell = MeshToShellKaramba(Mesh=mesh_3, Identifier="slab", CrossSection=cross_sections, LimitDistance_m=0.005)  # -> Element, Points, Info
pt_11 = Point(meshtoshell.Points)
cps_2 = ClosestPoints(Point=pt_4, Cloud=flatten(pt_11), Count="1")  # -> ClosestPoint, CPIndex, Distance
pt_12 = Point(cps_2.ClosestPoint)
pt_13 = Point(pt_12)  # disabled
match = MatchTree(Tree=vec_2.Vector, Guide=split_2.Positive)
match_2 = MatchTree(Tree=vec.Vector, Guide=split_2.Negative)
cull_i = CullIndex(List=pt_9, Indices=panel_7, Wrap=True)  # disabled
item = ListItem(List=pt_9, Index="1", Wrap=True)
supp = SupportKaramba(PosInd=pt_13, menu=[buttons(on, on, on, off, off, off)])
supp_2 = SupportKaramba(PosInd=pt_10, menu=[buttons(off, on, on, off, off, off)])
pt_14 = ConstructPoint(XCoordinate=0, YCoordinate=0, ZCoordinate=0)
vec_3 = VectorXYZ(XComponent="1.0", YComponent=num_14, ZComponent=0)  # -> Vector, Length
supp_3 = SupportKaramba(PosInd=pt_12, menu=[buttons(on, on, on, off, off, on)])
supp_4 = SupportKaramba(PosInd=cull_i, menu=[buttons(on, on, on, off, off, off)])
loads = LoadsKaramba(ForceVector=[match, match_2], Local=False, PosInd=pt_6, LCase=0, mode="Point")
vdisex = VectorDisplayEx(Point=pt_14, Vector=vec_3.Vector, Colour=RGB(0, 0, 0), Width=2)
orientate = OrientateElemKaramba(Shell=meshtoshell.Element, XOrientations=vec_3.Vector, mode="Shell")
entwine = Entwine(Branch00=supp, Branch01=supp_2, Branch02=supp_3, Branch03=supp_4, FlattenInputs=True)
element = ElementKaramba(flatten(orientate))
support = SupportKaramba(flatten(entwine))
element_2 = ElementKaramba(element)
support_2 = SupportKaramba(support)
pt_15 = Point(flatten(cull))

# ---- group: Optional Colors
range = Range(Domain=Domain(0, 1), Steps=10)
gradient = Gradient(
    LowerLimit=0,
    UpperLimit=1,
    Parameter=range,
    stops=[0: RGB(255, 0, 0), 0.176: RGB(255, 238, 0), 0.35: RGB(0, 255, 234), 0.504: RGB(35, 4, 128), 0.664: RGB(0, 252, 215), 0.843: RGB(255, 255, 0), 1: RGB(255, 0, 47)])

range_2 = Range(Domain=Domain(0, 1), Steps=10)
gradient_2 = Gradient(
    LowerLimit=0,
    UpperLimit=1,
    Parameter=range_2,
    stops=[0: RGB(255, 0, 0), 0.176: RGB(255, 238, 0), 0.35: RGB(0, 255, 234), 0.504: RGB(35, 4, 128), 0.664: RGB(0, 252, 215), 0.843: RGB(255, 255, 0), 1: RGB(255, 0, 47)])

# ----
panel_9 = Panel("""nx
ny
nxy
mx
my
mxy
vx
vy""")
graft_3 = GraftTree(Tree=panel_9, IncludeEmptyLists=True, IncludeNullItems=True)

# ---- group: Display Vector Field - Selection 2
list = ValueList({"n_1": 0, "n_2": 1, "m_1": 2, "m_2": 3, "ps_1_top": 4, "ps_1_bot": 5, "ps_1_mid": 6, "ps_2_top": 7, "ps_2_bot": 8, "ps_2_mid": 9, "custom_1": 10, "custom_2": 11}, selected="ps_1_top")
int = Integer(list)

# ---- group: Vector Field 1 - Selection
list_2 = ValueList({"n_1": 0, "n_2": 1, "m_1": 2, "m_2": 3, "ps_1_top": 4, "ps_1_bot": 5, "ps_1_mid": 6, "ps_2_top": 7, "ps_2_bot": 8, "ps_2_mid": 9, "custom_1": 10, "custom_2": 11}, selected="ps_1_top")
int_2 = Integer(list_2)

# ---- group: Display Vector Field - Selection
list_3 = ValueList({"n_1": 0, "n_2": 1, "m_1": 2, "m_2": 3, "ps_1_top": 4, "ps_1_bot": 5, "ps_1_mid": 6, "ps_2_top": 7, "ps_2_bot": 8, "ps_2_mid": 9, "custom_1": 10, "custom_2": 11}, selected="ps_1_top")
int_3 = Integer(list_3)

# ---- group: Display Mesh - Mode Selection
list_4 = ValueList({"max": 0, "min": 1, "avg": 2, "angle_avg": 3}, selected="max")
int_4 = Integer(list_4)

# ---- group: As 2 - Density Selection
list_5 = ValueList({"asx_": 0, "asy_": 1}, selected="asy_")
int_5 = Integer(list_5)

# ---- group: RC - Design Controls
shell_thickness_m = Slider(0.14, range=0..1)
concrete_compression_strength_fck = Slider(40, range=0..100)
concrete_tension_strength_factor_fctd = Slider(10, range=0..100)
rebar_yield_strength_fy = Slider(500, range=0..1000)
cover_to_rebar_m = Slider(0.05, range=0..1)

# ---- group: Display Controls
display_results_on_mesh = BooleanToggle(True)
bool = Boolean(display_results_on_mesh)

display_vector_field = BooleanToggle(True)
bool_2 = Boolean(display_vector_field)

display_seeds = BooleanToggle(False)
bool_3 = Boolean(display_seeds)

display_face_singularities = BooleanToggle(True)
bool_4 = Boolean(display_face_singularities)

display_face_edge_planes = BooleanToggle(False)
bool_5 = Boolean(display_face_edge_planes)

# ---- group: As 1 - Density Selection
list_6 = ValueList({"asx_": 0, "asy_": 1}, selected="asx_")
int_6 = Integer(list_6)

# ---- group: Display Mesh - Results Selection
list_7 = ValueList({"nx": 0, "ny": 1, "nxy": 2, "mx": 3, "my": 4, "mxy": 5, "vx": 6, "vy": 7, "asx_b": 8, "asx_t": 9, "asy_b": 10, "asy_t": 11, "asx_c": 12, "asy_c": 13, "asx_": 14, "asy_": 15, "sp_asx_": 16, "sp_asy_": 17}, selected="asx_")
int_7 = Integer(list_7)

# ----
panel_10 = Panel("""asx_b
asx_t
asy_b
asy_t
asx_c
asy_c
asx_
asy_
spacing_asx_
spacing_asy_""")
int_8 = Integer(int_7)

min_length = Slider(0.2, range=0..2)
dl = Slider(0.01, range=0..0.1)
num_15 = Number(dl)
num_16 = Number(min_length)

dir_1_weight_vector_field = Slider(1, range=0..1)
dir_1_weight_separate = Slider(0, range=0..1)
dir_1_weight_align = Slider(0, range=0..1)
dir_2_weight_separate = Slider(0, range=0..1)
dir_2_weight_vector_field = Slider(1, range=0..1)
dir_2_weight_align = Slider(0, range=0..1)
merge = Merge(
    Data1=dir_1_weight_vector_field,
    Data2=dir_1_weight_separate,
    Data3=dir_1_weight_align,
    Data4=dir_2_weight_vector_field,
    Data5=dir_2_weight_separate,
    Data6=dir_2_weight_align)
num_17 = Number(merge)

# ---- group: Loading - Controls
area_load_kn_m2 = Slider(10, range=0..100)
num_18 = Number(area_load_kn_m2)

# ----
num_19 = Number(num_18)
panel_11 = Panel(num_19)
Z = UnitZ(Factor=panel_11)
rev = Reverse(Vector=Z)
loads_2 = LoadsKaramba(Vector=rev, Mesh=mesh_4, LCase=0, mode="MeshLoad -Const.", menu=[buttons(off, on, off), buttons(on, on)])
entwine_2 = Entwine(Branch00=loads_2, Branch01=loads, FlattenInputs=True)
load = LoadKaramba(flatten(entwine_2))
load_2 = LoadKaramba(load)
assemble = AssembleModelKaramba(Elem=element_2, Support=support_2, Load=load_2, LimitDistance_m=0.005)  # -> Model, Info, Mass_kg, CenterOfGravity
analyzethi = AnalyzeThIKaramba(Model=assemble.Model)  # -> CalculatedModel, MaximumDisplacement_m, ResultingForceOfGravity_kN, ElasticEnergy_kNm
panel_12 = Panel(analyzethi.MaximumDisplacement_m)
model = ModelKaramba(analyzethi.CalculatedModel)
model_2 = ModelKaramba(model)
shelllineresults = LineResultsOnShellsKaramba(
    AnalyzedModel=model_2,
    Layer="-1",
    ListOfSourcesOfPrincipalStressLinesLinesPoints=pt_15,
    SegmentLength_m=0.5,
    DA_deg=5,
    mode="PrincStress")  # -> AnalyzedModel, Lines1, Lines2
curve = Curve(shelllineresults.Lines1)
model_3 = ModelKaramba(model)

model_4 = ModelKaramba(model)
modelview = ModelViewKaramba(Model=model_4, LoadCaseFactorsForLinearSuperposition=1, IndexOfVisibleLoadcase=-1, ListOfColorsForColoringPlots=gradient)  # -> Model, DeformedMesh, DeformedAxes, DeformedModel
shellview = ShellViewKaramba(Model=modelview.Model, IndexOfLayer=0)  # -> Model, MeshesOfRenderedShells, LegendColors, LegendTags
legend = Legend(Colour=shellview.LegendColors, Tags=shellview.LegendTags, LegendType=1)

# ---- group: Algorithm - Controls
run_rc_design = BooleanToggle(False)
bool_6 = Boolean(run_rc_design)

run_smesh = BooleanToggle(True)
bool_7 = Boolean(run_smesh)

# ---- group: Custom Vector - Controls
x_vector = Slider(1, range=0..1)
y_vector = Slider(0, range=0..1)
z_vector = Slider(0, range=0..1)
vec_4 = VectorXYZ(XComponent=x_vector, YComponent=y_vector, ZComponent=z_vector)  # -> Vector, Length
vec_5 = Vector(vec_4.Vector)

# ----
vec_6 = Vector(vec_5)

vector_scale = Slider(2.5, range=0..2.5)
num_20 = Number(vector_scale)

vector_scale_2 = Slider(2.5, range=0..2.5)
num_21 = Number(vector_scale_2)

singularities_tol = Slider(0, range=0..1)
num_22 = Number(singularities_tol)

panel_13 = Panel("""n_1
n_2
m_1
m_2
ps_1_top
ps_1_bot
ps_1_mid
ps_2_top
ps_2_bot
ps_2_mid
custom_1
custom_2""")
int_9 = Integer(int_2)
int_10 = Integer(int_3)
graft_4 = GraftTree(Tree=panel_13, IncludeEmptyLists=True, IncludeNullItems=True)
item_2 = ListItem(List=panel_13, Index=int_10, Wrap=True)
item_3 = ListItem(List=panel_13, Index=int_9, Wrap=True)

panel_14 = Panel("""max
min
avg
angle_avg""")
int_11 = Integer(int_4)

panel_15 = Panel("""asx_
asy_""")
int_12 = Integer(int_6)
int_13 = Integer(int_5)
item_4 = ListItem(List=panel_15, Index=int_12, Wrap=True)
item_5 = ListItem(List=panel_15, Index=int_13, Wrap=True)

int_14 = Integer(int)
merge_2 = Merge(Data1=panel_9, Data2=panel_10)
item_6 = ListItem(List=panel_13, Index=int_14, Wrap=True)
item_7 = ListItem(List=merge_2, Index=int_8, Wrap=True)
item_8 = ListItem(List=panel_14, Index=int_11, Wrap=True)

# ---- group: Internal Forces - Tags
txt = Text(graft_3)

# ---- group: Display - Tag
txt_2 = Text(item_7)

# ---- group: as_tag_1
txt_3 = Text(item_4)

# ---- group: as_tag_2
txt_4 = Text(item_5)

# ---- group: Principal Vectors - Tags
txt_5 = Text(graft_4)

# ---- group: vector_tag
txt_6 = Text(item_3)

# ---- group: vector_tag - display
txt_7 = Text(item_2)

# ---- group: Display - Tag
txt_8 = Text(item_8)

# ----
txt_9 = Text(item_6)

# ---- group: RC - Design Controls
num_23 = Number(shell_thickness_m)
num_24 = Number(cover_to_rebar_m)
num_25 = Number(concrete_compression_strength_fck)
num_26 = Number(concrete_tension_strength_factor_fctd)
num_27 = Number(rebar_yield_strength_fy)

# ----
crv_5 = Curve()
crv_6 = Curve()

bool_8 = Boolean(bool_3)

X = UnitX(Factor="6")
swatch = ColourSwatch(SwatchColor=RGB(0, 0, 0))
swatch_2 = ColourSwatch(SwatchColor=RGB(0, 0, 0))
Z_2 = UnitZ(Factor="6")
Z_3 = UnitZ(Factor="6")
panel_16 = Panel("4 to 0.5")
panel_17 = Panel("2")

# ---- group: Principal Vectors - Tags
txt_10 = Text(txt_5)

# ---- group: vector_tag
txt_11 = Text(txt_6)

# ---- group: Optional Colors
range_3 = Range(Domain=Domain(0, 1), Steps=10)
gradient_3 = Gradient(
    LowerLimit=0,
    UpperLimit=1,
    Parameter=range_3,
    stops=[0: RGB(255, 0, 0), 0.176: RGB(255, 238, 0), 0.35: RGB(0, 255, 234), 0.504: RGB(35, 4, 128), 0.664: RGB(0, 252, 215), 0.843: RGB(255, 255, 0), 1: RGB(255, 0, 47)])

# ----
panel_19 = Panel("""1
-1
0""")

# ---- group: Principal Vectors - Tags
txt_12 = Text(flatten(txt_5))

# ----
txt_13 = Text(flatten(txt))
bool_9 = Boolean(bool_6)
num_28 = Number(num_23)
num_29 = Number(num_24)
num_30 = Number(num_25)
num_31 = Number(num_27)
num_32 = Number(num_26)
panel_20 = Panel("True")

# ---- group: display
bool_10 = Boolean(bool)

# ---- group: mode
txt_14 = Text(txt_8)

# ---- group: data_tag
txt_15 = Text(txt_2)

# ---- group: vector_tag
txt_16 = Text(txt_9)

txt_17 = Text(txt_7)

# ---- group: Vector Scale
num_33 = Number(num_22)

# ---- group: vector_tag
txt_18 = Text(txt_7)

# ---- group: display
bool_11 = Boolean(bool_4)

bool_12 = Boolean(bool_5)

# ---- group: Vector Scale
num_34 = Number(num_20)

num_35 = Number(num_21)

# ---- group: display
bool_13 = Boolean(bool_2)

bool_14 = Boolean(bool_2)

# ----
panel_21 = Panel("0")

proximity_factor_to_others = Slider(0.05, range=0..1)
number_of_samples = Slider(15, range=0..500)
strat_factor = Slider(1, range=0..1)
proximity_at_start = Slider(0.9, range=0..1)
iterations = Slider(2000, range=0..10000)
proximity_to_itself = Slider(1, range=0..10)
int_15 = Integer(number_of_samples)
num_36 = Number(strat_factor)
num_37 = Number(proximity_factor_to_others)
num_38 = Number(iterations)
num_39 = Number(proximity_at_start)
num_40 = Number(proximity_to_itself)

uniform_spacing = BooleanToggle(True)
min_sp_m = Slider(0.5, range=0..1)
dl_2 = Slider(0.02, range=0..0.1)
min_length_2 = Slider(0.01, range=0..4)
num_41 = Number(dl_2)
num_42 = Number(min_length_2)
bool_15 = Boolean(uniform_spacing)
num_43 = Number(min_sp_m)

run_streamlines_jobard = BooleanToggle(False)
bool_16 = Boolean(run_streamlines_jobard)

run_streamlines_jobard_2 = BooleanToggle(False)
bool_17 = Boolean(run_streamlines_jobard_2)

uniform_spacing_2 = BooleanToggle(True)
min_sp_m_2 = Slider(0.5, range=0..1)
dl_3 = Slider(0.02, range=0..0.1)
min_length_3 = Slider(0.2, range=0..4)
num_44 = Number(min_length_3)
bool_18 = Boolean(uniform_spacing_2)
num_45 = Number(min_sp_m_2)
num_46 = Number(dl_3)

number_of_samples_2 = Slider(15, range=0..300)
proximity_at_start_2 = Slider(0.9, range=0..1)
strat_factor_2 = Slider(1, range=0..1)
proximity_factor_to_others_2 = Slider(0.05, range=0..1)
proximity_to_itself_2 = Slider(1, range=0..10)
iterations_2 = Slider(1000, range=0..10000)
int_16 = Integer(number_of_samples_2)
num_47 = Number(strat_factor_2)
num_48 = Number(proximity_factor_to_others_2)
num_49 = Number(proximity_at_start_2)
num_50 = Number(proximity_to_itself_2)
num_51 = Number(iterations_2)

percentage_of_max_demand_dir_1 = Slider(0.67, range=0..1)
percentage_of_max_demand_dir_2 = Slider(0.67, range=0..1)
bar_diameter_mm_dir_1 = Slider(12, range=0..30)
bar_diameter_mm_dir_2 = Slider(12, range=0..30)
max_spacing_dir_2 = Slider(0.4, range=0..1)
max_spacing_dir_1 = Slider(0.4, range=0..1)
merge_3 = Merge(Data1=bar_diameter_mm_dir_1, Data2=bar_diameter_mm_dir_2)
merge_4 = Merge(Data1=max_spacing_dir_1, Data2=max_spacing_dir_2)
merge_5 = Merge(Data1=percentage_of_max_demand_dir_1, Data2=percentage_of_max_demand_dir_2)
num_52 = Number(merge_4)
num_53 = Number(merge_5)
num_54 = Number(merge_3)

# ---- group: bar diameter
num_55 = Number(num_54)

# ---- group: max spacing
num_56 = Number(num_52)

# ---- group: % demand
num_57 = Number(num_53)

# ----
bool_19 = Boolean(bool_16)
txt_19 = Text(txt_3)
num_58 = Number(num_17)
num_59 = Number(num_41)
num_60 = Number(num_42)
txt_20 = Text(txt_6)
num_61 = Number(num_43)
bool_20 = Boolean(bool_15)
int_17 = Integer(int_15)
num_62 = Number(num_36)
num_63 = Number(num_37)
num_64 = Number(num_39)
num_65 = Number(num_40)
num_66 = Number(num_38)
num_67 = Number(num_44)
num_68 = Number(num_17)
num_69 = Number(num_49)
bool_21 = Boolean(bool_17)
num_70 = Number(num_46)
txt_21 = Text(txt_6)
txt_22 = Text(txt_4)
num_71 = Number(num_45)
bool_22 = Boolean(bool_18)
int_18 = Integer(int_16)
num_72 = Number(num_47)
num_73 = Number(num_48)
num_74 = Number(num_50)
num_75 = Number(num_51)
crv_7 = Curve()
crv_8 = Curve()
flatten = FlattenTree(Tree=crv_7, Path="{0}")
flatten_2 = FlattenTree(Tree=crv_8, Path="{0}")
eval = EvaluateCurve(Curve=reparameterize(flatten), Parameter="0.5")  # -> Point, Tangent, Angle
eval_2 = EvaluateCurve(Curve=reparameterize(flatten_2), Parameter="0.5")  # -> Point, Tangent, Angle
panel_22 = Panel("""dir1-8-8
dir2-8-8
boundary""")
panel_23 = Panel("""dir1-12-12
dir2-12-12
boundary""")
panel_24 = Panel("""dir1-6-6
dir2-6-6
boundary""")
panel_25 = Panel("""dir1-10-10
dir2-10-10
boundary""")
dpipeline = DynamicGeometryPipeline(
    LayerFilter=panel_23,
    TypeFilter="curve",
    NameFilter="*",
    GroupByLayer=False,
    GroupByType=False,
    IncludeHidden=True,
    IncludeLocked=True,
    enableFullPath=False,
    listenToAttributes=True)
crv_9 = Curve(dpipeline)
crv_10 = Curve(crv_9)
pt_16 = ConstructPoint(XCoordinate="0", YCoordinate=0, ZCoordinate=0)
yz = YZPlane(Origin=pt_16)
mirror = Mirror(Geometry=crv_10, Plane=yz)  # -> Geometry, Transform
merge_6 = Merge(Data1=crv_10, Data2=mirror.Geometry)  # -> simplify(Result)
split_3 = SplitTree(Data=merge_6, Masks=flatten("{2}"))  # -> Positive, Negative
join = JoinCurves(Curves=split_3.Negative, Preserve=False)  # -> simplify(Curves)
merge_7 = Merge(Data1=split_3.Positive, Data2=join)  # -> simplify(Result)
crv_11 = Curve(merge_7)
crv_12 = Curve(crv_11)
flatten_3 = FlattenTree(Tree=crv_12, Path="{0}")
crv_13 = Curve(flatten_3)
crv_14 = Curve(crv_13)
crv_15 = Curve(reparameterize(crv_14))
graft_5 = GraftTree(Tree=crv_15, IncludeEmptyLists=True, IncludeNullItems=True)  # -> simplify(Tree)
flatten_4 = FlattenTree(Tree=crv_15, Path="{0}")
group = Group(Objects=flatten_4)
tstat = TreeStatistics(Tree=graft_5)  # -> Paths, Length, Count
dup = DuplicateData(Data=group, Number=tstat.Count, Order=True)
series_2 = Series(Start=0, Step=1, Count=tstat.Count)
ungroup = Ungroup(Group=dup)
graft_6 = GraftTree(Tree=series_2, IncludeEmptyLists=True, IncludeNullItems=True)
cull_i_2 = CullIndex(List=ungroup, Indices=graft_6, Wrap=True)
match_3 = MatchTree(Tree=cull_i_2, Guide=graft_5)
ccx = CurveCurve(CurveA=graft_5, CurveB=match_3)  # -> Points, ParamsA, ParamsB
pt_17 = Point(ccx.Points)
num_76 = Number(ccx.ParamsA)
crv_16 = Curve(reparameterize(crv_14))
pt_18 = Point(pt_17)
simplify = SimplifyTree(Tree=pt_18, Front=False)
graft_7 = GraftTree(Tree=crv_16, IncludeEmptyLists=True, IncludeNullItems=True)
trim = TrimTree(Tree=simplify, Depth=1)
simplify_2 = SimplifyTree(Tree=graft_7, Front=False)
crv_cp_2 = CurveClosestPoint(Point=trim, Curve=simplify_2)  # -> Point, Parameter, Distance
smaller_2 = SmallerThan(FirstNumber=crv_cp_2.Distance, SecondNumber="0.001")  # -> SmallerThan, OrEqualTo
cull_2 = CullPattern(List=crv_cp_2.Parameter, CullPattern=smaller_2.SmallerThan)
cull_3 = CullPattern(List=crv_cp_2.Point, CullPattern=smaller_2.SmallerThan)
clean = CleanTree(RemoveNulls=True, RemoveInvalid=True, RemoveEmpty=False, Tree=cull_2)
clean_2 = CleanTree(RemoveNulls=True, RemoveInvalid=True, RemoveEmpty=False, Tree=cull_3)
rdpoints = RemoveDuplicatePointsKaramba(Point=flatten(clean_2), LimitDistance=0.005)  # -> OutPoint, Info, Indexes
shatter = Shatter(Curve=simplify_2, Parameters=clean)  # -> simplify(Segments)
pt_19 = Point(rdpoints.OutPoint)
reb = RebuildCurve(Curve=shatter, Degree="3", Count="10", Tangents=False)
crv_17 = Curve(reb)
crv_18 = Curve(crv_17)
crv_19 = Curve(crv_17)
end = EndPoints(Curve=crv_18)  # -> Start, End
join_2 = JoinCurves(Curves=crv_19, Preserve=False)
ln = Line(StartPoint=end.Start, EndPoint=end.End)  # -> simplify(Line)
crv_20 = Curve(join_2)
line = Line(ln)
line_2 = Line(line)
flatten_5 = FlattenTree(Tree=line_2, Path="{0}")
rdlines = RemoveDuplicateLinesKaramba(Line=flatten_5, LimitDistance="0.005")  # -> OutLine, Info, Indexes
line_topo = LineTopology(ListOfLines=rdlines.OutLine, Tolerance="0.005")  # -> ListOfPoints, LinePointStructure, PointPointStructure, PointLineStructure
lng_2 = ListLength(List=line_topo.PointPointStructure)
larger = LargerThan(FirstNumber=lng_2, SecondNumber="2")  # -> LargerThan, OrEqualTo
flatten_6 = FlattenTree(Tree=larger.OrEqualTo, Path="{0}")
bool_23 = Boolean("False")
mindex = MemberIndex(Set=flatten_6, Member=bool_23)  # -> Index, Count
replace = ReplaceItems(List=line_topo.ListOfPoints, Indices=mindex.Index, Wrap=False)
item_9 = ListItem(List=replace, Index=line_topo.LinePointStructure, Wrap=True)
pline = PolyLine(Vertices=item_9, Closed=False)  # -> flatten(Polyline)
clean_3 = CleanTree(RemoveNulls=True, RemoveInvalid=True, RemoveEmpty=False, Tree=pline)
crv_21 = Curve(clean_3)
createatts = CreateAttributes(enableFullPath=False)
createhatch = CreateHatch(Bake=False, HatchPatternName="Solid", HatchScale=1, HatchRotation=0)
ngon = NGon(LineWeight=1)

panel_27 = Panel("""1
-1
0""")
graft_8 = GraftTree(Tree=panel_27, IncludeEmptyLists=True, IncludeNullItems=True)
shellvecresults = ResultVectorsOnShellsKaramba(AnalyzedModel=model_3, mode="PrincForce")  # -> AnalyzedModel, Points, FirstPrincipalNormalForceVector_kN_m, SecondPrincipalNormalForceVector_kN_m, FirstPrincipalMomentVector_kN, SecondPrincipalMomentVector_kN, FirstPrincipalNormalForceValue_kN_m, SecondPrincipalNormalForceValue_kN_m, FirstPrincipalMomentValue_kN, SecondPrincipalMomentValue_kN
shellvecresults_2 = ResultVectorsOnShellsKaramba(AnalyzedModel=model_3, LayerOfResults=graft_8, mode="PrincStress")  # -> AnalyzedModel, Points, FirstPrincipalStressVector_kN_cm2, SecondPrincipalStressVector_kN_cm2, FirstPrincipalStressValue_kN_cm2, SecondPrincipalStressValue_kN_cm2
disassemble = DisassembleModelKaramba(Model=model_3)  # -> Model, Point, Beam, Shell, Support, Load, Line, Mesh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

vec_7 = Vector(shellvecresults_2.SecondPrincipalStressVector_kN_cm2)
vec_8 = Vector(shellvecresults_2.FirstPrincipalStressVector_kN_cm2)

vec_9 = Vector(shellvecresults.SecondPrincipalNormalForceVector_kN_m)
vec_10 = Vector(shellvecresults.FirstPrincipalNormalForceVector_kN_m)

vec_11 = Vector(shellvecresults.FirstPrincipalMomentVector_kN)
vec_12 = Vector(shellvecresults.SecondPrincipalMomentVector_kN)

vec_13 = Vector(vec_9)
vec_14 = Vector(vec_10)
vec_15 = Vector(vec_11)
vec_16 = Vector(vec_12)
vec_17 = Vector(vec_8)
vec_18 = Vector(vec_7)

path_mapper = PathMapper(vec_18, source="{A;B}", target="{A;B+7}")
path_mapper_2 = PathMapper(vec_17, source="{A;B}", target="{A;B+4}")
entwine_3 = Entwine(Branch00=vec_14, Branch01=vec_13, Branch02=vec_15, Branch03=vec_16, FlattenInputs=True)  # -> simplify(Result)
merge_8 = Merge(Data1=entwine_3, Data2=simplify(path_mapper_2), Data3=simplify(path_mapper))

mesh_5 = Mesh(disassemble.Mesh)

# ---- group: Vector Fields
vec_19 = Vector(merge_8)

# ----
vec_20 = Vector(vec_19)
mesh_6 = Mesh(mesh_5)

cluster = Cluster(mesh=mesh_6, vec=vec_6)  # -> vec_6, vec_5
entwine_4 = Entwine(Branch00=cluster.vec_6, Branch01=cluster.vec_5, FlattenInputs=True)  # -> simplify(Result)
path_mapper_3 = PathMapper(entwine_4, source="{A}", target="{A+10}")
merge_9 = Merge(Data1=vec_20, Data2=simplify(path_mapper_3))

mesh_7 = Mesh(mesh_6)
model_5 = ModelKaramba(model)
vec_21 = Vector(merge_9)

mesh_8 = Mesh(mesh_7)
vec_22 = Vector(vec_21)
model_6 = ModelKaramba(model_5)

mesh_9 = Mesh(mesh_8)
vec_23 = Vector(vec_22)
model_7 = ModelKaramba(model_6)

mesh_10 = Mesh(mesh_9)
bool_24 = Boolean(bool_7)

# ---- group: Principal Vectors
vec_24 = Vector(vec_23)

# ----
python = GhPythonScript(run=bool_24, mesh=mesh_10, vectors=vec_24, vectors_tags=txt_10)  # -> out, s_mesh; inputs mesh: Mesh, vectors: tree of Vector3d, vectors_tags: tree
# ---------- python: Python ----------
__author__ = "Rafael Pastrana"
__name__ = "Mesh Maker"
__date__ = "2018.07.19"
__version__ = "0.0.1"


# 1. Import dependencies
import sys
import imp
import rhinoscriptsyntax as rs

# 1-b. Replace with your own path here
sys.path.append("Z:\code\libraries\streamlines\src\streamlines")

import custom_mesh
imp.reload(custom_mesh)

from custom_mesh import StructuralMesh
from compas.datastructures import Mesh
from compas_rhino.helpers import mesh_from_guid

# Define Global Variables
NORM = False

# 2. Start System
if run is True:
    print('SYSTEM STARTED')
        
    # instantiate mesh
    my_mesh = StructuralMesh(mesh_from_guid(Mesh, mesh))

    # set vector attributes
    for idx, vector_field in enumerate(vectors.Branches):
        tag = vectors_tags.Branches[idx][0]
        clean_vectors = [[vec.X, vec.Y, vec.Z] for vec in vector_field]
        my_mesh.set_face_vectors(clean_vectors, tag, NORM)
        # my_mesh.set_vertex_vectors(tag)
        my_mesh.set_vertex_vectors_angles(tag)
    
    # output mesh
    s_mesh = my_mesh
# ---------- end python ----------
wbedges = WeaverbirdsMeshEdges(MeshOrPolylines=mesh_10)
lng_3 = ListLength(List=wbedges)
data = Data(python.s_mesh)
panel_28 = Panel(lng_3)

# ---- group: s_mesh
data_2 = Data(data)

# ----
python_2 = GhPythonScript(s_mesh=data_2, vector_tag=txt_11)  # -> out, s_mesh, vector_field
# ---------- python_2: Python ----------
# 1. Import dependencies
import rhinoscriptsyntax as rs
import copy

print('number of edges is: {}'.format(len([e for e in s_mesh.c_mesh.edges()])))

# 2. Start System
my_mesh = s_mesh
v_name = vector_tag

# vector properties
vector_field = [x[0] for x in my_mesh.find_vector_face_centers(v_name)]
vector_field = [rs.CreateVector(x) for x in vector_field]
s_mesh = my_mesh
# ---------- end python_2 ----------
vec_25 = Vector(python_2.vector_field)
model_8 = ModelKaramba(model_7)
vec_26 = Vector(vec_25)

disassemble_2 = DisassembleModelKaramba(Model=model_8)  # -> Model, Point, Beam, Shell, Support, Load, Line, Mesh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
orientate_2 = OrientateElemKaramba(Shell=disassemble_2.Shell, XOrientations=unitize(vec_26), mode="Shell")
assemble_2 = AssembleModelKaramba(
    Points=disassemble_2.Point,
    Elem=orientate_2,
    Support=disassemble_2.Support,
    Load=disassemble_2.Load,
    LimitDistance_m=0.005)  # -> Model, Info, Mass_kg, CenterOfGravity
analyzethi_2 = AnalyzeThIKaramba(Model=assemble_2.Model)  # -> CalculatedModel, MaximumDisplacement_m, ResultingForceOfGravity_kN, ElasticEnergy_kNm

model_9 = ModelKaramba(analyzethi_2.CalculatedModel)

model_10 = ModelKaramba(model_9)
modelview_2 = ModelViewKaramba(Model=model_10, LoadCaseFactorsForLinearSuperposition=1, IndexOfVisibleLoadcase=-1)  # -> Model, DeformedMesh, DeformedAxes, DeformedModel
shellview_2 = ShellViewKaramba(Model=modelview_2.Model, IndexOfLayer=0)  # -> Model, MeshesOfRenderedShells, LegendColors, LegendTags
legend_2 = Legend(Colour=shellview_2.LegendColors, Tags=shellview_2.LegendTags, LegendType=1)

model_11 = ModelKaramba(model_9)
modelview_3 = ModelViewKaramba(
    Model=model_11,
    LoadCaseFactorsForLinearSuperposition=1,
    IndexOfVisibleLoadcase=-1,
    ListOfColorsForColoringPlots=gradient_3)  # -> Model, DeformedMesh, DeformedAxes, DeformedModel
shellview_3 = ShellViewKaramba(Model=modelview_3.Model, IndexOfLayer=0)  # -> Model, MeshesOfRenderedShells, LegendColors, LegendTags
legend_3 = Legend(Colour=shellview_3.LegendColors, Tags=shellview_3.LegendTags, LegendType=1)

panel_29 = Panel(analyzethi_2.MaximumDisplacement_m)
model_12 = ModelKaramba(model_9)

graft_9 = GraftTree(Tree=panel_19, IncludeEmptyLists=True, IncludeNullItems=True)
shellvecresults_3 = ResultVectorsOnShellsKaramba(AnalyzedModel=model_12, LayerOfResults=graft_9, mode="PrincStress")  # -> AnalyzedModel, Points, FirstPrincipalStressVector_kN_cm2, SecondPrincipalStressVector_kN_cm2, FirstPrincipalStressValue_kN_cm2, SecondPrincipalStressValue_kN_cm2
shellvecresults_4 = ResultVectorsOnShellsKaramba(AnalyzedModel=model_12, mode="PrincForce")  # -> AnalyzedModel, Points, FirstPrincipalNormalForceVector_kN_m, SecondPrincipalNormalForceVector_kN_m, FirstPrincipalMomentVector_kN, SecondPrincipalMomentVector_kN, FirstPrincipalNormalForceValue_kN_m, SecondPrincipalNormalForceValue_kN_m, FirstPrincipalMomentValue_kN, SecondPrincipalMomentValue_kN
path_mapper_4 = PathMapper(shellvecresults_3.SecondPrincipalStressValue_kN_cm2, source="{A;B}", target="{A;B+7}")
path_mapper_5 = PathMapper(shellvecresults_3.FirstPrincipalStressValue_kN_cm2, source="{A;B}", target="{A;B+4}")
entwine_5 = Entwine(
    Branch00=shellvecresults_4.FirstPrincipalNormalForceValue_kN_m,
    Branch01=shellvecresults_4.SecondPrincipalNormalForceValue_kN_m,
    Branch02=shellvecresults_4.FirstPrincipalMomentValue_kN,
    Branch03=shellvecresults_4.SecondPrincipalMomentValue_kN,
    FlattenInputs=True)  # -> simplify(Result)
merge_10 = Merge(Data1=entwine_5, Data2=simplify(path_mapper_5), Data3=simplify(path_mapper_4))

s_forces = ShellForcesKaramba(AnalyzedModel=model_12, LCase=0, mode="Local")  # -> AnalyzedModel, Nxx_kN_m, Nyy_kN_m, Nxy_kN_m, Mxx_kN, Myy_kN, Mxy_kN, Vx_kN_m, Vy_kN_m
graft_10 = GraftTree(Tree=s_forces.Nxx_kN_m, IncludeEmptyLists=True, IncludeNullItems=True)  # -> simplify(Tree)
graft_11 = GraftTree(Tree=s_forces.Nyy_kN_m, IncludeEmptyLists=True, IncludeNullItems=True)  # -> simplify(Tree)
graft_12 = GraftTree(Tree=s_forces.Nxy_kN_m, IncludeEmptyLists=True, IncludeNullItems=True)  # -> simplify(Tree)
graft_13 = GraftTree(Tree=s_forces.Mxx_kN, IncludeEmptyLists=True, IncludeNullItems=True)  # -> simplify(Tree)
graft_14 = GraftTree(Tree=s_forces.Myy_kN, IncludeEmptyLists=True, IncludeNullItems=True)  # -> simplify(Tree)
graft_15 = GraftTree(Tree=s_forces.Mxy_kN, IncludeEmptyLists=True, IncludeNullItems=True)  # -> simplify(Tree)
graft_16 = GraftTree(Tree=s_forces.Vx_kN_m, IncludeEmptyLists=True, IncludeNullItems=True)  # -> simplify(Tree)
graft_17 = GraftTree(Tree=s_forces.Vy_kN_m, IncludeEmptyLists=True, IncludeNullItems=True)  # -> simplify(Tree)
merge_11 = Merge(
    Data1=graft_10,
    Data2=graft_11,
    Data3=graft_12,
    Data4=graft_13,
    Data5=graft_14,
    Data6=graft_15,
    Data7=graft_16,
    Data8=graft_17)
flip = FlipMatrix(Data=merge_11)

num_77 = Number(merge_10)
num_78 = Number(flip)

txt_23 = Text(flatten(txt))
data_3 = Data(data)

num_79 = Number(num_78)

# ---- group: Assign Local Internal Forces to sMesh
python_3 = GhPythonScript(s_mesh=data_3, int_forces=num_79, force_tags=txt_23)  # -> out, s_mesh; inputs int_forces: tree, force_tags: list
# ---------- python_3: Python ----------
__author__ = "Rafael Pastrana"
__name__ = "Mesh Maker"
__date__ = "2018.07.19"
__version__ = "0.0.1"


# 1. Import dependencies
import rhinoscriptsyntax as rs
import copy

# 2. Start System
# set vector attributes
my_mesh = s_mesh


for idx, int_force in enumerate(int_forces.Branches):
    tag = force_tags[idx]
    
    for f_key in my_mesh.c_mesh.faces():
        force = int_force[f_key]
        if force == 0:
            force = 1e-7
            
        my_mesh.c_mesh.set_face_attribute(f_key, str(tag), force)

s_mesh = my_mesh
# ---------- end python_3 ----------

# ----
data_4 = Data(python_3.s_mesh)
data_5 = Data(data_4)
num_80 = Number(num_77)

# ---- group: Assign Principal Internal Forces to sMesh
python_4 = GhPythonScript(s_mesh=data_5, int_forces=num_80, force_tags=txt_12)  # -> out, s_mesh; inputs int_forces: tree, force_tags: list
# ---------- python_4: Python ----------
__author__ = "Rafael Pastrana"
__name__ = "Mesh Maker"
__date__ = "2018.07.19"
__version__ = "0.0.1"


# 1. Import dependencies
import rhinoscriptsyntax as rs
import copy

TAG = '_val'
my_mesh = s_mesh

# 2. Start System
# set vector attributes
for idx, int_force in enumerate(int_forces.Branches):
    f_tag = force_tags[idx] + TAG
    
    for f_key in my_mesh.c_mesh.faces():
        force = int_force[f_key]
        if force == 0:
            force = 1e-7
        my_mesh.c_mesh.set_face_attribute(f_key, str(f_tag), force)

s_mesh = my_mesh
# ---------- end python_4 ----------

# ----
data_6 = Data(python_4.s_mesh)
data_7 = Data(data_6)

mesh_11 = Mesh(mesh_8)
line_3 = Line(crv_21)

line_topo_2 = LineTopology(ListOfLines=line_3, Tolerance=0.001)  # -> ListOfPoints, LinePointStructure, PointPointStructure, PointLineStructure
meshcp = MeshClosestPoint(Point=line_topo_2.ListOfPoints, Mesh=mesh_11)  # -> Point, Index, Parameter
facen = FaceNormals(Mesh=mesh_11)  # -> Centers, Normals
item_10 = ListItem(List=facen.Normals, Index=meshcp.Index, Wrap=True)
unit = UnitVector(Vector=item_10)
multiplication_8 = Multiplication(A=unit, B="0.1")
pl = PlaneNormal(Origin=meshcp.Point, ZAxis=unit)
vdisex_2 = VectorDisplayEx(Point=meshcp.Point, Vector=multiplication_8, Colour=RGB(0, 0, 0), Width=2)

meval = MeshEval(Mesh=mesh_11, Parameter=meshcp.Parameter)  # -> Point, Normal, Colour

int_19 = Integer(line_topo_2.PointPointStructure)
pln = Plane(pl)
pt_20 = Point(line_topo_2.ListOfPoints)

crv_22 = Curve(crv_20)
pt_21 = Point(pt_20)
explode_2 = Explode(Curve=crv_22, Recursive=True)  # -> Segments, simplify(Vertices)
python_5 = GhPythonScript(pts=pt_21, y=explode_2.Vertices, tol=Slider(0.01, range=0..0.01))  # -> out, a; inputs pts: list of Point3d, y: tree of Point3d
# ---------- python_5: Python ----------
__author__ = "ARPJ"
__version__ = "2018.09.16"

import rhinoscriptsyntax as rs
import clr
clr.AddReference("Grasshopper")
import Grasshopper.Kernel.Data.GH_Path as ghpath
import Grasshopper.DataTree as datatree
import System
 
a = datatree[System.Object]()
import compas.geometry as cg
from compas.geometry import KDTree

search_points = list(map(lambda x: [x.X, x.Y, x.Z], pts))
search_tree = KDTree(search_points)

for idx, branch in enumerate(y.Branches):

    for point in branch:
        pt = [point.X, point.Y, point.Z]
        nbr, label, d = search_tree.nearest_neighbor(pt)
        print('distance is {}'.format(d))
        if d <= tol:
            a.Add(point, ghpath(idx))
# ---------- end python_5 ----------
pline_2 = PolyLine(Vertices=python_5.a, Closed=False)
intcrv = Interpolate(Vertices=python_5.a, Degree="3", Periodic=False, KnotStyle=1)  # -> Curve, Length, Domain
crv_23 = Curve(pline_2)

pln_2 = Plane(pln)
pt_22 = Point(pt_20)
int_20 = Integer(int_19)

gcfl = GetCellsFromLines(Connectivity=int_20, Points=pt_22, Planes=pln_2)
int_21 = Integer(gcfl)
pt_23 = Point(pt_22)
pt_24 = Point(pt_23)
cir = Circle(Plane=pt_24, Radius="0.04")
crv_24 = Curve(cir)
item_11 = ListItem(List=pt_23, Index=int_21, Wrap=True)
pt_25 = Point(pt_23)
int_22 = Integer(int_21)
pline_3 = PolyLine(Vertices=item_11, Closed=False)
python_6 = GhPythonScript(rs_points=pt_25, topology=int_22)  # -> out, mesh_face_centroids, mesh_edges, mesh_vertices, mesh_face_vertices; inputs rs_points: list of Point3d, topology: tree of Int32
# ---------- python_6: Python ----------
__author__ = "ARPJ"
__version__ = "2018.07.25"

import rhinoscriptsyntax as rs
import compas.datastructures
import compas_rhino
import System
import clr
clr.AddReference("Grasshopper")
import Grasshopper.Kernel.Data.GH_Path as ghpath
import Grasshopper.DataTree as datatree
import Rhino.Geometry as rg
from compas.datastructures import Mesh
from compas.datastructures import Network

FACTOR = 5

def get_coordinates(points):
    return [(point.X, point.Y, point.Z) for point in points]

def get_line_coordinates(lines):
    line_coords = []
    for line in lines:
          line_coord = rs.CurveStartPoint(line), rs.CurveEndPoint(line)
          line_coords.append(get_coordinates(line_coord))
    return line_coords

def get_edges_lines(dstr, geo=True):
    edges = []
    for u, v in dstr.edges():
        start, end = dstr.edge_coordinates(u, v)
        if geo is True:
            edges.append(rs.AddLine(start, end))
        else:
            edges.append((start, end))
    return edges
    
def get_vertices_points(dstr, geo=True):
    points = []
    for v in dstr.vertices():
        if geo is True:
            points.append(rs.AddPoint(dstr.vertex_coordinates(v)))
        else:
            points.append(dstr.vertex_coordinates(v))
    return points

def get_faces_centroids(dstr):
    centroids = []
    for f_key in dstr.faces():
        pt = rs.AddPoint(*dstr.face_centroid(f_key))
        centroids.append(pt)
    return centroids

def get_vertices_faces(gh_mesh):
    vertices = [[v.X, v.Y, v.Z] for v in rs.MeshVertices(gh_mesh)]
    faces = [list(face) for face in rs.MeshFaceVertices(gh_mesh)]
    return vertices, faces
    
def get_face_rs_vertices(c_mesh):
    f_ver = datatree[System.Object]()
    
    for idx, f in enumerate(c_mesh.faces()):
        f_ver.AddRange([rg.Point3d(*c) for c in c_mesh.face_coordinates(f)], ghpath(idx))
    
    return f_ver
    
def get_faces_topology(topo):
    faces = []
    for cell in topo.Branches:
        new_cell =[value for value in cell]
        faces.append(new_cell)
    return faces

def sanitize_faces(mesh):
    ids = []
    h_e = [mesh.face_halfedges(f) for f in mesh.faces()]
    
    thres = sum(list(map(lambda x: len(x), h_e))) / len(h_e)
    thres = thres * FACTOR
    print('threshold is {}'.format(thres))
    for f in mesh.faces():
        if len(mesh.face_halfedges(f)) > thres:
            ids.append(f)
            
    if len(ids) > 0:
        for id in ids:
            mesh.delete_face(id)
        print('----')
        print('{} faces were sanitized'.format(len(ids)))
    return mesh
        
def sanitize_edges(mesh):
    ids = []
    for u, v in mesh.edges():
        num_f = list(mesh.edge_faces(u, v))
        
        if None in num_f:
            clean_num_f = [x for x in num_f if x is not None]
            if len(clean_num_f) > 1:
                com = [(f, len(mesh.face_vertices(f))) for f in clean_num_f]
                com = sorted(com, key=lambda x: x[1])
                ids.append(com[-1][0])
    
    if len(ids) > 0:
        for id in ids:
            mesh.delete_face(id)
        print('----')
        print('{} faces were sanitized'.format(len(ids)))
    return mesh

m_v = get_coordinates(rs_points)
m_f = get_faces_topology(topology)

# print(len(m_v))
# print(len(m_f))
# print(m_f[1])

c_mesh = Mesh.from_vertices_and_faces(m_v, m_f)
#c_mesh = sanitize_edges(c_mesh)
c_mesh = sanitize_faces(c_mesh)
#print(c_mesh)

# cull out redundant faces
# 1. faces that contain several faces

# display
mesh_face_centroids = get_faces_centroids(c_mesh)
mesh_edges = get_edges_lines(c_mesh)
mesh_vertices = get_vertices_points(c_mesh)
mesh_face_vertices = get_face_rs_vertices(c_mesh)
# ---------- end python_6 ----------
panel_30 = Panel(python_6.out)
line_4 = Line(python_6.mesh_edges)
pt_26 = Point(python_6.mesh_face_vertices)
pt_27 = Point(python_6.mesh_face_centroids)
pt_28 = Point(python_6.mesh_vertices)

panel_31 = Panel("""bottom layer
top layer
center layer
total """)
panel_32 = Panel("""asx_b
asx_t
asy_b
asy_t
asx_c
asy_c""")

entwine_6 = Entwine(
    Branch00=ColourSwatch(SwatchColor=RGB(0, 124, 247)),
    Branch01=ColourSwatch(SwatchColor=RGB(1, 35, 97)),
    Branch02=ColourSwatch(SwatchColor=RGB(1, 97, 92)),
    FlattenInputs=True)

entwine_7 = Entwine(
    Branch00=ColourSwatch(SwatchColor=RGB(227, 9, 118)),
    Branch01=ColourSwatch(SwatchColor=RGB(214, 204, 4)),
    FlattenInputs=True)

X_2 = UnitX(Factor="6")

X_3 = UnitX(Factor="6")

entwine_8 = Entwine(
    Branch00=ColourSwatch(SwatchColor=RGB(0, 255, 38)),
    Branch01=ColourSwatch(SwatchColor=RGB(255, 0, 0)),
    Branch02=ColourSwatch(SwatchColor=RGB(0, 128, 255)),
    FlattenInputs=True)
X_4 = UnitX(Factor="0")

# ---- group: Make RC Design
python_7 = GhPythonScript(run=bool_9, s_mesh=data_7, heights=num_28, covers=num_29, fck=num_30, fy=num_31, fctd_factor=num_32, force_tags=txt_13)  # -> out, s_mesh, asxb, asxt, asyb, asyt, asxc, asyc, ast; inputs run: Boolean, force_tags: list
# ---------- python_7: Python ----------
"""NOTE 18.08.01: Bottom and Top were inverted for compatibility"""

__author__ = "Rafael Pastrana"
__name__ = "Sandwich"
__date__ = "2018.08.01"
__version__ = "0.0.2"

# 1. Import dependencies
import sys
import imp
import rhinoscriptsyntax as rs

# 1-b. Replace with your own path here
sys.path.append("Z:\projects\streamlines\src\streamlines")

import materials
import basic_sandwich

imp.reload(materials)
imp.reload(basic_sandwich)

from basic_sandwich import ReinforcedShell
from materials import Concrete
from materials import Rebar


# 2. Create Input Material Data
myConcrete = Concrete(fck)
myRebar = Rebar(fy)
#myConcrete.printSummary()

# 3. Perform Reinforcement Design
my_mesh = s_mesh

asxb = []
asyb = []
asxt = []
asyt = []
asxc = []
asyc = []

ast = []
shells = []

if run is True:
    for idx, f_key in enumerate(s_mesh.c_mesh.faces()):
        forces = s_mesh.c_mesh.get_face_attributes(f_key, force_tags)
        myForces = {str(a): b for a, b in zip(force_tags, forces)}
        
        myShell = ReinforcedShell(idx, myConcrete, myRebar, heights, covers)
        myShell.tcred = myShell.concrete.fctd * fctd_factor
        
        # 4. Perform Reinforcement Design Routine
        myShell.applyForces(**myForces)
        
        # new version 25.08.18
        myShell.get_membrane_forces()
        myShell.get_reinforcement_forces()
        myShell.design_reinforcement()
        
        # 5. Append Results to Output Lists. Bottom and top were inverted
        shells.append(myShell)
        
        asxb.append(myShell.asxt)
        asyb.append(myShell.asyt)
        
        asxt.append(myShell.asxb)
        asyt.append(myShell.asyb)
        
        asxc.append(myShell.asxc)
        asyc.append(myShell.asyc)
        
        ast.append(myShell.ast)
        
        # 6. Set Face Attributes. Bottom and top were inverted
        my_mesh.c_mesh.set_face_attribute(f_key, 'asx_b', myShell.asxt)
        my_mesh.c_mesh.set_face_attribute(f_key, 'asx_t', myShell.asxb)
        my_mesh.c_mesh.set_face_attribute(f_key, 'asy_b', myShell.asyt)
        my_mesh.c_mesh.set_face_attribute(f_key, 'asy_t', myShell.asyb)
        
        my_mesh.c_mesh.set_face_attribute(f_key, 'asx_c', myShell.asxc)
        my_mesh.c_mesh.set_face_attribute(f_key, 'asy_c', myShell.asyc)
        
        my_mesh.c_mesh.set_face_attribute(f_key, 'asx_', (myShell.asxc + myShell.asxt + myShell.asxb))
        my_mesh.c_mesh.set_face_attribute(f_key, 'asy_', (myShell.asyc + myShell.asyt + myShell.asyb))
    
        
    # 6. Retrieve Statistics
    print("# of Elements with Crushed Core: {}".format(len([shell for shell in shells if shell.coreCrush == True])))
    print("# of Elements with Crushed Top Cover: {}".format(len([shell for shell in shells if shell.tsupCrush == True])))
    print("# of Elements with Crushed Bottom Cover: {}".format(len([shell for shell in shells if shell.tinfCrush == True])))
    print("----------------------------------")
    print("Shear Force Vo in Crushed Core Elements: {}".format([shell.vo for shell in shells if shell.coreCrush == True]))
    print("----------------------------------")
# ---------- end python_7 ----------

num_81 = Number(python_7.asyt)
num_82 = Number(python_7.ast)
num_83 = Number(python_7.asyb)
num_84 = Number(python_7.asxb)
num_85 = Number(python_7.asxt)

# ----
num_86 = Number(python_7.asxc)
num_87 = Number(python_7.asyc)
num_88 = Number(num_86)
num_89 = Number(num_87)

# ---- group: Make RC Design (continued)
num_90 = Number(num_84)
num_91 = Number(num_85)
num_92 = Number(num_83)
num_93 = Number(num_81)
entwine_9 = Entwine(Branch00=num_90, Branch01=num_91, Branch02=num_92, Branch03=num_93, Branch04=num_88, Branch05=num_89, FlattenInputs=True)

# ----
entwine_10 = Entwine(Branch00=num_90, Branch01=num_91, Branch02=num_92, Branch03=num_93, FlattenInputs=True)

data_8 = Data(python_7.out)
num_94 = Number(entwine_9)

data_9 = Data(python_7.s_mesh)
num_95 = Number(entwine_10)

# ---- group: s_mesh
data_10 = Data(data_9)

# ----
python_8 = GhPythonScript(s_mesh=data_10, diam=num_55, max_sp=num_56)  # -> out, s_mesh, sp_asx, sp_asy; inputs diam: list, max_sp: list
# ---------- python_8: Python ----------
# 1. Import dependencies
import rhinoscriptsyntax as rs
import Rhino.Geometry as rg
import math


# 1-b. Define Globals
TAG = 'spacing_'
TOL = 1e-6
AS_TAGS = ['asx_', 'asy_']
my_mesh = s_mesh

# 1-c. Define Functions

def get_bar_area(diameter):
    return math.pi * math.pow((diameter / 10), 2) / 4

def steel_area_to_spacing(steel_areas, diameter, max):
    spacings = []
    bar_area = get_bar_area(diameter)
    
    for s_area in steel_areas:
        if s_area < TOL:
            s_area = TOL
        spacing = s_area / bar_area
        spacing = 1 / spacing
        
        if spacing > max:
            spacing = max
        spacings.append(spacing)
    return spacings

# 2. Set Data
for f_key in my_mesh.c_mesh.faces():
    for as_tag in AS_TAGS:
        steel_area = my_mesh.c_mesh.get_face_attribute(f_key, as_tag)
        if as_tag[2] == 'x':
            sp = steel_area_to_spacing([steel_area], diam[0], max_sp[0])[0]
            my_mesh.c_mesh.set_face_attribute(f_key, TAG+as_tag, sp)
            my_mesh.c_mesh.set_face_attribute(f_key, 'bar_diameter_x', diam[0])
            
        elif as_tag[2] == 'y':
            sp = steel_area_to_spacing([steel_area], diam[1], max_sp[1])[0]
            my_mesh.c_mesh.set_face_attribute(f_key, TAG+as_tag, sp)
            my_mesh.c_mesh.set_face_attribute(f_key, 'bar_diameter_y', diam[1])
            
# 3. Get Data

s_mesh = my_mesh
keys = [f_key for f_key in my_mesh.c_mesh.faces()]

sp_asx_ = my_mesh.c_mesh.get_faces_attribute(keys, TAG+AS_TAGS[0])
sp_asy_ = my_mesh.c_mesh.get_faces_attribute(keys, TAG+AS_TAGS[1])

t_sp_asx_ = sorted(sp_asx_)
t_sp_asy_ = sorted(sp_asy_)

print('Spacings for ASX_ min is {0}. max is {1}'.format(t_sp_asx_[0], t_sp_asx_[-1]))
print('Spacings for ASY_ min is {0}. max is {1}'.format(t_sp_asy_[0], t_sp_asy_[-1]))
# ---------- end python_8 ----------
data_11 = Data(python_8.out)
num_96 = Number(python_8.sp_asx)
num_97 = Number(python_8.sp_asy)
data_12 = Data(python_8.s_mesh)

# ---- group: s_mesh
data_13 = Data(data_12)

# ----
python_9 = GhPythonScript(s_mesh=data_13, perc=num_57)  # -> out, s_mesh, face_centers, seeds_x, seeds_y; inputs perc: list
# ---------- python_9: Python ----------
# 1. Import dependencies
import rhinoscriptsyntax as rs
import Rhino.Geometry as rg
import math


# 1-b. Define Globals
my_mesh = s_mesh
TAG = 'spacing_'
TOL = 1e-6
AS_TAGS = ['asx_', 'asy_']
seeds_x = []
seeds_y = []
face_centers = []

# 1-c. Define Functions

# 2. Set and Get Data
as_dir_1 = TAG + AS_TAGS[0]
as_dir_2 = TAG + AS_TAGS[1]
keys = [f_key for f_key in my_mesh.c_mesh.faces()]

max_dir_1 = sorted(my_mesh.c_mesh.get_faces_attribute(keys, as_dir_1))[-1]
max_dir_2 = sorted(my_mesh.c_mesh.get_faces_attribute(keys, as_dir_2))[-1]
print('Max AS in dir X is {} cm2/m. In dir Y is {} cm2/m'.format(max_dir_1, max_dir_2))

for f_key in my_mesh.c_mesh.faces():
    my_as_dir_1 = my_mesh.c_mesh.get_face_attribute(f_key, as_dir_1)
    my_as_dir_2 = my_mesh.c_mesh.get_face_attribute(f_key, as_dir_2)
    pt = rg.Point3d(*my_mesh.c_mesh.face_centroid(f_key))
    
    face_centers.append(pt)
    if my_as_dir_1 <= max_dir_1 * perc[0]:
        seeds_x.append((pt, my_as_dir_1))
    if my_as_dir_2 <= max_dir_2 * perc[1]:
        seeds_y.append((pt, my_as_dir_2))

s_mesh = my_mesh
seeds_x = [seed[0] for seed in sorted(seeds_x, key=lambda x: x[1])]
seeds_y = [seed[0] for seed in sorted(seeds_y, key=lambda x: x[1])]

print('Number of Seeds in X direction is {}'.format(len(seeds_x)))
print('Number of Seeds in Y direction is {}'.format(len(seeds_y)))
# ---------- end python_9 ----------
pt_29 = Point(python_9.seeds_y)

# ---- group: seeds Y
pt_30 = Point(pt_29)

# ----
pt_31 = Point(python_9.seeds_x)

# ---- group: seeds X
pt_32 = Point(pt_31)

# ----
entwine_11 = Entwine(Branch00=pt_32, Branch01=pt_30, FlattenInputs=True)
filter = StreamFilter(Gate=bool_8, Stream1=entwine_11)
dots = DotDisplay(Point=filter, Colour=entwine_7, Size="0.01")

data_14 = Data(python_9.out)
data_15 = Data(python_9.s_mesh)  # disabled
pt_33 = Point(python_9.face_centers)  # disabled

# ---- group: s_mesh
data_16 = Data(data_12)

data_17 = Data(data_12)

data_18 = Data(data_12)

data_19 = Data(data_12)

# ----
python_10 = GhPythonScript(show=bool_13, s_mesh=data_17, vector_tag=txt_16, v_scale=num_35)  # -> out, s_mesh, line_field, node_line_field, centers_line_field, colors_line_field, colors_node_line_field, colors_centers_line_field, vectors_a, vectors_b; inputs show: Boolean
# ---------- python_10: Python ----------
"""Retrieves data from a Structural Mesh object"""

__author__ = "Rafael Pastrana"
__name__ = "Mesh Displayer"
__date__ = "2018.07.24"
__version__ = "0.0.1"


# 1. Import dependencies
import imp
import rhinoscriptsyntax as rs
import sys
sys.path.append("Z:\projects\streamlines\src\streamlines")
import display
imp.reload(display)
from display import Display
import compas.geometry as cg

dsp = Display()

# 2. Start System
my_mesh = s_mesh
v_name = vector_tag
TAG = '_val'

if show is True:
    # vector properties
    line_field = dsp.draw_face_vectors(my_mesh, v_name, v_scale)
    node_line_field = dsp.draw_node_vectors(my_mesh, v_name, v_scale)
    center_vectors = my_mesh.find_vector_face_centers(v_name)
    centers = list(map(lambda x: my_mesh.c_mesh.face_centroid(x), my_mesh.c_mesh.faces()))
    centers_line_field = dsp.draw_vectors(centers, center_vectors, v_scale)
        
    f_color = []
    for f_key in my_mesh.c_mesh.faces():
        val = my_mesh.c_mesh.get_face_attribute(f_key, v_name+TAG)
        if val:
            if val < 0:
                f_color.append(rs.CreateColor(255,0,0))
            else:
                f_color.append(rs.CreateColor(0,0,255))
        else:
            f_color.append(rs.CreateColor(0,0,255))
            
    n_color = []
    for v_key in my_mesh.c_mesh.vertices():
        val = my_mesh.c_mesh.get_vertex_attribute(v_key, v_name+TAG)
        if val < 0:
            n_color.append(rs.CreateColor(0,0,0))
        else:
            n_color.append(rs.CreateColor(0,0,0))
    
    colors_line_field = f_color
    colors_node_line_field = n_color
    colors_centers_line_field = f_color
    
    vectors_a = list(map(lambda x: my_mesh.c_mesh.get_vertex_attribute(x,v_name+'_a'), my_mesh.c_mesh.vertices()))
    vectors_a = list(map(lambda x: rs.CreateVector(*x), vectors_a))
    
    vectors_b = list(map(lambda x: my_mesh.c_mesh.get_vertex_attribute(x,v_name+'_b'), my_mesh.c_mesh.vertices()))
    vectors_b = list(map(lambda x: rs.CreateVector(*x), vectors_b))
# ---------- end python_10 ----------
python_11 = GhPythonScript(show=bool_14, s_mesh=data_18, vector_tag=txt_18, v_scale=num_34)  # -> out, s_mesh, line_field, node_line_field, centers_line_field, colors_line_field, colors_node_line_field, colors_centers_line_field, vectors_a, vectors_b; inputs show: Boolean; same code as python_10
python_12 = GhPythonScript(show=bool_10, s_mesh=data_16, data_tag=txt_15, mode=txt_14)  # -> out, s_mesh, display_mesh, color_data, data_values; inputs show: Boolean
# ---------- python_12: Python ----------
"""Retrieves data from a Structural Mesh object"""

__author__ = "Rafael Pastrana"
__name__ = "Mesh Displayer"
__date__ = "2018.07.24"
__version__ = "0.0.1"


# 1. Import dependencies
import imp
import copy
import rhinoscriptsyntax as rs
import sys
sys.path.append("Z:\Dropbox\Documentos\ETH Zuerich\ETH MAS Thesis\code\current")

import Display
imp.reload(Display)
from Display import Display

dsp = Display()
my_mesh = s_mesh

# 2. Start System
if show is True:
    display_mesh = my_mesh.gh_mesh
    color_data = None
    data_values = my_mesh.get_data_on_nodes(data_tag, mode)
    # display_mesh, data_values, color_data = dsp.plot_mesh(my_mesh, data_tag, mode)
# ---------- end python_12 ----------
data_20 = Data(python_12.s_mesh)
python_13 = GhPythonScript(s_mesh=data_19, steel_density="7.85")  # -> out, steel_mass, mass_bot, mass_top, mass_center
# ---------- python_13: Python ----------
"""Retrieves data from a Structural Mesh object"""

__author__ = "Rafael Pastrana"
__name__ = "Steel Mass Calculator"
__date__ = "2018.08.02"
__version__ = "0.0.1"


# 1. Import dependencies
import rhinoscriptsyntax as rs

# 2. Define Globals
DENSITY = steel_density  # kg/cm3
TOL = 1e-6
AS_TAGS = ['asx_b', 'asx_t', 'asy_b', 'asy_t', 'asx_c', 'asy_c']

# 3. Start System
my_mesh = s_mesh
face_areas = list(map(lambda x: my_mesh.c_mesh.face_area(x), my_mesh.c_mesh.faces()))

# 4. Get Mass at Bottom Layer
m_asx_b = list(map(lambda x: DENSITY * my_mesh.c_mesh.get_face_attribute(x,AS_TAGS[0]), my_mesh.c_mesh.faces()))
m_asy_b = list(map(lambda x: DENSITY * my_mesh.c_mesh.get_face_attribute(x,AS_TAGS[2]), my_mesh.c_mesh.faces()))

m_asx_t = list(map(lambda x: DENSITY * my_mesh.c_mesh.get_face_attribute(x,AS_TAGS[1]), my_mesh.c_mesh.faces()))
m_asy_t = list(map(lambda x: DENSITY * my_mesh.c_mesh.get_face_attribute(x,AS_TAGS[3]), my_mesh.c_mesh.faces()))

m_asx_c = list(map(lambda x: DENSITY * my_mesh.c_mesh.get_face_attribute(x,AS_TAGS[4]), my_mesh.c_mesh.faces()))
m_asy_c = list(map(lambda x: DENSITY * my_mesh.c_mesh.get_face_attribute(x,AS_TAGS[5]), my_mesh.c_mesh.faces()))

mass_bot = reduce(lambda x, y: x+y, [sum(x)*face_areas[idx] for idx, x in enumerate(zip(m_asx_b, m_asy_b))])
mass_top = reduce(lambda x, y: x+y, [sum(x)*face_areas[idx] for idx, x in enumerate(zip(m_asx_t, m_asy_t))])
mass_center = reduce(lambda x, y: x+y, [sum(x)*face_areas[idx] for idx, x in enumerate(zip(m_asx_c, m_asy_c))])

steel_mass = mass_bot + mass_top + mass_center
# ---------- end python_13 ----------
python_14 = GhPythonScript(x=data_20)  # -> out, a
# ---------- python_14: Python ----------
__author__ = "ARPJ"
__version__ = "2018.08.01"

import rhinoscriptsyntax as rs

print('number of edges is: {}'.format(len([e for e in x.c_mesh.edges()])))
# ---------- end python_14 ----------
num_98 = Number(python_13.steel_mass)
num_99 = Number(python_13.mass_bot)
num_100 = Number(python_13.mass_top)
num_101 = Number(python_13.mass_center)
num_102 = Number(num_101)

num_103 = Number(num_98)
num_104 = Number(num_99)
num_105 = Number(num_100)
data_21 = Data(data_11)
data_22 = Data(data_14)
num_106 = Number(num_94)
data_23 = Data(data_8)
entwine_12 = Entwine(Branch00=num_104, Branch01=num_105, Branch02=num_102, Branch03=num_103, FlattenInputs=True)
num_107 = Number(num_94)
bnd = Bounds(Numbers=num_106)
sort = SortList(Keys=num_107)  # -> Keys, ValuesA
concat = Concatenate(FragmentA=graft(panel_32), FragmentB="domain is:", FragmentC=bnd, JoinSeparator=" ")
concat_2 = Concatenate(FragmentA=graft(panel_31), FragmentB="mass is:", FragmentC=entwine_12, FragmentD="kg", JoinSeparator=" ")
panel_33 = Panel(data_21)
panel_34 = Panel(data_22)
panel_35 = Panel(data_23)
reinforcement_areas_domain_cm2_m = Panel(concat)
graph = QuickGraph(sort.Keys, SortOrder=0)
reinforcement_areas_domain_cm2_m_2 = Panel(concat_2)

panel_36 = Panel(python_14.out)
num_108 = Number(python_12.data_values)
mesh_12 = Mesh(python_12.display_mesh)
mesh_13 = Mesh(mesh_12)
wbnaked = WeaverbirdsNakedBoundary(MeshClosedPolylines=mesh_13)

entwine_13 = Entwine(Branch00=wbnaked, Branch01=crv_5, Branch02=crv_6, FlattenInputs=True)
previewlw = CustomPreviewLineweights(Geometry=entwine_13, Shader=entwine_6, Thickness="4", Absolute=False)

col = Colour(python_12.color_data)
line_5 = Line(python_10.centers_line_field)
line_6 = Line(python_10.line_field)
col_2 = Colour(python_10.colors_line_field)
col_3 = Colour(python_10.colors_centers_line_field)
vec_27 = Vector(python_10.vectors_a)
line_7 = Line(python_11.line_field)
line_8 = Line(python_11.centers_line_field)
col_4 = Colour(python_11.colors_line_field)
col_5 = Colour(python_11.colors_centers_line_field)
vec_28 = Vector(python_11.vectors_a)
vec_29 = Vector(python_10.vectors_b)
vec_30 = Vector(python_11.vectors_b)
line_9 = Line(python_10.node_line_field)

line_10 = Line(line_6)
line_11 = Line(line_9)
line_12 = Line(line_5)

line_13 = Line(flatten(line_11))
line_14 = Line(line_13)
end_2 = EndPoints(Curve=graft(line_14))  # -> Start, End
vec2pt = Vector2Pt(PointA=end_2.Start, PointB=end_2.End, Unitize=False)  # -> flatten(Vector), Length
evaluate_curve = EvaluateCurve(Curve=graft(line_14), Parameter=0.5)  # -> Point, Tangent, Angle
vec2pt_2 = Vector2Pt(PointA=end_2.Start, PointB=end_2.End, Unitize="True")  # -> Vector, Length
vlen = VectorLength(Vector=vec2pt.Vector)
multiplication_9 = Multiplication(A=vec2pt_2.Vector, B=Slider(0.04, range=0..0.1))
reverse = Reverse(Vector=multiplication_9)
bnd_2 = Bounds(Numbers=vlen)
remap = RemapNumbers(Value=vlen, Source=bnd_2, Target=Domain(0, 1))  # -> Mapped, Clipped
move = Move(Geometry=evaluate_curve.Point, Motion=reverse)  # -> Geometry, Transform
move_2 = Move(Geometry=line_13, Motion=Z_2)  # -> Geometry, Transform
move_3 = Move(Geometry=evaluate_curve.Point, Motion=multiplication_9)  # -> Geometry, Transform
graph_2 = GraphMapper(remap.Mapped, x0=0, x1=1, y0=0, y1=1, container_name="Bezier", cpx=[0, 0, 0.3804347813, 1], cpy=[0, 0, 1, 1])
line_15 = Line(StartPoint=move_3.Geometry, EndPoint=move.Geometry)  # -> flatten(Line)
bnd_3 = Bounds(Numbers=graph_2)
line_16 = Line(line_15)
gradient_4 = Gradient(
    LowerLimit="1",
    UpperLimit="-1",
    Parameter=graph_2,
    stops=[0: RGB(255, 0, 0), 0.176: RGB(255, 238, 0), 0.35: RGB(0, 255, 234), 0.504: RGB(35, 4, 128), 0.664: RGB(0, 252, 215), 0.843: RGB(255, 255, 0), 1: RGB(255, 0, 47)])
avr = Average(Input=[end_2.Start, end_2.End])  # -> flatten(ArithmeticMean)
remap_2 = RemapNumbers(Value=graph_2, Source=bnd_3, Target="4 to 0.5")  # -> Mapped, Clipped
scale = Scale(Geometry=line_14, Center=avr, Factor=remap_2.Mapped)  # -> Geometry, Transform
line_17 = Line(scale.Geometry)
col_6 = Colour(gradient_4)
preview = CustomPreview(Geometry=line_17, Material=col_6)
preview_2 = CustomPreview(Geometry=line_14, Material=col_6)
preview_3 = CustomPreview(Geometry=line_16, Material=col_6)
col_7 = Colour(col_6)
line_18 = Line(line_17)
graft_18 = GraftTree(Tree=col_7, IncludeEmptyLists=True, IncludeNullItems=True)
graft_19 = GraftTree(Tree=line_18, IncludeEmptyLists=True, IncludeNullItems=True)
createatts_2 = CreateAttributes(LayerName="colored_vectors", Color=graft_18, enableFullPath=False)
bake = BakeGeometry(Bake=Button(), Geometry=graft_19, Attributes=createatts_2, DeleteOldBakes=False, PreserveTrees=False)
line_19 = Line(python_11.node_line_field)

line_20 = Line(line_7)
line_21 = Line(line_19)
line_22 = Line(line_8)

line_23 = Line(flatten(line_21))
line_24 = Line(line_23)
end_3 = EndPoints(Curve=graft(line_24))  # -> Start, End
vec2pt_3 = Vector2Pt(PointA=end_3.Start, PointB=end_3.End, Unitize=False)  # -> flatten(Vector), Length
vlen_2 = VectorLength(Vector=vec2pt_3.Vector)
bnd_4 = Bounds(Numbers=vlen_2)
remap_3 = RemapNumbers(Value=vlen_2, Source=bnd_4, Target=Domain(0, 1))  # -> Mapped, Clipped
move_4 = Move(Geometry=line_23, Motion=Z_3)  # -> Geometry, Transform
graph_3 = GraphMapper(
    remap_3.Mapped,
    x0=0,
    x1=1,
    y0=0,
    y1=1,
    container_name="Bezier",
    cpx=[0, 0, 1, 1],
    cpy=[0, 0.3821747303, 0.5108695626, 1])
bnd_5 = Bounds(Numbers=graph_3)
gradient_5 = Gradient(
    LowerLimit="1",
    UpperLimit="-1",
    Parameter=graph_3,
    stops=[0: RGB(255, 0, 0), 0.176: RGB(255, 238, 0), 0.35: RGB(0, 255, 234), 0.504: RGB(35, 4, 128), 0.664: RGB(0, 252, 215), 0.843: RGB(255, 255, 0), 1: RGB(255, 0, 47)])
avr_2 = Average(Input=[end_3.Start, end_3.End])  # -> flatten(ArithmeticMean)
remap_4 = RemapNumbers(Value=graph_3, Source=bnd_5, Target="4 to 0.5")  # -> Mapped, Clipped
scale_2 = Scale(Geometry=line_24, Center=avr_2, Factor=remap_4.Mapped)  # -> Geometry, Transform
line_25 = Line(scale_2.Geometry)
col_8 = Colour(gradient_5)
preview_4 = CustomPreview(Geometry=line_25, Material=col_8)
preview_5 = CustomPreview(Geometry=line_24, Material=col_8)
col_9 = Colour(col_8)
line_26 = Line(line_25)
graft_20 = GraftTree(Tree=col_9, IncludeEmptyLists=True, IncludeNullItems=True)
graft_21 = GraftTree(Tree=line_26, IncludeEmptyLists=True, IncludeNullItems=True)
createatts_3 = CreateAttributes(LayerName="colored_vectors", Color=graft_20, enableFullPath=False)
bake_2 = BakeGeometry(Bake=Button(), Geometry=graft_21, Attributes=createatts_3, DeleteOldBakes=False, PreserveTrees=False)
data_24 = Data(python_10.s_mesh)
col_10 = Colour(python_10.colors_node_line_field)

col_11 = Colour(col_2)
col_12 = Colour(col_10)
col_13 = Colour(col_3)

entwine_14 = Entwine(Branch00=line_10, Branch01=line_11, Branch02=line_12, FlattenInputs=True)
entwine_15 = Entwine(Branch00=col_11, Branch01=col_12, Branch02=col_13, FlattenInputs=True)
move_5 = Move(Geometry=entwine_14, Motion=X_2)  # -> Geometry, Transform
preview_6 = CustomPreview(Geometry=line_13, Material=ColourSwatch(SwatchColor=RGB(255, 255, 255)))

data_25 = Data(python_11.s_mesh)

# ---- group: s_mesh
data_26 = Data(data_25)

# ----
python_15 = GhPythonScript(show=bool_11, s_mesh=data_26, vector_tag=txt_17, tol=num_33)  # -> out, s_mesh, face_neg, face_null, face_pos; inputs show: Boolean
# ---------- python_15: Python ----------
"""Retrieves data from a Structural Mesh object"""

__author__ = "Rafael Pastrana"
__name__ = "Mesh Displayer"
__date__ = "2018.07.24"
__version__ = "0.0.1"


# 1. Import dependencies
import rhinoscriptsyntax as rs

# 2. Start System
my_mesh = s_mesh
v_name = vector_tag

if show is True:
    my_mesh.get_face_labels(v_name, tol)
    face_neg, face_null, face_pos = my_mesh.stream_face_labels()
# ---------- end python_15 ----------
data_27 = Data(python_15.s_mesh)

# ---- group: s_mesh
data_28 = Data(data_27)

# ----
python_16 = GhPythonScript(show=bool_12, s_mesh=data_28)  # -> out, s_mesh, face_planes, edge_planes; inputs show: Boolean
# ---------- python_16: Python ----------
"""Retrieves data from a Structural Mesh object"""

__author__ = "Rafael Pastrana"
__name__ = "Mesh Displayer"
__date__ = "2018.07.24"
__version__ = "0.0.1"


# 1. Import dependencies
import rhinoscriptsyntax as rs

# 2. Start System
my_mesh = s_mesh

if show is True:
    # plane properties
    face_planes = list(map(lambda x: my_mesh.cMesh.get_face_attribute(x,'plane'), my_mesh.cMesh.faces()))
    face_planes = [rs.PlaneFromNormal(x[0], x[1]) for x in face_planes]
    
    edge_planes = list(map(lambda x: my_mesh.cMesh.get_edge_attribute(x,'plane'), my_mesh.cMesh.edges()))
    edge_planes = [rs.PlaneFromNormal(x[0], x[1]) for x in edge_planes if x is not None]

s_mesh = s_mesh
# ---------- end python_16 ----------
pt_34 = Point(python_15.face_neg)
pt_35 = Point(python_15.face_null)
pt_36 = Point(python_15.face_pos)

pt_37 = Point(pt_34)
pt_38 = Point(pt_35)
pt_39 = Point(pt_36)  # disabled

entwine_16 = Entwine(Branch00=pt_37, Branch01=pt_38, Branch02=pt_39, FlattenInputs=True)
move_6 = Move(Geometry=entwine_16, Motion=X_4)  # -> Geometry, Transform

circle_cnr = CircleCNR(Center=move_6.Geometry, Normal=Vector(0, 0, 1), Radius="0.05")
custom_preview = CustomPreview(Geometry=circle_cnr, Material=entwine_8)
data_29 = Data(python_16.s_mesh)
pln_3 = Plane(python_16.edge_planes)
pln_4 = Plane(python_16.face_planes)
col_14 = Colour(python_11.colors_node_line_field)

col_15 = Colour(col_4)
col_16 = Colour(col_14)
col_17 = Colour(col_5)

entwine_17 = Entwine(Branch00=line_20, Branch01=line_21, Branch02=line_22, FlattenInputs=True)
entwine_18 = Entwine(Branch00=col_15, Branch01=col_16, Branch02=col_17, FlattenInputs=True)
move_7 = Move(Geometry=entwine_17, Motion=X_3)  # -> Geometry, Transform
preview_7 = CustomPreview(Geometry=line_23, Material=ColourSwatch(SwatchColor=RGB(255, 255, 255)))

data_30 = Data(data_12)
data_31 = Data(data_12)
python_17 = GhPythonScript(
    run=bool_19,
    s_mesh=flatten(data_30),
    weights=num_58,
    dL=num_59,
    min_length=num_60,
    vector_tag=txt_20,
    as_tag=txt_19,
    min_sp=num_61,
    uni_sp=bool_20,
    num_samples=int_17,
    strat_factor=num_62,
    others_prox=num_63,
    start_prox=num_64,
    self_prox=num_65,
    iterations=num_66)  # -> out, str_system; inputs weights: list, uni_sp: Boolean, num_samples: Int32, iterations: Int32
# ---------- python_17: Python ----------
fac__author__ = "Rafael Pastrana"
__name__ = "Streamliner"
__date__ = "2018.08.05"
__version__ = "0.0.4"


# 0. Import dependencies
import sys
import imp
import rhinoscriptsyntax as rs
import clr
clr.AddReference("Grasshopper")
import Grasshopper.Kernel.Data.GH_Path as ghpath
import Grasshopper.DataTree as datatree
import System
import ghpythonlib.parallel as gh_parallel
 
# 0-b. Replace with your own path here
sys.path.append("Z:\projects\streamlines\src\streamlines")
import streamsystem
imp.reload(streamsystem)
from streamsystem import Streamsystem


# 1. Define Globals 
TAG = 'spacing_'
TOL = 1e-6
AS_TAGS = [TAG+'asx_', TAG+'asy_']
MIN_SP = min_sp  # minimum backup separation for objects
UNI_SP = uni_sp  # Ignore Separation Map from RC Design?

W_1 = [weights[0], weights[1], weights[2]]
W_2= [weights[3], weights[4], weights[5]]
vec_tag_dict = {'n_1':'n_2', 'n_2':'n_1', 'm_1':'m_2', 'm_2':'m_1', 'ps_1_top':'ps_2_top', 'ps_1_bot':'ps_2_bot', 'ps_1_mid':'ps_2_mid', 'ps_2_top':'ps_1_top', 'ps_2_bot':'ps_1_bot', 'ps_2_mid':'ps_1_mid', 'custom_1':'custom_2', 'custom_2':'custom_1'}

# 2. Establish Tag Convention
if as_tag == 'asx_':
    as_dir = AS_TAGS[0]
    w = W_1
    vector_tag = vector_tag

elif as_tag == 'asy_':
    as_dir = AS_TAGS[1]
    w = W_2
    vector_tag = vec_tag_dict[vector_tag]

# 3. Create Data Trees for collecting output
streamlines = datatree[System.Object]()
streamlines_objects = datatree[System.Object]()
short_streamlines = datatree[System.Object]()
offsets = datatree[System.Object]()

# 4. Run Streamlines on Direction 1
if run :
    str_system = Streamsystem(s_mesh, as_dir, dL, MIN_SP, UNI_SP)
    str_system.set_tracing_data(vector_tag, w, min_length)
    str_system.make_streamlines_jobard(strat_factor, others_prox, start_prox, self_prox, num_samples, iterations)
# ---------- end python_17 ----------
python_18 = GhPythonScript(
    run=bool_21,
    s_mesh=flatten(data_31),
    weights=num_68,
    dL=num_70,
    min_length=num_67,
    vector_tag=txt_21,
    as_tag=txt_22,
    min_sp=num_71,
    uni_sp=bool_22,
    num_samples=int_18,
    strat_factor=num_72,
    others_prox=num_73,
    start_prox=num_69,
    self_prox=num_74,
    iterations=num_75)  # -> out, str_system; inputs weights: list, uni_sp: Boolean, num_samples: Int32, iterations: Int32
# ---------- python_18: Python ----------
__author__ = "Rafael Pastrana"
__name__ = "Streamliner"
__date__ = "2018.08.05"
__version__ = "0.0.4"


# 0. Import dependencies
import sys
import imp
import rhinoscriptsyntax as rs
import clr
clr.AddReference("Grasshopper")
import Grasshopper.Kernel.Data.GH_Path as ghpath
import Grasshopper.DataTree as datatree
import System
import ghpythonlib.parallel as gh_parallel
 
# 0-b. Replace with your own path here
sys.path.append("Z:\projects\streamlines\src\streamlines")
import streamsystem
imp.reload(streamsystem)
from streamsystem import Streamsystem


# 1. Define Globals 
TAG = 'spacing_'
TOL = 1e-6
AS_TAGS = [TAG+'asx_', TAG+'asy_']
MIN_SP = min_sp  # minimum backup separation for objects
UNI_SP = uni_sp  # Ignore Separation Map from RC Design?

W_1 = [weights[0], weights[1], weights[2]]
W_2= [weights[3], weights[4], weights[5]]
vec_tag_dict = {'n_1':'n_2', 'n_2':'n_1', 'm_1':'m_2', 'm_2':'m_1', 'ps_1_top':'ps_2_top', 'ps_1_bot':'ps_2_bot', 'ps_1_mid':'ps_2_mid', 'ps_2_top':'ps_1_top', 'ps_2_bot':'ps_1_bot', 'ps_2_mid':'ps_1_mid', 'custom_1':'custom_2', 'custom_2':'custom_1'}

# 2. Establish Tag Convention
if as_tag == 'asx_':
    as_dir = AS_TAGS[0]
    w = W_1
    vector_tag = vector_tag

elif as_tag == 'asy_':
    as_dir = AS_TAGS[1]
    w = W_2
    vector_tag = vec_tag_dict[vector_tag]

# 3. Create Data Trees for collecting output
streamlines = datatree[System.Object]()
streamlines_objects = datatree[System.Object]()
short_streamlines = datatree[System.Object]()
offsets = datatree[System.Object]()

# 4. Run Streamlines on Direction 1
if run :
    str_system = Streamsystem(s_mesh, as_dir, dL, MIN_SP, UNI_SP)
    str_system.set_tracing_data(vector_tag, w, min_length)
    str_system.make_streamlines_jobard(strat_factor, others_prox, start_prox, self_prox, num_samples, iterations)

# 5. Collect Streamlines
#    for idx, streamline in enumerate(str_system.streamlines):
#        rh_pts = []
#        for point in streamline.polyline.points:
#            rh_pts.append(rs.AddPoint(*point))
#        streamlines.AddRange(rh_pts, ghpath(idx))
#        streamlines_objects.Add(streamline, ghpath(idx))
#        
#    for idx, streamline in enumerate(str_system.short_streamlines):
#        rh_pts = []
#        for point in streamline.polyline.points:
#            rh_pts.append(rs.AddPoint(*point))
#        short_streamlines.AddRange(rh_pts, ghpath(idx))
#   
#    for idx, streamline in enumerate(str_system.offsets):
#        rh_pts = []
#        for point in streamline.polyline.points:
#            rh_pts.append(rs.AddPoint(*point))
#        offsets.AddRange(rh_pts, ghpath(idx))
#        
#    seed_pts = str_system.seed_pts
#    first_pt = str_system.first_pt


# if run_2:
#     print('dir 2')
#     myStreamSystem = StreamSystem(s_mesh, seeds_2, as_dir_2, dL, MIN_SP, UNI_SP)
#     myStreamSystem.set_data_mebarki(vector_tag_2, W_2, min_length)
# 
#     all_seeds = seeds_2
#     if PARALLEL is True:
#         rh_pts = gh_parallel.run(myStreamSystem.make_streamline_mebarki_parallel, [all_seeds], True)
#     else:
#         rh_pts = myStreamSystem.make_streamline_mebarki_parallel([all_seeds])
# 
#     for idx, pts in enumerate(rh_pts):
#         if pts:
#            streamlines_2.AddRange(pts, ghpath(idx))
# ---------- end python_18 ----------
data_32 = Data(python_17.str_system)
data_33 = Data(python_18.str_system)
panel_37 = Panel(python_17.out)
data_34 = Data(data_32)
data_35 = Data(data_33)
panel_38 = Panel(python_18.out)
python_19 = GhPythonScript(streamsystem=data_34)  # -> out, offsets, first_pt, seed_pts, streamlines, streamlines_objects, short_streamlines
# ---------- python_19: Python ----------
__author__ = "Rafael Pastrana"
__name__ = "Streamliner"
__date__ = "2018.08.05"
__version__ = "0.0.4"


# 0. Import dependencies
import sys
import imp
import rhinoscriptsyntax as rs
import clr
clr.AddReference("Grasshopper")
import Grasshopper.Kernel.Data.GH_Path as ghpath
import Grasshopper.DataTree as datatree
import System
import ghpythonlib.parallel as gh_parallel
 
# 0-b. Replace with your own path here
# sys.path.append("Z:\Dropbox\Documentos\ETH Zuerich\ETH MAS Thesis\code\current")
#import streamsystem
#imp.reload(streamsystem)
#from streamsystem import Streamsystem


# 1. Define Globals 
streamlines = datatree[System.Object]()
streamlines_objects = datatree[System.Object]()
short_streamlines = datatree[System.Object]()
offsets = datatree[System.Object]()


# 5. Collect Streamlines
if streamsystem is not None:
    str_system = streamsystem
    
    for idx, streamline in enumerate(str_system.streamlines):
        rh_pts = []
        for point in streamline.polyline.points:
            rh_pts.append(rs.AddPoint(*point))
        streamlines.AddRange(rh_pts, ghpath(idx))
        streamlines_objects.Add(streamline, ghpath(idx))
        
    for idx, streamline in enumerate(str_system.short_streamlines):
        rh_pts = []
        for point in streamline.polyline.points:
            rh_pts.append(rs.AddPoint(*point))
        short_streamlines.AddRange(rh_pts, ghpath(idx))
    
    for idx, streamline in enumerate(str_system.offsets):
        rh_pts = []
        for point in streamline.polyline.points:
            rh_pts.append(rs.AddPoint(*point))
        offsets.AddRange(rh_pts, ghpath(idx))
        
    seed_pts = str_system.seed_pts
    first_pt = str_system.first_pt
# ---------- end python_19 ----------
python_20 = GhPythonScript(streamsystem=data_35)  # -> out, offsets, first_pt, seed_pts, streamlines, streamlines_objects, short_streamlines
# ---------- python_20: Python ----------
__author__ = "Rafael Pastrana"
__name__ = "Streamliner"
__date__ = "2018.08.05"
__version__ = "0.0.4"


# 0. Import dependencies
import sys
import imp
import rhinoscriptsyntax as rs
import clr
clr.AddReference("Grasshopper")
import Grasshopper.Kernel.Data.GH_Path as ghpath
import Grasshopper.DataTree as datatree
import System
import ghpythonlib.parallel as gh_parallel
 
# 0-b. Replace with your own path here
sys.path.append("Z:\Dropbox\Documentos\ETH Zuerich\ETH MAS Thesis\code\current")
#import streamsystem
#imp.reload(streamsystem)
#from streamsystem import Streamsystem


# 1. Define Globals 
streamlines = datatree[System.Object]()
streamlines_objects = datatree[System.Object]()
short_streamlines = datatree[System.Object]()
offsets = datatree[System.Object]()


# 5. Collect Streamlines
if streamsystem is not None:
    str_system = streamsystem
    
    for idx, streamline in enumerate(str_system.streamlines):
        rh_pts = []
        for point in streamline.polyline.points:
            rh_pts.append(rs.AddPoint(*point))
        streamlines.AddRange(rh_pts, ghpath(idx))
        streamlines_objects.Add(streamline, ghpath(idx))
        
    for idx, streamline in enumerate(str_system.short_streamlines):
        rh_pts = []
        for point in streamline.polyline.points:
            rh_pts.append(rs.AddPoint(*point))
        short_streamlines.AddRange(rh_pts, ghpath(idx))
    
    for idx, streamline in enumerate(str_system.offsets):
        rh_pts = []
        for point in streamline.polyline.points:
            rh_pts.append(rs.AddPoint(*point))
        offsets.AddRange(rh_pts, ghpath(idx))
        
    seed_pts = str_system.seed_pts
    first_pt = str_system.first_pt
# ---------- end python_20 ----------
pt_40 = Point(python_19.first_pt)
pt_41 = Point(python_19.seed_pts)
pt_42 = Point(python_19.short_streamlines)
pt_43 = Point(python_19.offsets)
pt_44 = Point(python_19.streamlines)
data_36 = Data(python_19.streamlines_objects)
pt_45 = Point(python_20.streamlines)
pt_46 = Point(python_20.first_pt)
pt_47 = Point(python_20.short_streamlines)
pt_48 = Point(python_20.seed_pts)
data_37 = Data(python_20.streamlines_objects)
pt_49 = Point(python_20.offsets)

pt_50 = Point(pt_43)
pt_51 = Point(pt_42)
pt_52 = Point(pt_44)
pline_4 = PolyLine(Vertices=pt_52, Closed=False)
pline_5 = PolyLine(Vertices=pt_50, Closed=False)
pline_6 = PolyLine(Vertices=pt_51, Closed=False)
crv_25 = Curve(pline_4)
crv_26 = Curve(pline_5)
crv_27 = Curve(pline_6)

pt_53 = Point(pt_47)
pt_54 = Point(pt_49)
pt_55 = Point(pt_45)
pline_7 = PolyLine(Vertices=pt_55, Closed=False)
pline_8 = PolyLine(Vertices=pt_54, Closed=False)
pline_9 = PolyLine(Vertices=pt_53, Closed=False)
crv_28 = Curve(pline_8)
crv_29 = Curve(pline_7)
crv_30 = Curve(pline_9)

crv_31 = Curve(crv_25)
crv_32 = Curve(crv_25)
crv_33 = Curve(crv_29)
crv_34 = Curve(crv_29)
tstat_2 = TreeStatistics(Tree=crv_31)  # -> Paths, Length, Count
flatten_7 = FlattenTree(Tree=crv_32, Path="{0}")
tstat_3 = TreeStatistics(Tree=crv_34)  # -> Paths, Length, Count
flatten_8 = FlattenTree(Tree=crv_33, Path="{0}")
crv_35 = Curve(crv_29)
series_3 = Series(Start=0, Step=1, Count=tstat_2.Count)
eval_3 = EvaluateCurve(Curve=reparameterize(flatten_7), Parameter="0.5")  # -> Point, Tangent, Angle
series_4 = Series(Start=0, Step=1, Count=tstat_3.Count)
eval_4 = EvaluateCurve(Curve=reparameterize(flatten_8), Parameter="0.5")  # -> Point, Tangent, Angle
gradient_6 = Gradient(
    LowerLimit=0,
    UpperLimit=expr("x-1", tstat_2.Count),
    Parameter=series_3,
    stops=[0: RGB(255, 255, 255), 0.498: RGB(89, 147, 247), 1: RGB(20, 2, 107)])
gradient_7 = Gradient(
    LowerLimit=0,
    UpperLimit=expr("x-1", tstat_3.Count),
    Parameter=series_4,
    stops=[0: RGB(255, 255, 255), 0.498: RGB(89, 147, 247), 1: RGB(20, 2, 107)])
intersection_2 = SetIntersection(SetA=eval_3.Point, SetB=eval.Point)
intersection_3 = SetIntersection(SetA=eval_4.Point, SetB=eval_2.Point)
item_12 = ListItem(List=flatten(crv_35), Index=Slider(19, range=0..100), Wrap=True)
mindex_2 = MemberIndex(Set=eval.Point, Member=intersection_2)  # -> flatten(Index), Count
mindex_3 = MemberIndex(Set=eval_2.Point, Member=intersection_3)  # -> flatten(Index), Count
cull_i_3 = CullIndex(List=flatten, Indices=mindex_2.Index, Wrap=True)
cull_i_4 = CullIndex(List=flatten_2, Indices=mindex_3.Index, Wrap=True)
graft_22 = GraftTree(Tree=gradient_6, IncludeEmptyLists=True, IncludeNullItems=True)
graft_23 = GraftTree(Tree=gradient_7, IncludeEmptyLists=True, IncludeNullItems=True)
smoothpline = SmoothPolyline(Polyline=crv_31, Strength=1, Times="50")
previewlw_2 = CustomPreviewLineweights(Geometry=cull_i_3, Shader=ColourSwatch(SwatchColor=RGB(107, 107, 107)), Thickness="3", Absolute=False)
previewlw_3 = CustomPreviewLineweights(Geometry=crv_31, Shader=graft_22, Thickness="3", Absolute=False)
previewlw_4 = CustomPreviewLineweights(Geometry=crv_34, Shader=graft_23, Thickness="3", Absolute=False)
previewlw_5 = CustomPreviewLineweights(Geometry=cull_i_4, Shader=ColourSwatch(SwatchColor=RGB(107, 107, 107)), Thickness="3", Absolute=False)

# ---- group: The Bridge
pt_56 = Point()  # disabled
pt_57 = Point()  # disabled
mesh_14 = Mesh()  # disabled
data_38 = Data(data_12)  # disabled

# ----
crv_36 = Curve(crv_25)
crv_37 = Curve(pline_7)
crv_38 = Curve(cull_i_4)
crv_39 = Curve(cull_i_3)
pt_58 = ConstructPoint(XCoordinate="0.02", YCoordinate=0, ZCoordinate=0)
pt_59 = ConstructPoint(XCoordinate="0", YCoordinate=0, ZCoordinate=0)
entwine_19 = Entwine(Branch00=crv_36, Branch01=crv_37, FlattenInputs=True)
yz_2 = YZPlane(Origin=pt_58)
entwine_20 = Entwine(Branch00=crv_39, Branch01=crv_38, FlattenInputs=True)
yz_3 = YZPlane(Origin=pt_59)
mirror_2 = Mirror(Geometry=entwine_19, Plane=yz_2)  # -> Geometry, Transform
mirror_3 = Mirror(Geometry=entwine_20, Plane=yz_3)  # -> Geometry, Transform
merge_12 = Merge(Data1=entwine_19, Data2=mirror_2.Geometry)
merge_13 = Merge(Data1=entwine_20, Data2=mirror_3.Geometry)
rad = Radians(Degrees="90")
rad_2 = Radians(Degrees="180")
rotate = Rotate(Geometry=merge_12, Angle=rad_2, Plane=PlaneXY(0, 0, 0))  # -> Geometry, Transform
rotate_2 = Rotate(Geometry=merge_13, Angle=rad, Plane=PlaneXY(0, 0, 0))  # -> Geometry, Transform
previewlw_6 = CustomPreviewLineweights(Geometry=rotate.Geometry, Shader=ColourSwatch(SwatchColor=RGB(255, 255, 255)), Thickness="3", Absolute=False)
previewlw_7 = CustomPreviewLineweights(Geometry=merge_13, Shader=ColourSwatch(SwatchColor=RGB(255, 255, 255)), Thickness="3", Absolute=False)

mesh_15 = Mesh(mesh_12)

demesh_2 = DeconstructMesh(Mesh=mesh_15)  # -> Vertices, Faces, Colours, Normals

num_109 = Number(num_108)
bnd_6 = Bounds(Numbers=num_109)
python_21 = GhPythonScript(x=num_109)  # -> out, a; inputs x: list
# ---------- python_21: Python ----------
__author__ = "ARPJ"
__version__ = "2018.08.01"

import rhinoscriptsyntax as rs

def normalise_data(data, cmin=None, cmax=None):
    fmax = cmax if cmax is not None else max([abs(x) for x in data])
    fmin = cmin if cmin is not None else min([abs(x) for x in data])
    fabs = max([abs(fmin), abs(fmax)])

    fscaled = []
    for value in data:
        new_val = value / fabs
        if new_val > 1:
            new_val = 1
        elif new_val < -1:
            new_val = -1
        fscaled.append(new_val)
    return fscaled

a = normalise_data(x)
# ---------- end python_21 ----------
dedomain = DeconstructDomain(Domain=bnd_6)  # -> Start, End
range_4 = Range(Domain=bnd_6, Steps="15")
neg_3 = Negative(Value=dedomain.End)
gradient_8 = Gradient(
    LowerLimit=neg_3,
    UpperLimit=dedomain.End,
    Parameter=range_4,
    stops=[0: RGB(255, 0, 0), 0.176: RGB(255, 238, 0), 0.35: RGB(0, 255, 234), 0.504: RGB(35, 4, 128), 0.664: RGB(0, 252, 215), 0.843: RGB(255, 255, 0), 1: RGB(255, 0, 47)])
gradient_9 = Gradient(
    LowerLimit="-1",
    UpperLimit="1",
    Parameter=python_21.a,
    stops=[0: RGB(255, 0, 0), 0.176: RGB(255, 238, 0), 0.35: RGB(0, 255, 234), 0.504: RGB(35, 4, 128), 0.664: RGB(0, 252, 215), 0.843: RGB(255, 255, 0), 1: RGB(255, 0, 47)])
num_110 = Number(range_4)
col_18 = Colour(gradient_8)

num_111 = Number(num_110)
col_19 = Colour(col_18)
legend_4 = Legend(Colour=col_19, Tags=num_111, LegendType=1)

gradient_10 = Gradient(
    LowerLimit="-1",
    UpperLimit="1",
    Parameter=python_21.a,
    stops=[0: RGB(255, 0, 0), 0.254: RGB(255, 238, 0), 0.423: RGB(0, 255, 234), 0.504: RGB(35, 4, 128), 0.56: RGB(0, 252, 215), 0.719: RGB(255, 255, 0), 1: RGB(255, 0, 47)])
num_112 = Number(python_21.a)

col_20 = Colour(gradient_10)

col_21 = Colour(col_20)

conmesh = ConstructMesh(Vertices=demesh_2.Vertices, Faces=demesh_2.Faces, Colours=col_21)
move_8 = Move(Geometry=conmesh, Motion=X)  # -> Geometry, Transform
wbedges_2 = WeaverbirdsMeshEdges(MeshOrPolylines=move_8.Geometry)
mblur = BlurMesh(Mesh=conmesh, Iterations=1)
previewlw_8 = CustomPreviewLineweights(Geometry=wbedges_2, Shader=ColourSwatch(SwatchColor=RGB(3, 3, 3)), Absolute=False)
mesh_16 = Mesh(mblur)

pt_60 = Point(pt_26)
X_5 = UnitX(Factor="0")
move_9 = Move(Geometry=pt_60, Motion=X_5)  # -> Geometry, Transform
pline_10 = PolyLine(Vertices=move_9.Geometry, Closed="True")
from_polylines = FromPolylines(Polylines=flatten(pline_10), Weld=-1, Min_Triangulation=False)
ngon_2 = NGon(Mesh=flatten(from_polylines), LineWeight=1)
ngonfaces = NGonFaces(Mesh=ngon_2)  # -> F, I
crv_40 = Curve(pline_10)
crv_41 = Curve(pline_10)
explode_3 = Explode(Curve=crv_40, Recursive=True)  # -> Segments, Vertices
explode_4 = Explode(Curve=crv_41, Recursive=True)  # -> Segments, Vertices
plfit = PlaneFit(Points=explode_4.Vertices)  # -> Plane, Deviation
project = Project(Geometry=crv_41, Plane=plfit.Plane)  # -> Geometry, Transform
crv_42 = Curve(pline_10)
crv_43 = Curve(crv_42)
pt_61 = Point(pt_27)
panel_39 = Panel("0")
X_6 = UnitX(Factor=panel_39)
swatch_3 = ColourSwatch(SwatchColor=RGB(0, 0, 0))
move_10 = Move(Geometry=pt_61, Motion=X_6)  # -> Geometry, Transform
dots_2 = DotDisplay(Point=move_10.Geometry, Colour=swatch_3, Size="0.01")  # disabled

crv_44 = Curve(ngonfaces.F)
rdlines_2 = RemoveDuplicateLinesKaramba(Line=explode_3.Segments, LimitDistance=0.005)  # -> OutLine, Info, Indexes
rdpoints_2 = RemoveDuplicatePointsKaramba(Point=explode_3.Vertices, LimitDistance=0.005)  # -> OutPoint, Info, Indexes
del = DelaunayMesh(Points=rdpoints_2.OutPoint, Plane=PlaneXY(0, 0, 0))
wbnaked_2 = WeaverbirdsNakedBoundary(MeshClosedPolylines=del)
mesh_17 = Mesh(del)
crv_45 = Curve(crv_42)
explode_5 = Explode(Curve=crv_45, Recursive=True)  # -> Segments, Vertices
flatten_9 = FlattenTree(Tree=explode_5.Segments, Path="{0}")
wbedges_3 = WeaverbirdsMeshEdges(MeshOrPolylines=crv_43)
flatten_10 = FlattenTree(Tree=explode_5.Vertices, Path="{0}")
rdpoints_3 = RemoveDuplicatePointsKaramba(Point=flatten_10, LimitDistance=0.005)  # -> OutPoint, Info, Indexes
rdlines_3 = RemoveDuplicateLinesKaramba(Line=flatten_9, LimitDistance=0.005)  # -> OutLine, Info, Indexes
cir_2 = Circle(Plane=rdpoints_3.OutPoint, Radius="0.035")
crv_46 = Curve(cir_2)
line_27 = Line(rdlines_3.OutLine)
crv_47 = Curve(wbedges_3)
crv_48 = Curve(crv_47)
rdlines_4 = RemoveDuplicateLinesKaramba(Line=flatten(crv_48), LimitDistance=0.005)  # -> OutLine, Info, Indexes
line_28 = Line(rdlines_4.OutLine)
crv_49 = Curve([line_28, crv_24])
previewlw_9 = CustomPreviewLineweights(Geometry=crv_49, Shader=ColourSwatch(SwatchColor=RGB(0, 0, 0)), Thickness="2", Absolute=False)

wbweave = WeaverbirdsMeshFromLinesWeaveBack(Lines=rdlines_2.OutLine, MaximumValence=4)
trim_2 = TrimTree(Tree=wbweave, Depth=1)
area = Area(Geometry=trim_2)  # -> Area, Centroid
project_2 = Project(Geometry=area.Centroid, Plane=plfit.Plane)  # -> Geometry, Transform
incurve = PointInCurve(Point=project_2.Geometry, Curve=project.Geometry)  # -> Relationship, Point
larger_2 = LargerThan(FirstNumber=incurve.Relationship, SecondNumber="1")  # -> LargerThan, OrEqualTo
cull_4 = CullPattern(List=trim_2, CullPattern=larger_2.OrEqualTo)
wbjoin = WeaverbirdsJoinMeshesAndWeld(Mesh=cull_4, Weld=False)
mesh_18 = Mesh(wbjoin)
mesh_19 = Mesh(mesh_17)
geo = Geometry(flatten(mesh_18))
lng_4 = ListLength(List=flatten(geo))
subtraction = Subtraction(A=lng_4, B=1)
range_5 = Range(Domain=Domain(0, 1), Steps=subtraction)
gradient_11 = Gradient(
    LowerLimit=0,
    UpperLimit=1,
    Parameter=range_5,
    stops=[0: RGB(243, 57, 0), 0.1: RGB(236, 27, 60), 0.2: RGB(210, 0, 118), 0.3: RGB(103, 0, 120), 0.4: RGB(39, 72, 161), 0.5: RGB(1, 192, 229), 0.6: RGB(18, 178, 90), 0.7: RGB(79, 186, 8), 0.8: RGB(220, 237, 32), 0.9: RGB(247, 159, 20), 1: RGB(243, 57, 0)])
previewlw_10 = CustomPreviewLineweights(Geometry=wbedges_3, Shader=swatch_3, Thickness="2", Absolute=False)

area_2 = Area(Geometry=flatten(mesh_19))  # -> Area, Centroid
pdecon = Deconstruct(Point=area_2.Centroid)  # -> XComponent, YComponent, ZComponent
bnd_7 = Bounds(Numbers=area_2.Area)
bnd_8 = Bounds(Numbers=pdecon.YComponent)
dedomain_2 = DeconstructDomain(Domain=bnd_7)  # -> Start, End
wbjoin_2 = WeaverbirdsJoinMeshesAndWeld(Mesh=flatten(mesh_19), Weld=False)
dedomain_3 = DeconstructDomain(Domain=bnd_8)  # -> Start, End
gradient_12 = Gradient(
    LowerLimit=dedomain_2.Start,
    UpperLimit=dedomain_2.End,
    Parameter=area_2.Area,
    stops=[0: RGB(234, 38, 0), 0.25: RGB(234, 126, 0), 0.5: RGB(254, 244, 84), 0.75: RGB(173, 203, 249), 1: RGB(75, 107, 169)])
gradient_13 = Gradient(
    LowerLimit=dedomain_3.End,
    UpperLimit=dedomain_3.Start,
    Parameter=pdecon.YComponent,
    stops=[0: RGB(243, 57, 0), 0.1: RGB(236, 27, 60), 0.2: RGB(210, 0, 118), 0.3: RGB(103, 0, 120), 0.4: RGB(39, 72, 161), 0.5: RGB(1, 192, 229), 0.6: RGB(18, 178, 90), 0.7: RGB(79, 186, 8), 0.8: RGB(220, 237, 32), 0.9: RGB(247, 159, 20), 1: RGB(243, 57, 0)])
wblaplace = WeaverbirdsLaplacianSmoothing(MeshCurves=wbjoin_2, Level=Slider(0, range=0..10), SmoothNakedEdges=0, Thin=1)
wbfacepolys = WeaverbirdsFacePolylines(Mesh=wblaplace)

material = CreateMaterial(
    Diffuse=gradient_12,
    Specular=RGB(255, 255, 255),
    Emission=RGB(0, 0, 0),
    Transparency=Slider(0, range=0..1),
    Shine=Slider(27, range=0..100))
preview_8 = CustomPreview(Geometry=flatten(mesh_19), Material=material)

# ==== cluster Cluster
mesh = ClusterInput()
vec = ClusterInput()
mesh_2 = Mesh(mesh)
vec_2 = Vector(vec)
facen = FaceNormals(Mesh=mesh_2)  # -> Centers, Normals
pl = PlaneNormal(Origin=facen.Centers, ZAxis=facen.Normals)
move = Move(Geometry=facen.Centers, Motion=vec_2)  # -> Geometry, Transform
project = Project(Geometry=move.Geometry, Plane=pl)  # -> Geometry, Transform
vec2pt = Vector2Pt(PointA=facen.Centers, PointB=project.Geometry, Unitize="True")  # -> Vector, Length
xprod = CrossProduct(VectorA=facen.Normals, VectorB=vec2pt.Vector, Unitize="True")  # -> Vector, Length
vec_3 = Vector(xprod.Vector)
vec_4 = Vector(vec2pt.Vector)
vec_5 = ClusterOutput(vec_3)
vec_6 = ClusterOutput(vec_4)
